# Grasshopper definition 3_SimpleWindAnalysisWithTerrain.ghx (Grasshopper 1.0.8)
# plug-ins: Eddy3D

# ----
# 1. Geometry &
# Boundary Conditions
panel = Panel("0")
abl = ABL(WDir=panel, Uref=5, Zref=10, Z0=1, ZGround=0)

geo = Geometry(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)
cluster = Cluster_2()
# 2. Simulation Domain
dombox = BoxDomain(
    Buildings=cluster,
    Terrain=geo,
    BoundaryCondition=abl,
    CellSize=20,
    Length=Slider(1000, range=0..1000),
    Width=Slider(500, range=0..1000))  # -> Domain, PreviewMesh
cluster_2 = Cluster_3(G=geo, S=dombox.PreviewMesh)
Z = UnitZ(Factor="2")

# ----
# 3. Mesh & Simulation
panel_2 = Panel("3")
panel_3 = Panel("C:\Eddy3D-Cases\3_SimpleWindAnalysisWithTerrain")
rset = RunSettings(
    NumberOfIterations="1200",
    WriteInterval=20,
    NumberOfTimestepsToKeep=3,
    TurbulenceModel=1,
    RelaxationFactors=2,
    SolutionAndAlgorithmControl=1,
    PotentialFoamInitialization=False,
    AgeOfAir=False,
    NumberOfCPUs="6",
    OperatingSystem=0)

mset = MeshSettings(
    BuildingMinLevel=2,
    BuildingMaxLevel=panel_2,
    FeatureLevel=2,
    BoundingBoxLevel=panel_2,
    GroundLevel=2,
    MiscSettings=1,
    BoundaryLayers=4,
    CellsBetweenLevels=4,
    MeshMode=1)

simulation = Simulation(
    SimulationDomain=dombox.Domain,
    WorkingDirectory=panel_3,
    MeshSettings=mset,
    RunSettings=rset,
    RunMeshing=Button(),
    MakeTrees=False,
    RunSimulation=Button())

residuals = VisualizeResiduals(Result=simulation, X=":", Y=":", Version=0, Run=Button(), visResiduals=True)

# ----
# 6. Clean
button = Button()
clean = Clean(Directory=panel_3, Mode=2, Run=button)

# ----
# 4. Probing points & probing
number_slider = Slider(5, range=1..30)
brep = Brep(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)
mjoin = MeshJoin(Meshes=cluster)
brep_2 = Brep(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)

probing = Probing(BuildingMesh=mjoin, GroundMesh=cluster_2, ConvertQuadsToTriangles_2=True)
demesh = DeconstructMesh(Mesh=probing)  # -> Vertices, Faces, Colours, Normals
move = Move(Geometry=demesh.Vertices, Motion=Z)  # -> Geometry, Transform

probing_2 = Probing(Result=simulation, ProbingPoints=move.Geometry, NameOfInstance="ttt", NameOfField=0, Run_2=Button())  # -> PorbingPoints, ProbingResult

# ----
# 5. Post-processing
# 5.1. Paraview
# 5.2. Grasshopper
# Wind vectors
points = Data(probing_2.PorbingPoints)
vectors = Data(probing_2.ProbingResult)
cluster_3 = Cluster(data=vectors)  # -> S, E, data_3
gradient = Gradient(
    LowerLimit=cluster_3.S,
    UpperLimit=Slider(5, range=0..10),
    Parameter=cluster_3.data_3,
    stops=[0.103: RGB(0, 0, 255), 0.22: RGB(0, 170, 255), 0.305: RGB(0, 255, 255), 0.398: RGB(0, 255, 188), 0.504: RGB(0, 255, 106), 0.605: RGB(91, 255, 0), 0.699: RGB(184, 255, 0), 0.799: RGB(255, 255, 0), 0.898: RGB(255, 170, 0)])
vdisex = VectorDisplayEx(Point=points, Vector=vectors, Colour=gradient, Width=Slider(2, range=0..10))

paraview = Paraview(Result=simulation, ParaviewVersion=2, Run=Button())

# ==== cluster Cluster
data = ClusterInput()
data_2 = Data(data)
data_3 = ClusterOutput(data_2)
bnd = Bounds(Numbers=data_2)
dedomain = DeconstructDomain(Domain=bnd)  # -> Start, End
S = ClusterOutput(dedomain.Start)
E = ClusterOutput(dedomain.End)

# ==== cluster Cluster_2
geo = Geometry([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])
mesh = Mesh(geo)
mjoin = MeshJoin(Meshes=mesh)
M = ClusterOutput(mjoin)

# ==== cluster Cluster_3
G = ClusterInput()
Z = UnitZ(Factor=Slider(2, range=0..10))
move = Move(Geometry=G, Motion=Z)  # -> Geometry, Transform
mesh = Mesh(move.Geometry)
S = ClusterInput()
geo = Geometry(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)
mesh_2 = Mesh(geo)
msplit = MeshSplit(Mesh=mesh, Splitters=S)
item = ListItem(List=msplit, Index=1, Wrap=True)
msplit_2 = MeshSplit(Mesh=item, Splitters=mesh_2)
item_2 = ListItem(List=msplit_2, Index=1, Wrap=True)
refine = Refine(Mesh=item_2, Level=Slider(2, range=0..10))
M = ClusterOutput(refine)
