# Grasshopper definition 5_PressureOnBuildingFacade.ghx (Grasshopper 1.0.8)
# plug-ins: Eddy3D

# ----
# 0. Download Weather
panel = Panel("https://energyplus-weather.s3.amazonaws.com/asia_wmo_region_2/IND/IND_Ahmedabad.426470_IWEC/IND_Ahmedabad.426470_IWEC.epw")

# ----
# 1. Geometry &
# Boundary Conditions
panel_2 = Panel("""0
45
90
135
180
225
270
320""")

abl_flow = ABLFlow(WindDirections=panel_2)
cluster = Cluster_2()

# ----
# 2. Simulation Domain
number_slider = Slider(40, range=0..1000)

domcyl = CylindricalDomain(
    Buildings=cluster,
    BoundaryCondition=abl_flow,
    CellSize="15",
    InnerSize=number_slider,
    OuterRadius=Slider(519, range=0..1000),
    Height=Slider(80, range=0..1000),
    RadialMultiplier=2,
    XDivisions=1)  # -> Domain, PreviewMesh
cellsz = MeshCellSize(Domain=domcyl.Domain, BaseCellSize="15", TargetCellSize=Slider(2, range=0..10))  # -> RefinementLevel, RefinementLevel1
panel_3 = Panel("C:\Eddy3D-Cases\5_PressureOnBuildingFacade")
c_script = CSharpScript(url=panel, saveTo=panel_3)  # -> out, epwPath; inputs url: String, saveTo: String
# ---------- c_script: C# ----------
// Grasshopper Script Instance
#region Usings
using System;
using System.Linq;
using System.Collections;
using System.Collections.Generic;
using System.Drawing;
using System.IO;
using System.Net.Http;
using System.Threading.Tasks;

using Rhino;
using Rhino.Geometry;

using Grasshopper;
using Grasshopper.Kernel;
using Grasshopper.Kernel.Data;
using Grasshopper.Kernel.Types;
#endregion

public class Script_Instance : GH_ScriptInstance
{
    private void RunScript(string url, string saveTo, ref object epwPath)
    {
        try
        {
            // Validate inputs
            if (string.IsNullOrWhiteSpace(url))
            {
                Print("URL is invalid.");
                return;
            }

            if (string.IsNullOrWhiteSpace(saveTo) || !Directory.Exists(saveTo))
            {
                Print("Save folder is invalid.");
                return;
            }

            // Extract the file name from the URL
            string fileName = Path.GetFileName(new Uri(url).AbsolutePath);
            if (string.IsNullOrWhiteSpace(fileName))
            {
                Print("Failed to extract file name from URL.");
                return;
            }

            // Construct the full file path
            string filePath = Path.Combine(saveTo, fileName);

            // Check if the file already exists
            if (File.Exists(filePath))
            {
                Print($"File already exists at {filePath}, skipping download.");
                epwPath = filePath;
                return;
            }

            // Execute the asynchronous method synchronously
            Task.Run(async () =>
            {
                await FileDownloader.DownloadFileAsync(url, filePath);
            }).Wait();

            Print($"File downloaded successfully to {filePath}");
            epwPath = filePath;
        }
        catch (Exception ex)
        {
            Print($"Failed to download file: {ex.Message}");
        }
    }
}

public static class FileDownloader
{
    /// <summary>
    /// Asynchronously downloads a file from the specified URL and saves it to the given file path.
    /// </summary>
    /// <param name="url">The URL of the file to download.</param>
    /// <param name="filePath">The local file path to save the downloaded file.</param>
    public static async Task DownloadFileAsync(string url, string filePath)
    {
        // Validate inputs
        if (string.IsNullOrWhiteSpace(url))
            throw new ArgumentException("URL cannot be null or empty.", nameof(url));

        if (string.IsNullOrWhiteSpace(filePath))
            throw new ArgumentException("File path cannot be null or empty.", nameof(filePath));

        // Ensure the directory exists
        var directory = Path.GetDirectoryName(filePath);
        if (!string.IsNullOrEmpty(directory) && !Directory.Exists(directory))
        {
            Directory.CreateDirectory(directory);
        }

        try
        {
            // Download file using HttpClient
            using var httpClient = new HttpClient();
            using var response = await httpClient.GetAsync(url, HttpCompletionOption.ResponseHeadersRead);
            response.EnsureSuccessStatusCode();

            // Save the file
            await using var fileStream = new FileStream(filePath, FileMode.Create, FileAccess.Write, FileShare.None);
            await response.Content.CopyToAsync(fileStream);
        }
        catch (Exception ex)
        {
            Console.WriteLine($"Error downloading file: {ex.Message}");
            throw;
        }
    }
}
# ---------- end c_script ----------
panel_4 = Panel(c_script.out)

# ----
# 3. Mesh & Simulation
button = Button()

mset = MeshSettings(
    AccBuilding=cellsz.RefinementLevel,
    AccFeatures=cellsz.RefinementLevel1,
    AccBBox=0,
    AccGround=cellsz.RefinementLevel,
    MiscSettings=1,
    NumberOfLayers=4,
    Mode=1,
    CellsBetweenLevels=4,
    MeshMode=1)
rset = RunSettings(
    NumberOfIterations="1200",
    WriteInterval=20,
    NumberOfTimestepsToKeep=3,
    TurbulenceModel=2,
    RelaxationFactors=2,
    SolutionAndAlgorithmControl=1,
    PotentialFoamInitialization=False,
    AgeOfAir=False,
    NumberOfCPUs="6",
    OperatingSystem=0)
simulation = Simulation(
    SimulationDomain=domcyl.Domain,
    WorkingDirectory=panel_3,
    MeshSettings=mset,
    RunSettings=rset,
    RunMeshing=button,
    MakeTrees=False,
    RunSimulation=Button())
residuals = VisualizeResiduals(Result=simulation, X="0", Y=":", Version=0, Run=Button(), visResiduals=True)
qrmesh = QuadRemesh(Geometry=cluster, Settings={aqc=True, as=50, dhe=True, gci=0, null=False, pme=2, sa=0, tqc=2000})
demesh = DeconstructMesh(Mesh=qrmesh)  # -> Vertices, Faces, Colours, Normals

# ----
# 4.2. Probing points & probing
panel_5 = Panel("pressure100")

probing = Probing(
    Result=simulation,
    ProbingPoints=demesh.Vertices,
    NameOfInstance=panel_5,
    InterpolationScheme=2,
    NameOfField=1,
    Run=Button())  # -> ProbingPoints, ProbingResult

# ----
# 6. Clean
button_2 = Button()
clean = Clean(Directory=simulation, Mode=2, Run=button_2)

# ----
# 5. Post-processing
# 5.1. Change wind direction
number_slider_2 = Slider(6, range=0..7)
branch = TreeBranch(Tree=probing.ProbingResult, Path=number_slider_2, MaintainPaths=True)
cluster_2 = Cluster(data=branch)  # -> S, E, data_3
gradient = Gradient(
    LowerLimit="-1",
    UpperLimit="1",
    Parameter=cluster_2.data_3,
    stops=[0.103: RGB(0, 0, 255), 0.22: RGB(0, 170, 255), 0.305: RGB(0, 255, 255), 0.398: RGB(0, 255, 188), 0.504: RGB(0, 255, 106), 0.605: RGB(91, 255, 0), 0.699: RGB(184, 255, 0), 0.799: RGB(255, 255, 0), 0.898: RGB(255, 170, 0)])
conmesh = ConstructMesh(Vertices=demesh.Vertices, Faces=demesh.Faces, Colours=gradient)

# ==== cluster Cluster
data = ClusterInput()
data_2 = Data(data)
data_3 = ClusterOutput(data_2)
bnd = Bounds(Numbers=data_2)
dedomain = DeconstructDomain(Domain=bnd)  # -> Start, End
S = ClusterOutput(dedomain.Start)
E = ClusterOutput(dedomain.End)

# ==== cluster Cluster_2
geo = Geometry([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])
mesh = Mesh(geo)
mjoin = MeshJoin(Meshes=mesh)
M = ClusterOutput(mjoin)
