# Grasshopper definition 97_ExportResultsAsGeoJSON.ghx (Grasshopper 1.0.8)
# plug-ins: MeshEdit Components, Eddy3D, Urbano.Grasshopper

geographic_boundary = GeographicBoundary(Left="-76.5078", Top="42.4515", Right="-76.4746", Bottom="42.4342")  # -> Boundary, CoordinateReference
workflow_template = WorkflowTemplate()  # -> Directories, Templates
project_setting = ProjectSetting(Directory=workflow_template.Directories, Boundary=geographic_boundary.Boundary, Run=True)
simple_simulation_engine = SimpleSimulationEngine(ProjectSetting=project_setting, SaveToFile=True, Run=Button())  # -> ProjectSetting, Trips, StreetNetwork, PublicTransitNetwork, Blocks
import_street_network = ImportStreetNetwork(ProjectSetting=project_setting, Terrain=False, Run=True)  # -> ProjectSetting, StreetNetwork, Polylines

crv = Curve([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])
crv_2 = Curve(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)
qrsettings = QuadRemeshSettings(
    TargetCount=Slider(100000, range=0..1000000),
    AdaptiveSize=0,
    AdaptiveCount=False,
    HardEdges=False,
    SeamEdges=0,
    Symmetry=0,
    GuideCurves=0)
qrsettings_2 = QuadRemeshSettings(TargetCount="100", AdaptiveSize=0, AdaptiveCount=False, HardEdges=False, SeamEdges=0, Symmetry=0, GuideCurves=0)
srf = Surface(crv_2)
srf_2 = Surface(crv)
qrmesh = QuadRemesh(Geometry=srf_2, Settings=qrsettings_2)
qrmesh_2 = QuadRemesh(Geometry=srf, Settings=qrsettings)
probing = Probing(BuildingMesh=qrmesh, GroundMesh=qrmesh_2, TargetCount=50000, ConvertQuadsToTriangles=True)
demesh = DeconstructMesh(Mesh=probing)  # -> Vertices, Faces, Colours, Normals
area = Area(Geometry=probing)  # -> Area, Centroid
dist = Distance(PointA=area.Centroid, PointB=demesh.Vertices)
explode = MeshExplode(Mesh=probing, Interpolate=False)
area_2 = Area(Geometry=explode)  # -> Area, Centroid
dist_2 = Distance(PointA=area_2.Centroid, PointB=area.Centroid)
bnd = Bounds(Numbers=dist)
dedomain = DeconstructDomain(Domain=bnd)  # -> Start, End

export_to_urbano_viewer = ExportToUrbanoViewer(ProjectSetting=project_setting, Trips=simple_simulation_engine.Trips, Blocks=simple_simulation_engine.Blocks)
panel = Panel(export_to_urbano_viewer)

gradient = Gradient(
    LowerLimit=dedomain.Start,
    UpperLimit=dedomain.End,
    Parameter=dist,
    stops=[0: RGB(234, 38, 0), 0.25: RGB(234, 126, 0), 0.5: RGB(254, 244, 84), 0.75: RGB(173, 203, 249), 1: RGB(75, 107, 169)])
data = Data(dist_2)

coordinate_reference = CoordinateReference(geographic_boundary.CoordinateReference)
file_path = FilePath("C:\Temp\EXPORT.geojson")
save_data_to_geojson = SaveDataToGeojson(Geometries=explode, Metadata=data, FilePath=file_path, CoordinateReference=coordinate_reference, Run=True)  # disabled
panel_2 = Panel(save_data_to_geojson)

conmesh = ConstructMesh(Vertices=demesh.Vertices, Faces=demesh.Faces, Colours=gradient)
