# Grasshopper definition 98_VolumetricFlowRates.ghx (Grasshopper 1.0.8)
# plug-ins: Eddy3D

# ----
# 1. Geometry &
# Boundary Conditions
panel = Panel("0")
abl = ABL(WDir=panel, Uref=5, Zref=10, Z0=1, ZGround=0)

cluster = Cluster()
uniform_flow = UniformFlow(ReferenceVelocity_m_s=5, SurfaceRoughnessHeight_m=1)

# ----
# 2. Simulation Domain
domainbox = BoxShapedDomain(Geometry=cluster, BoundaryCondition=uniform_flow, BlockSize=20)  # -> Domain, Mesh

# ----
# 4. Probing points & probing
number_slider = Slider(5, range=1..30)
brep = Brep(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)
brep_2 = Brep(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)
rad = Radians(Degrees=Slider(67.5, range=0..100))
brep_3 = Brep(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)
meshplane = MeshPlane(brep=brep_3, number=number_slider)
area = Area(Geometry=brep_3)  # -> Area, Centroid
area_2 = Area(Geometry=brep_3)  # -> Area, Centroid
rad_2 = Radians(Degrees=Slider(45, range=0..100))
rot3d = Rotate3D(Geometry=brep_3, Angle=rad, Center=area.Centroid, Axis=Vector(0, 0, 1))  # -> Geometry, Transform
panel_2 = Panel(area.Area)
cos = Cosine(Value=rad)
panel_3 = Panel(area_2.Area)
cos_2 = Cosine(Value=rad_2)
rot3d_2 = Rotate3D(Geometry=brep_3, Angle=rad_2, Center=area_2.Centroid, Axis=Vector(0, 0, 1))  # -> Geometry, Transform
mesh = MeshBrep(
    Brep=brep_3,
    Settings={GridMaxCount=0, GridMinCount=16, JaggedSeams=False, MaxEdgeLength=0, MinEdgeLength=0.0001, MinTolerance=0, Refine=True, RefineAngle=0, RelativeTolerance=0.65, SimplePlanes=True, Tolerance=0})
area_3 = Area(Geometry=brep_3)  # -> Area, Centroid
mesh_2 = MeshBrep(
    Brep=rot3d.Geometry,
    Settings={GridMaxCount=0, GridMinCount=16, JaggedSeams=False, MaxEdgeLength=0, MinEdgeLength=0.0001, MinTolerance=0, Refine=True, RefineAngle=0, RelativeTolerance=0.65, SimplePlanes=True, Tolerance=0})
mesh_3 = MeshBrep(
    Brep=rot3d_2.Geometry,
    Settings={GridMaxCount=0, GridMinCount=16, JaggedSeams=False, MaxEdgeLength=0, MinEdgeLength=0.0001, MinTolerance=0, Refine=True, RefineAngle=0, RelativeTolerance=0.65, SimplePlanes=True, Tolerance=0})
panel_4 = Panel(area_3.Area)
flipm = FlipMesh(Mesh=mesh, VertexNormals=True, FaceNormals=True, FaceOrientation=True)
flipm_2 = FlipMesh(Mesh=mesh_2, VertexNormals=True, FaceNormals=True, FaceOrientation=True)
flipm_3 = FlipMesh(Mesh=mesh_3, VertexNormals=True, FaceNormals=True, FaceOrientation=True)
demesh = DeconstructMesh(Mesh=flipm)  # -> Vertices, Faces, Colours, Normals
demesh_2 = DeconstructMesh(Mesh=flipm_2)  # -> Vertices, Faces, Colours, Normals
demesh_3 = DeconstructMesh(Mesh=flipm_3)  # -> Vertices, Faces, Colours, Normals
vdis = VectorDisplay(Anchor=demesh.Vertices, Vector=demesh.Normals)
vdis_2 = VectorDisplay(Anchor=demesh_2.Vertices, Vector=demesh_2.Normals)
vdis_3 = VectorDisplay(Anchor=demesh_3.Vertices, Vector=demesh_3.Normals)

# ----
# 3. Mesh & Simulation
panel_5 = Panel("100")
button = Button()
panel_6 = Panel("C:\3_SimpleWindAnalysis")
rset = RunSettings(
    NumberOfIterations=panel_5,
    WriteInterval=20,
    NumberOfTimestepsToKeep=3,
    TurbulenceModel=1,
    RelaxationFactors=3,
    SolutionAndAlgorithmControl=1,
    PotentialFoamInitialization=False,
    AgeOfAir=False,
    NumberOfCPUs="4",
    OperatingSystem=0)

mset = MeshSettings(AccBuilding=2, AccFeatures="3", AccBBox=0, AccGround="3", MiscSettings=1, NumberOfLayers=4, Mode=2)

simulation = Simulation(
    SimulationDomain=domainbox.Domain,
    WorkingDirectory=panel_6,
    MeshSettings=mset,
    RunSettings=rset,
    RunMeshing=Button(),
    MakeTrees=False,
    RunSimulation=Button(),
    runWithBlueCFD=True)
residuals = Residuals(Result=simulation, X=":", visResiduals=True)

visprobes = VisualizeProbes(Result=simulation, ProbingPoints=demesh_2.Vertices, NameOfInstance="ttttt", NameOfField=0, Run=Button(), Run_2=False)  # -> PorbingPoints, ProbingResult
visprobes_2 = VisualizeProbes(Result=simulation, ProbingPoints=demesh_3.Vertices, NameOfInstance="tttt", NameOfField=0, Run=Button(), Run_2=False)  # -> PorbingPoints, ProbingResult
visprobes_3 = VisualizeProbes(Result=simulation, ProbingPoints=demesh.Vertices, NameOfInstance="ttt", NameOfField=0, Run=Button(), Run_2=False)  # -> PorbingPoints, ProbingResult

# ----
# 5. Post-processing
# 5.1. Paraview
button_2 = Button()
paraview = Paraview(Result=simulation, ParaviewVersion=2, Run=button_2)

# ----
# 6. Clean
button_3 = Button()
clean = Clean(Directory=panel_6, Mode=2, Run=button_3)

flow_rates = FlowRates(VelocityVectors=visprobes.ProbingResult, Mesh=flipm_2)  # -> Flows, Centers, FlowDirs
flow_rates_2 = FlowRates(VelocityVectors=visprobes_3.ProbingResult, Mesh=flipm)  # -> Flows, Centers, FlowDirs
flow_rates_3 = FlowRates(VelocityVectors=visprobes_2.ProbingResult, Mesh=flipm_3)  # -> Flows, Centers, FlowDirs
ma = MassAddition(Input=flow_rates_2.Flows)  # -> flatten(Result), PartialResults
vdis_4 = VectorDisplay(Anchor=flow_rates_2.Centers, Vector=flow_rates_2.FlowDirs)
vdis_5 = VectorDisplay(Anchor=flow_rates.Centers, Vector=flow_rates.FlowDirs)
ma_2 = MassAddition(Input=flow_rates.Flows)  # -> flatten(Result), PartialResults
ma_3 = MassAddition(Input=flow_rates_3.Flows)  # -> flatten(Result), PartialResults
vdis_6 = VectorDisplay(Anchor=flow_rates_3.Centers, Vector=flow_rates_3.FlowDirs)
panel_7 = Panel(flow_rates_2.Flows)
multiplication = Multiplication(A=panel_7, B=cos)
multiplication_2 = Multiplication(A=panel_7, B=cos_2)
panel_8 = Panel(flow_rates.Flows)
panel_9 = Panel(multiplication)
panel_10 = Panel(flow_rates_3.Flows)
panel_11 = Panel(multiplication_2)

# ==== cluster MeshPlane
number = ClusterInput()
number_2 = Number(number)
settings_custom = SettingsCustom(
    StitchSeams=True,
    SimplePlanes=False,
    Refine=True,
    MinCount=16,
    MaxCount=400,
    AspectRatio=20,
    MaxDistance=0,
    MaxAngle=20,
    MinEdge=number_2,
    MaxEdge=number_2)
brep = ClusterInput()
mesh_brep = MeshBrep(Brep=brep, Settings=settings_custom)
deconstruct_mesh = DeconstructMesh(Mesh=mesh_brep)  # -> Vertices, Faces, Colours, Normals
vertices = ClusterOutput(deconstruct_mesh.Vertices)

# ==== cluster Cluster
geo = Geometry([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])
mesh = Mesh(geo)
mjoin = MeshJoin(Meshes=mesh)
M = ClusterOutput(mjoin)
