# Grasshopper definition 99_ValidationCaseJiang2003.ghx (Grasshopper 1.0.8)
# plug-ins: Eddy3D

# ----
# Wind tunnel data
# Jiang et al., 2003
# Uy/U_ref
# z/H
cluster = Cluster()
divide = DivideCurve(Curve=cluster, Count="50", Kinks=False)  # -> Points, Tangents, Parameters
panel = Panel("""0.1015
0.1869
0.2631
0.329
0.3837
0.4262
0.4554
0.4722
0.4733
0.4509
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""")
panel_2 = Panel("""0.0408164
0.0816328
0.1224488
0.1632652
0.2040816
0.244898
0.2857144
0.3265308
0.3673468
0.408164
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""")
cluster_2 = Cluster_2(Y=panel, A=panel_2)

# ----
# Mesh
panel_3 = Panel("0.01")
panel_4 = Panel("0.001")
rset = RunSettings(
    NumberOfIterations="2500",
    WriteInterval=20,
    NumberOfTimestepsToKeep=3,
    TurbulenceModel=1,
    RelaxationFactors=3,
    SolutionAndAlgorithmControl=1,
    PotentialFoamInitialization=False,
    AgeOfAir=False,
    NumberOfCPUs="8",
    OperatingSystem=0)

# ----
# Box-shaped simulation domain
panel_5 = Panel("0.005")
abl = ABL(WDir="180", Uref="12", Zref="0.5", Z0=panel_5, ZGround=0)
geo = Geometry(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)
button = Button()

domcyl = CylindricalDomain(Buildings=geo, BoundaryCondition=abl, CellSize="0.25", RadialMultiplier=2, XDivisions=1)  # -> Domain, PreviewMesh
dombox = BoxDomain(Buildings=geo, BoundaryCondition=abl, CellSize="0.25")  # -> Domain, PreviewMesh
cellsz = MeshCellSize(Domain=dombox.Domain, BaseCellSize="0.25", TargetCellSize=panel_3)  # -> RefinementLevel, RefinementLevel1
mset = MeshSettings(
    BuildingMinLevel=cellsz.RefinementLevel,
    BuildingMaxLevel=cellsz.RefinementLevel,
    FeatureLevel=cellsz.RefinementLevel1,
    BoundingBoxLevel=cellsz.RefinementLevel,
    GroundLevel=2,
    MiscSettings=1,
    BoundaryLayers=Slider(3, range=0..10),
    CellsBetweenLevels=4,
    MeshMode=1)

simulation = Simulation(
    SimulationDomain=dombox.Domain,
    WorkingDirectory="C:\Eddy3D-Cases\99_ValidationCaseJiang2003_Box",
    MeshSettings=mset,
    RunSettings=rset,
    RunMeshing=button,
    MakeTrees=False,
    RunSimulation=button)
clean = Clean(ResultDirectory=simulation, Mode=2, Run=Button())
paraview = Paraview(Result=simulation, ParaviewVersion=2, Run=Button())
visprobes = VisualizeProbes(Res=simulation, Points=divide.Points, Name="Validation", Field=0, Run=Button(), Run_2=False)  # -> Points, Result
cluster_3 = Cluster_3(V_2=visprobes.Points, V=visprobes.Result)  # -> Z, R
pt = ConstructPoint(XCoordinate=0, YCoordinate=cluster_3.R, ZCoordinate=cluster_3.Z)
graph = QuickGraph([pt, cluster_2], SortOrder=0)

residuals = VisualizeResiduals(Result=simulation, X=":", Y=":", Version=0, Run=Button(), visResiduals=True)

# ----
# Cylindrical simulation domain
panel_6 = Panel("C:\Eddy3D-Cases\99_ValidationCaseJiang2003_Cyl")
button_2 = Button()

simulation_2 = Simulation(
    SimulationDomain=domcyl.Domain,
    WorkingDirectory=panel_6,
    MeshSettings=mset,
    RunSettings=rset,
    RunMeshing=button_2,
    MakeTrees=False,
    RunSimulation=button_2)
residuals_2 = VisualizeResiduals(Result=simulation_2, X=":", Y=":", Version=0, Run=Button(), visResiduals=True)

clean_2 = Clean(Directory=simulation_2, Mode=2, Run=Button())
paraview_2 = Paraview(Result=simulation_2, ParaviewVersion=2, Run=Button())
visprobes_2 = VisualizeProbes(Res=simulation_2, Points=divide.Points, Name="Validation", Field=0, Run=Button(), Run_2=False)  # -> Points, Result
cluster_4 = Cluster_3(V_2=visprobes_2.Points, V=visprobes_2.Result)  # -> Z, R
pt_2 = ConstructPoint(XCoordinate=0, YCoordinate=cluster_4.R, ZCoordinate=cluster_4.Z)
graph_2 = QuickGraph([pt_2, cluster_2], SortOrder=0)

# ==== cluster Cluster
pt = ConstructPoint(XCoordinate="0.125", YCoordinate="0.125", ZCoordinate="0.5")
pt_2 = ConstructPoint(XCoordinate="0.125", YCoordinate="0.125", ZCoordinate="0.01")
ln = Line(StartPoint=pt_2, EndPoint=pt)
L = ClusterOutput(ln)

# ==== cluster Cluster_2
Y = ClusterInput()
A = ClusterInput()
division = Division(A=A, B="4")
pt = ConstructPoint(XCoordinate="0.125", YCoordinate=Y, ZCoordinate=division)
pt_2 = ClusterOutput(pt)

# ==== cluster Cluster_3
V = ClusterInput()
V_2 = ClusterInput()
devec = DeconstructVector(Vector=V)  # -> XComponent, YComponent, ZComponent
devec_2 = DeconstructVector(Vector=V_2)  # -> XComponent, YComponent, ZComponent
division = Division(A=devec.YComponent, B="12")
Z = ClusterOutput(devec_2.ZComponent)
R = ClusterOutput(division)
