# Grasshopper definition SimpleWall.ghx (Grasshopper 1.0.8)
# plug-ins: Outdoor, Eddy3D, Eddy3D-Radiance, Eddy3D-Indoor

# Description: Purpose: Heat flow through a two-layer brick wall held at 20 degC on one face and -5 degC on the other.
# Fidelity: Engineering - transient conjugate heat transfer, not validated for this wall. Cite: Kastner and Dogan (SimAUD 2020).
# Method: CHT Case solves conduction in two 0.15 m CHT Solid blocks of CHT Material Brick for 10000 s; unassigned faces stay adiabatic.
# Result: Wall temperature T probed on a Brep Grid and drawn by Scalar Field Viewer; Live Residuals tracks convergence.
# Needs: Eddy3D Setup > Fully-coupled multi-region CFD / HAM / RAD / VEG (urbanMicroclimateFoam). Runtime: minutes.
# Edit: Wall blocks, materials, boundary temperatures and simulated time.
select_template = SelectTemplate()
select_template_2 = SelectTemplate()
eddy3d_setup = Eddy3DSetup(Open=False)
pt = ConstructPoint(XCoordinate=0, YCoordinate=0, ZCoordinate=0)
pt_2 = ConstructPoint(XCoordinate=0.15, YCoordinate=1, ZCoordinate=1)
pt_3 = ConstructPoint(XCoordinate=0.15, YCoordinate=0, ZCoordinate=0)
pt_4 = ConstructPoint(XCoordinate=0.3, YCoordinate=1, ZCoordinate=1)
chtmat = CHTMaterial(Material="Brick")
chtmat_2 = CHTMaterial(Material="Brick")
box = Box2Pt(PointA=pt, PointB=pt_2, Plane=PlaneXY(0, 0, 0))
box_2 = Box2Pt(PointA=pt_3, PointB=pt_4, Plane=PlaneXY(0, 0, 0))
wires = BrepWireframe(Brep=box_2, Density=-1)
wires_2 = BrepWireframe(Brep=box, Density=-1)
chtsolid = CHTSolid(Geometry=box, Name="wall", Material=chtmat)  # -> Solid, InsidePoint
chtsolid_2 = CHTSolid(Geometry=box_2, Name="outer", Material=chtmat_2)  # -> Solid, InsidePoint
chtbc = CHTBoundary(Face="X- (west)", Type="Fixed Temperature", Temperature=20, HeatTransferCoefficient=10)
chtbc_2 = CHTBoundary(Face="maxX", Type="Fixed Temperature", Temperature=-5, HeatTransferCoefficient=10)
merge = Merge(Data1=chtbc, Data2=chtbc_2)
merge_2 = Merge(Data1=chtsolid.Solid, Data2=chtsolid_2.Solid)
chtcase = CHTCase(
    CaseName="CHT",
    Solids=merge_2,
    Boundaries=merge,
    CellSize=0.05,
    Refinement=1,
    InitialTemperature=10,
    Duration=10000,
    SteadyState=False,
    Engine="Containerized",
    Write=False,
    Clear=False,
    ChtInputLayoutVersion=2)  # -> CaseDirectory, Commands, Logs, Case
run = Run(Case=chtcase.Case, Mesh=False, Simulate=False, RunAll=False, Parallel=True, DirectionIndex=-1, ShowZones=False)
panel = Panel(chtcase.Logs)
reslive = LiveResiduals(Case=chtcase.Case, Live=True, DirectionDegrees=-1, ShowResidualGoals=False)
geometry = Geometry(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)
brep_grid_points = BrepGridPoints(Geometry=geometry, Spacing=Slider(0.01, range=0..0.01))  # -> Points, Vectors, Mesh, Status
probe = Probe(
    Case=chtcase.Case,
    Points=brep_grid_points.Points,
    Field="T",
    Region="wall",
    Time="latestTime",
    Run=Button(),
    AutoProbeName="fresh-salmon-delta-mirror",
    BakeTimeHistory=False,
    CullHugeVectors=True,
    CullInvalid=True,
    ShowCulled=False,
    ShowRegion=True)  # -> Values, TimeSteps, SubResults, Points
scalar_field_viewer = ScalarFieldViewer(
    Points=brep_grid_points.Points,
    Values=probe.Values,
    DisplayMode="Point Cloud",
    Size=4,
    ColorMap="Viridis",
    Fit="Gapless")  # -> Geometry, Colors, Range
