# Grasshopper definition ClimateCharts.ghx (Grasshopper 1.0.8)
# plug-ins: Outdoor, Eddy3D, Eddy3D-Radiance

# Description: Purpose: A climate overview of one site: temperature, humidity, sun path and wind rose from a single EPW.
# Fidelity: Screening - plots the weather file as recorded; no simulation.
# Method: Download Weather fetches the station's EPW; Monthly Climate Chart, Sun Path and Wind Compass draw from the same Weather object.
# Result: Monthly minimum, mean and maximum temperature and humidity charts, a sun-path dome and a 16-sector wind rose.
# Needs: Nothing to install; Download Weather needs internet. Runtime: seconds.
# Edit: Station name panel (Istanbul by default); the size panel (100) scales every chart.
weather = DownloadWeather(Station="Istanbul", ChartMonthFrom=1, ChartMonthTo=12)  # -> EPWFile, Logs, Stations, Station, ExtraFiles, SiteLatitude, SiteLongitude
weather_2 = Weather(EPWFilePath=weather.EPWFile)
pt = ConstructPoint(XCoordinate=0, YCoordinate=expr("x*-4", "100"), ZCoordinate=0)
compass = WindCompass(
    WindDirection=0,
    Radius="100",
    BasePoint=Point(0, 0, 0),
    Color=RGB(105, 105, 105),
    ArrowScale=1,
    Weather=weather_2,
    StartMonth=1,
    EndMonth=12)  # -> Vector, DirectionName
sunpath = SunPath(Weather=weather_2, Latitude=0, Longitude=0, TimeZone=0, Center=Point(0, 0, 0), Radius="100", North=0)  # -> Arcs, Analemmas, Suns, Compass, Report
climatechart = MonthlyClimateChart(Weather=weather_2, BasePoint=pt, Width=expr("x*5", "100"), Height=expr("x*2", "100"))  # -> Months, TemperatureMinimum, TemperatureMean, TemperatureMaximum, HumidityMinimum, HumidityMean, HumidityMaximum
