# Grasshopper definition Solar_radiation.ghx (Grasshopper 1.0.8)
# plug-ins: Outdoor, Eddy3D, Eddy3D-Radiance

context = Brep([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])
number_slider = Slider(1, range=0..1)

# ---- group: Ground Surface
brep = Brep(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)

# ----
join = BrepJoin(Breps=context)  # -> Breps, Closed
preview = CustomPreview(Geometry=join.Breps, Material=ColourSwatch(SwatchColor=RGB(255, 255, 255)))
brepgrid = BrepGridPoints(Geometry=brep, Spacing=number_slider)  # -> Points, Vectors, Mesh, Status
brepgrid_2 = BrepGridPoints(Geometry=join.Breps, Spacing=number_slider)  # -> Points, Vectors, Mesh, Status

# ----
# Description: Purpose: Annual solar irradiation in kWh/m2 over a ground surface and its surrounding facades.
# Fidelity: Screening - interactive beam, sky and ground-reflected estimate, not a Radiance simulation.
# Method: Brep Grid Points samples surfaces at 1 m; Sky Exposure gives sky view; Solar Irradiation sums every daylight hour of an Istanbul year.
# Result: Ground and context coloured on one legend range; Text Tag prints rounded ground values.
# Needs: Nothing to install; runs inside Rhino. Runtime: seconds to minutes.
# Edit: Ground Brep, the ten context Breps, weather station.
panel = Panel("istanbul")
weather = DownloadWeather(Station=panel, ChartMonthFrom=1, ChartMonthTo=12)  # -> EPWFile, Logs, Stations, Station, ExtraFiles, SiteLatitude, SiteLongitude

sky_exposure = SkyExposure(Positions=brepgrid.Points, Context=join.Breps, Offset=0.918, Engine="Auto")
sky_exposure_2 = SkyExposure(Positions=brepgrid_2.Points, Context=join.Breps, Offset=0.918, Engine="Auto")

weather_2 = Weather(EPWFilePath=weather.EPWFile)

solarirr = SolarIrradiation(
    Context=join.Breps,
    Points=brepgrid_2.Points,
    Normals=brepgrid_2.Vectors,
    Weather=weather_2,
    Timestep=1,
    SkyView=sky_exposure_2,
    GroundReflectance=0.2,
    Offset=0.01,
    North=0,
    Engine="Auto",
    Date="Custom",
    SolarIrradiationInputLayoutVersion=2)  # -> Total, Direct, Diffuse, Reflected, Colors, Report
bnd = Bounds(Numbers=solarirr.Total)
flexlegend = FlexLegend(
    Values=solarirr.Total,
    Points=brepgrid_2.Points,
    Range=bnd,
    MetricType="solar radiation",
    ColorMap="Spectral",
    Normals=brepgrid_2.Vectors,
    Contours="Off",
    Plane=PlaneXY(0, 0, 0),
    LabelStyle="Text",
    Offset=0.5,
    Smoothing=0,
    Aggregate="Mean",
    HighlightTop=0,
    FlexLegendInputLayoutVersion=5)  # -> LegendMesh, LegendPoints, LegendValues, FieldMesh, Colors, ResolvedRange, Contours, ContourValues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

solarirr_2 = SolarIrradiation(
    Context=join.Breps,
    Points=brepgrid.Points,
    Normals=brepgrid.Vectors,
    Weather=weather_2,
    Timestep=1,
    SkyView=sky_exposure,
    GroundReflectance=0.2,
    Offset=0.01,
    North=0,
    Engine="Auto",
    Date="Custom",
    SolarIrradiationInputLayoutVersion=2)  # -> Total, Direct, Diffuse, Reflected, Colors, Report
round = Round(Number=solarirr_2.Total)  # -> Nearest, Floor, Ceiling
tag = TextTag(Location=brepgrid.Points, Text=round.Nearest, Colour=ColourSwatch(SwatchColor=RGB(255, 255, 255)))
flexlegend_2 = FlexLegend(
    Values=solarirr_2.Total,
    Points=brepgrid.Points,
    Range=bnd,
    MetricType="solar radiation",
    ColorMap="Spectral",
    Normals=brepgrid.Vectors,
    Contours="Off",
    Plane=PlaneXY(0, 0, 0),
    Size=50,
    Steps=5,
    LabelStyle="Text",
    Offset=0.5,
    Smoothing=0,
    Aggregate="Mean",
    HighlightTop=0,
    FlexLegendInputLayoutVersion=5)  # -> LegendMesh, LegendPoints, LegendValues, FieldMesh, Colors, ResolvedRange, Contours, ContourValues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

mesh = Mesh(flexlegend.FieldMesh)
