# Grasshopper definition 7_IndoorCase.ghx (Grasshopper 1.0.8)
# plug-ins: Eddy3D

temperature = Panel("20")
velocity = Panel("1")
brep = Brep(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)
vec = VectorXYZ(XComponent=0, YComponent=velocity, ZComponent=0)  # -> Vector, Length
srf = Surface(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)

# ---- group: probing plane
srf_2 = Surface(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)
brep_to_grid_points = BrepToGridPoints(Geometry=srf_2, Spacing="0.1", Run=Toggle(True))  # -> Points, Status

# ----
bbox = BoundingBox(Content=brep, Plane=PlaneXY(0, 0, 0))  # -> Box, Box_2
ol = Outlet(Geo=srf, Vel=Vector(0, 0, 0))
srf_3 = Surface(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)
volume = Volume(Geometry=bbox.Box_2)  # -> Volume, Centroid
geo = Geometry(Geo=brep, Temp=temperature)
il = Inlet(Geo=srf_3, Vel=vec.Vector, Temp=temperature)
iterations = Panel("500")
cell_size = Panel(".5")
cpus = Panel("8")
idom = IndoorDomain(
    Geo=geo,
    Inlet=il,
    Outlet=ol,
    Directory="IndoorCase2",
    PointInside=volume.Centroid,
    CellSize=cell_size,
    Iterations=iterations,
    CPUs=cpus,
    RunMeshing=Button(),
    RunSimulation=Button(),
    SelectedEngine=0)
probe_simulation = ProbeSimulation(
    Result=idom,
    ProbingPoints=brep_to_grid_points.Points,
    NameOfInstance="probing",
    InterpolationScheme=3,
    NameOfField=0,
    Run=Button())  # -> ProbingPoints, ProbingResult
bounds = Bounds(Numbers=probe_simulation.ProbingResult)
deconstruct_domain = DeconstructDomain(Domain=bounds)  # -> Start, End
vlen = VectorLength(Vector=probe_simulation.ProbingResult)
gradient = Gradient(
    LowerLimit=deconstruct_domain.Start,
    UpperLimit=deconstruct_domain.End,
    Parameter=vlen,
    stops=[0: RGB(234, 38, 0), 0.25: RGB(234, 126, 0), 0.5: RGB(254, 244, 84), 0.75: RGB(173, 203, 249), 1: RGB(75, 107, 169)])
amplitude = Amplitude(Vector=probe_simulation.ProbingResult, Amplitude="0.1")
vdisex = VectorDisplayEx(Point=probe_simulation.ProbingPoints, Vector=amplitude, Colour=gradient, Width="3")
