# Grasshopper definition BoxRoom.ghx (Grasshopper 1.0.8)
# plug-ins: Outdoor, Eddy3D-Indoor

ground_roughness = GroundRoughness(RefinementLevel=2)
geometry = Geometry(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)
geometry_2 = Geometry(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)
geometry_3 = Geometry(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)
geometry_4 = Geometry(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)
indoor_wall = IndoorWall(Temperature="40", Surface=geometry)  # -> WallTemperature, Wall
indoor_inlet = IndoorInlet(Surface=geometry_3, Speed=0.5, Temperature=20)
indoor_outlet = IndoorOutlet(Surface=geometry_2)
heat_source = HeatSource(Zone=geometry_4, SourceRate=0.1)
brep = Brep(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)
indoor_case = IndoorCase(
    Room=brep,
    CellSize=0.25,
    Inlets=indoor_inlet,
    Outlets=indoor_outlet,
    InletSpeed=0.5,
    Sources=heat_source,
    WallTemp=indoor_wall.WallTemperature,
    Write=False,
    Clear=False,
    Walls=indoor_wall.Wall)  # -> Case, Logs
run = Run(
    Case=indoor_case.Case,
    Mesh=False,
    Simulate=False,
    RunAll=False,
    Parallel=True,
    Engine="Docker",
    DirectionIndex=-1,
    ShowZones=False)
open_in_paraview = OpenInParaView(Case=indoor_case.Case, Open=False, ComfortMetric=1, DirectionIndex=-1)
live_residuals = LiveResiduals(Case=indoor_case.Case, Live=True, DirectionDegrees=-1)
panel = Panel(run)
surface = Surface(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)
quad_remesh = QuadRemesh(Geometry=surface, Settings={aqc=True, as=50, dhe=True, gci=0, null=False, pme=2, sa=0, tqc=2000})
deconstruct_mesh = DeconstructMesh(Mesh=quad_remesh)  # -> Vertices, Faces, Colours, Normals
probe = Probe(
    Case=indoor_case.Case,
    Points=deconstruct_mesh.Vertices,
    Field="U",
    Run=False,
    AutoProbeName="bright-panda-tundra-quill",
    BakeTimeHistory=False,
    CullHugeVectors=True,
    CullInvalid=True,
    ShowRegion=False)  # -> Values, TimeSteps, SubResults
vector = Vector(probe.Values)
bounds = Bounds(Numbers=vector)
deconstruct_domain = DeconstructDomain(Domain=bounds)  # -> Start, End
gradient = Gradient(
    LowerLimit=deconstruct_domain.Start,
    UpperLimit=deconstruct_domain.End,
    Parameter=vector,
    stops=[0: RGB(48, 18, 59), 0.0294: RGB(56, 40, 112), 0.0588: RGB(63, 62, 156), 0.0882: RGB(68, 82, 193), 0.118: RGB(70, 102, 221), 0.147: RGB(71, 122, 241)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])
vector_display_ex = VectorDisplayEx(Point=deconstruct_mesh.Vertices, Vector=vector, Colour=gradient, Width=2)
