# Grasshopper definition Breathing_Manikin.ghx (Grasshopper 1.0.8)
# plug-ins: Outdoor, Eddy3D-Indoor

# Description: Purpose: Where exhaled CO2 goes around a breathing person in a small room.
# Fidelity: Engineering - transient CFD around a simplified manikin, not validated.
# Method: Indoor Species Case solves CO2 as mass (OpenFOAM multicomponentFluid): 12 breaths a minute at 40000 ppm for 10 s.
# Result: CO2 traces 0.15 m ahead of the mouth and in the far corner; the near one swings from about 20000 ppm to ambient each breath.
# Needs: Eddy3D Setup > Fully-coupled multi-region CFD / HAM / RAD / VEG (urbanMicroclimateFoam); multicomponentFluid ships only in the UMF image. Runtime: minutes.
# Edit: Manikin position and facing, breathing rate, room size, vent position.
# BREATHING MANIKIN (CO2 SPECIES)
# OpenFOAM 12 multicomponentFluid, TRANSIENT.
# Units: METERS.
# 
# *** ~10-15 MINUTES TO SOLVE ***
# snappy has to resolve the manikin body, mouth
# and vent as separate patches, then a 10 s
# transient runs on top. Needs the UMF image.
# 
# Room 3 x 3 x 2.4 m, cell size 0.12 m.
# Manikin at ground position (1.0, 1.5, 0),
# facing +X (the component default), 1.75 m tall,
# 0.02 m mouth patch.
# Vent (pressure outlet) at (3, 1.5, 2.2).
# 12 breaths/min, 40000 ppm exhaled, 400 ppm
# ambient, 10 s duration.
# All from TestIndoorSpeciesContainerE2E.
# 
# PROBES: the Manikin's own Mouth output moved
# 0.15 m along +X (the fixture's near-mouth probe),
# merged with a far-corner reference at
# (2.7, 2.7, 2.0).
# 
# Breathing is a PULSATING jet: the near probe
# swings from ~20000 ppm on the exhale back to
# ambient on the inhale. Judge the trace, never a
# single sample.
# 
# NOT APPLICABLE: Indoor Inlet and Indoor Outlet
# do not connect here. Indoor Species Case has no
# inlet/outlet inputs - its only opening is Vent.
# 
# Write ships OFF.
pt = ConstructPoint(XCoordinate=0, YCoordinate=0, ZCoordinate=0)
pt_2 = ConstructPoint(XCoordinate=3, YCoordinate=3, ZCoordinate=2.4)
pt_3 = ConstructPoint(XCoordinate=1, YCoordinate=1.5, ZCoordinate=0)
pt_4 = ConstructPoint(XCoordinate=3, YCoordinate=1.5, ZCoordinate=2.2)
pt_5 = ConstructPoint(XCoordinate=2.7, YCoordinate=2.7, ZCoordinate=2)
X = UnitX(Factor=0.15)
manikin = Manikin(Position=pt_3, Facing=Vector(1, 0, 0), Height=1.75, MouthSize=0.02)  # -> Manikin, Preview, Mouth
box = Box2Pt(PointA=pt, PointB=pt_2, Plane=PlaneXY(0, 0, 0))
move = Move(Geometry=manikin.Mouth, Motion=X)  # -> Geometry, Transform
merge = Merge(Data1=move.Geometry, Data2=pt_5)
species = IndoorSpeciesCase(
    CaseName="manikin",
    Room=box,
    CellSize=0.12,
    Manikin=manikin.Manikin,
    Vent=pt_4,
    Breaths=12,
    ExhaledCO2=40000,
    AmbientCO2=400,
    Duration=10,
    Probes=merge,
    Engine="BlueCFD",
    Write=False,
    Clear=False,
    IndoorSpeciesInputLayoutVersion=2)  # -> CaseDirectory, Commands, Logs, Case
run = Run(Case=species.Case, Mesh=False, Simulate=False, RunAll=False, Parallel=True, DirectionIndex=-1, ShowZones=False)
open_in_paraview = OpenInParaView(Case=species.Case, Open=True, ComfortMetric=1, DirectionIndex=-1, ParaviewInputLayoutVersion=2, Streamlines=True)
