# Grasshopper definition Ventilation.ghx (Grasshopper 1.0.8)
# plug-ins: Outdoor, Eddy3D-Indoor

# INDOOR VENTILATION
# Mechanically ventilated room, OpenFOAM 12 incompressibleFluid.
# Units: METERS.
# 
# Room 6 x 4 x 3 m = 72 m3.
# Inlet 1 m2 on the x=0 wall at 0.5 m/s
# = 0.5 m3/s = 25 air changes / hour.
# Outlet 1 m2 on the x=6 wall.
# Cell size 0.3 m.
# 
# Numbers from TestIndoorVentilationContainerE2E.
# Solver endTime is not a Grasshopper input;
# the fixture runs 60 iterations.
# 
# To use: Indoor Case > Write, then Run > Mesh,
# then Run > Simulate. All action toggles ship OFF.
pt = ConstructPoint(XCoordinate=0, YCoordinate=0, ZCoordinate=0)
pt_2 = ConstructPoint(XCoordinate=6, YCoordinate=4, ZCoordinate=3)
pt_3 = ConstructPoint(XCoordinate=0, YCoordinate=2, ZCoordinate=1.5)
pt_4 = ConstructPoint(XCoordinate=6, YCoordinate=2, ZCoordinate=1.5)
dom = ConstructDomain(DomainStart=-0.5, DomainEnd=0.5)
yz = YZPlane(Origin=pt_3)
yz_2 = YZPlane(Origin=pt_4)
box = Box2Pt(PointA=pt, PointB=pt_2, Plane=PlaneXY(0, 0, 0))
planesrf = PlaneSurface(Plane=yz, XSize=dom, YSize=dom)
planesrf_2 = PlaneSurface(Plane=yz_2, XSize=dom, YSize=dom)
inlet = IndoorInlet(Surface=planesrf, Speed=0.5, Temperature=20)
outlet = IndoorOutlet(Surface=planesrf_2)
indoor = IndoorCase(
    CaseName="indoorVent",
    Room=box,
    CellSize=0.3,
    Inlets=inlet,
    Outlets=outlet,
    InletSpeed=0.5,
    Write=False,
    Clear=False,
    AutoName="brave-badger-ridge-lantern",
    IndoorInputLayoutVersion=2)  # -> Case, Logs
run = Run(
    Case=indoor.Case,
    Mesh=False,
    Simulate=False,
    RunAll=False,
    Parallel=True,
    Engine="Containerized",
    DirectionIndex=-1,
    ShowZones=False)
