# Grasshopper definition 1_MetaBlock.ghx (Grasshopper 1.0.8)
# plug-ins: Eddy3D

# ---- group: 1st step
safetytoggle = SafetyToggle()

# ---- group: 2nd step
safetytoggle_2 = SafetyToggle()

# ----
geo = Geometry([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])
metablock = MetaBlock(Mesh=geo, MinLength=0.1, APIURL="http://localhost:8000", StartServer=safetytoggle, Run=safetytoggle_2)  # -> Combined, Status
bbox = BoundingBox(Content=geo, Plane=PlaneXY(0, 0, 0), UnionBox=True)  # -> Box, Box_2
panel = Panel(metablock.Status)
debox = DeconstructBox(Box=bbox.Box)  # -> Plane, X, Y, Z
mesh = Mesh(metablock.Combined)
X = UnitX(Factor=expr("x*1.2", debox.X))
move = Move(Geometry=mesh, Motion=X)  # -> Geometry, Transform
preview = CustomPreview(Geometry=move.Geometry, Material=ColourSwatch(SwatchColor=RGB(255, 255, 255)))
