# Grasshopper definition 9_ML_Inference_Comfort.ghx (Grasshopper 1.0.8)
# plug-ins: Eddy3D

# ---- group: model selection
list = ValueList({"GAN": 0, "GAN_tke": 1, "GAN_tke_roof": 2}, selected="GAN")

# ---- group: FNO_ONXX file / GAN_with TKE
path = FilePath("C:\Users\ilker\Desktop\Conditional_Transformer\Pix2PixHD_Model\pix2pixhd_uk_generator.onnx")

# ---- group: GAN_tke_roof
G = FilePath("C:\Users\ilker\Desktop\Conditional_Transformer\Pix2PixHD_Model\pix2pixhd_uk_roof_generator.onnx")

# ----
# How to?
# 
# -Please downlaod the ML models first (GAN and FNO).
#  Then assign them in the "File Path" components, respectively.
# 
# -Connect your input geometry to "Builidngs"
# 
# -Define wind speed/direction (optional).
# 
# -Define wind comfort map (optional).
yel_1_0 = CSharpScript(Run=True, Force=False)  # -> Status, FilePath, Progress; inputs Run: Boolean, Force: Boolean
# ---------- yel_1_0: C# ----------
// Grasshopper Script Instance
#region Usings
using System;
using System.IO;
using System.Diagnostics;
using System.Runtime.InteropServices;

using Rhino;
using Rhino.Geometry;

using Grasshopper;
using Grasshopper.Kernel;
using Grasshopper.Kernel.Data;
using Grasshopper.Kernel.Types;
#endregion

public class Script_Instance : GH_ScriptInstance
{
  private void RunScript(
		bool Run,
		bool Force,
		ref object Status,
		ref object FilePath,
		ref object Progress)
  {
    string modelUrl = "https://huggingface.co/SustainableUrbanSystemsLab/Yel/resolve/main/Yel.onnx";
    string modelFileName = "Yel.onnx";

    Progress = 0.0;

    try
    {
      if (!Run)
      {
        Status = "Set Run to True to download the model.";
        FilePath = null;
        Progress = 0.0;
        Component.Message = "Idle";
        return;
      }

      string userFolder = Environment.GetFolderPath(Environment.SpecialFolder.UserProfile);

      if (string.IsNullOrWhiteSpace(userFolder) || !Directory.Exists(userFolder))
      {
        Status = "Could not locate the user home folder.";
        FilePath = null;
        Progress = 0.0;
        Component.Message = "Error";
        return;
      }

      string modelFolder = Path.Combine(userFolder, "SUS_LAB");

      if (!Directory.Exists(modelFolder))
      {
        Directory.CreateDirectory(modelFolder);
      }

      string destinationPath = Path.Combine(modelFolder, modelFileName);
      string tempPath = destinationPath + ".download";

      FilePath = destinationPath;

      // Cache check
      if (File.Exists(destinationPath) && !Force)
      {
        FileInfo existingFile = new FileInfo(destinationPath);

        Status =
          "Model already exists. Using cached file.\n" +
          "Path: " + destinationPath + "\n" +
          "Size: " + Math.Round(existingFile.Length / 1024.0 / 1024.0, 2) + " MB\n" +
          "Set Force to True to re-download and replace it.";

        Progress = 100.0;
        Component.Message = "Cached";
        return;
      }

      if (File.Exists(tempPath))
      {
        File.Delete(tempPath);
      }

      Component.Message = "Downloading";
      Status = "Downloading model. Please wait...";

      bool isWindows = RuntimeInformation.IsOSPlatform(OSPlatform.Windows);
      bool isMac = RuntimeInformation.IsOSPlatform(OSPlatform.OSX);

      string curlPath = "";

      if (isWindows)
      {
        curlPath = "curl.exe";
      }
      else if (isMac)
      {
        curlPath = "/usr/bin/curl";
      }
      else
      {
        Status = "Unsupported operating system. This script currently supports Windows and macOS.";
        FilePath = null;
        Progress = 0.0;
        Component.Message = "Error";
        return;
      }

      ProcessStartInfo psi = new ProcessStartInfo();

      psi.FileName = curlPath;

      // -L follows Hugging Face redirects
      // --fail returns an error code for failed HTTP requests
      // --http1.1 avoids some HTTP/2 issues
      // --retry helps with unstable connections
      // --connect-timeout avoids hanging forever
      psi.Arguments =
        "-L --fail --show-error --http1.1 " +
        "--retry 3 --retry-delay 2 --connect-timeout 30 " +
        "-A \"Grasshopper-Yel-Model-Downloader\" " +
        "\"" + modelUrl + "\" " +
        "-o " +
        "\"" + tempPath + "\"";

      psi.UseShellExecute = false;
      psi.CreateNoWindow = true;
      psi.RedirectStandardOutput = true;
      psi.RedirectStandardError = true;

      using (Process process = new Process())
      {
        process.StartInfo = psi;
        process.Start();

        while (!process.HasExited)
        {
          if (File.Exists(tempPath))
          {
            FileInfo partialFile = new FileInfo(tempPath);
            double downloadedMB = partialFile.Length / 1024.0 / 1024.0;

            Status =
              "Downloading model...\n" +
              "Downloaded so far: " + Math.Round(downloadedMB, 2) + " MB";

            Component.Message = "Downloading";
            Progress = -1.0;
          }

          Rhino.RhinoApp.Wait();
          System.Threading.Thread.Sleep(300);
        }

        string output = process.StandardOutput.ReadToEnd();
        string error = process.StandardError.ReadToEnd();

        if (process.ExitCode != 0)
        {
          Status =
            "Download failed.\n" +
            "Exit code: " + process.ExitCode + "\n" +
            "Error: " + error + "\n\n" +
            "Test manually by opening Command Prompt and running:\n" +
            "curl.exe -L --http1.1 \"" + modelUrl + "\" -o \"" + tempPath + "\"";

          FilePath = null;
          Progress = 0.0;
          Component.Message = "Error";
          return;
        }
      }

      FileInfo downloadedFile = new FileInfo(tempPath);

      if (!downloadedFile.Exists || downloadedFile.Length == 0)
      {
        if (File.Exists(tempPath))
        {
          File.Delete(tempPath);
        }

        Status = "Download failed: downloaded file is empty.";
        FilePath = null;
        Progress = 0.0;
        Component.Message = "Error";
        return;
      }

      // Optional weak validation: Hugging Face error pages are usually tiny HTML files.
      // A real ONNX model should not start with '<'.
      using (FileStream fs = new FileStream(tempPath, FileMode.Open, FileAccess.Read))
      {
        if (fs.Length > 0)
        {
          int firstByte = fs.ReadByte();

          if (firstByte == 60) // '<'
          {
            fs.Close();

            if (File.Exists(tempPath))
            {
              File.Delete(tempPath);
            }

            Status =
              "Download failed: the downloaded file looks like an HTML error page, not an ONNX model.\n" +
              "Please check whether the Hugging Face file is public and accessible:\n" +
              modelUrl;

            FilePath = null;
            Progress = 0.0;
            Component.Message = "Error";
            return;
          }
        }
      }

      if (File.Exists(destinationPath))
      {
        File.Delete(destinationPath);
      }

      File.Move(tempPath, destinationPath);

      FileInfo finalFile = new FileInfo(destinationPath);

      Status =
        "Model downloaded successfully.\n" +
        "Path: " + destinationPath + "\n" +
        "Size: " + Math.Round(finalFile.Length / 1024.0 / 1024.0, 2) + " MB";

      FilePath = destinationPath;
      Progress = 100.0;
      Component.Message = "Done";
    }
    catch (Exception ex)
    {
      Status =
        "Download failed.\n" +
        "Error: " + ex.Message;

      FilePath = null;
      Progress = 0.0;
      Component.Message = "Error";
    }
  }
}
# ---------- end yel_1_0 ----------
panel = Panel(yel_1_0.Progress)
entwine = Entwine(Branch00=yel_1_0.FilePath, Branch01=path, Branch02=G, FlattenInputs=True)  # -> simplify(Result)
branch = TreeBranch(Tree=entwine, Path=list, MaintainPaths=False)

panel_2 = Panel("""0
0
1""")
branch_2 = TreeBranch(Tree=simplify(graft(panel_2)), Path=list, MaintainPaths=True)

# ---- group: Run
safetytoggle = SafetyToggle()

# ---- group: Terrain- Do not change / TERRAIN
srf = Surface(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)

# ----
list_2 = ValueList({"Wind Comfort Study - 8 wind directions": 0, "Wind Comfort Study - 16 wind directions": 1}, selected="Wind Comfort Study - 16 wind directions")

# ---- group: Terrain- Do not change
move = Move(Geometry=srf, Motion=Vector(0, 0, 1.8))  # -> Geometry, Transform
brep2grid = BrepToGridPoints(Geometry=move.Geometry, Spacing="2", Run=safetytoggle)  # -> Points, Status

# ---- group: Buildings
brep = Brep([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])

# ----
range = Range(Domain="0 To 315", Steps=7)
range_2 = Range(Domain="0 To 337.5", Steps=15)
preview = CustomPreview(Geometry=brep, Material=ColourSwatch(SwatchColor=RGB(255, 255, 255)))
entwine_2 = Entwine(Branch00=range, Branch01=range_2, FlattenInputs=True)  # -> simplify(Result)
branch_3 = TreeBranch(Tree=entwine_2, Path=list_2, MaintainPaths=False)
panel_3 = Panel("https://energyplus-weather.s3.amazonaws.com/europe_wmo_region_6/TUR/TUR_Istanbul.170600_IWEC/TUR_Istanbul.170600_IWEC.epw")
windpredict = WindPredictor(
    Points=brep2grid.Points,
    Buildings=brep,
    ONNXPath=branch,
    U_ref=3,
    Z_ref=10,
    Pedestrian_level=1.8,
    Wind_dir=branch_3,
    GPU=True,
    FilterMargin=100,
    Palette="jet",
    Interpolate=True,
    ShowTKE=False,
    ShowRoof=branch_2)  # -> X, Y, WindSpeed, GridMesh, LegendMesh, LegendPoints, LegendValues, TurbulentKineticEnergy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
py3 = Python3Script()  # -> Directory
# ---------- py3: Python ----------
import os

# Gets the current user's home directory on both Windows and macOS
home_dir = os.path.expanduser("~")

# Concatenate with Eddy3d-cases
eddy_cases_dir = os.path.join(home_dir, "Eddy3D","Cases")

# Outputs
Directory = eddy_cases_dir
# ---------- end py3 ----------
comfort_metric = ValueList({"NEN8100 Comfort": 4, "NEN8100 Safety": 5, "Lawson General": 0, "Lawson LDDC": 1, "Lawson 2001": 2, "Davenport": 3}, selected="NEN8100 Comfort")
pt = ConstructPoint(XCoordinate=windpredict.X, YCoordinate=windpredict.Y, ZCoordinate=1.8)
c_script = CSharpScript(url=panel_3, saveTo=py3)  # -> out, epwPath; inputs url: String, saveTo: String
# ---------- c_script: C# ----------
// Grasshopper Script Instance
#region Usings
using System;
using System.Linq;
using System.Collections;
using System.Collections.Generic;
using System.Drawing;
using System.IO;
using System.Net.Http;
using System.Threading.Tasks;

using Rhino;
using Rhino.Geometry;

using Grasshopper;
using Grasshopper.Kernel;
using Grasshopper.Kernel.Data;
using Grasshopper.Kernel.Types;
#endregion

public class Script_Instance : GH_ScriptInstance
{
private void RunScript(string url, string saveTo, ref object epwPath)
{
  epwPath = null;

  try
  {
    // --- Validate URL ---
    if (string.IsNullOrWhiteSpace(url))
    {
      Print("URL is invalid.");
      return;
    }

    string urlFileName;
    try { urlFileName = System.IO.Path.GetFileName(new Uri(url).LocalPath); }
    catch { Print("URL is invalid."); return; }
    if (string.IsNullOrWhiteSpace(urlFileName)) urlFileName = "download.epw";

    // --- Decide destination path ---
    string filePath;

    if (string.IsNullOrWhiteSpace(saveTo))
    {
      // Use GH file's directory
      var ghDoc  = GrasshopperDocument; // <-- use this in C# Script
      var ghPath = ghDoc?.FilePath;

      if (string.IsNullOrEmpty(ghPath))
      {
        // fallback to Rhino document folder if available
        var rhPath = Rhino.RhinoDoc.ActiveDoc?.Path;
        var rhDir  = string.IsNullOrEmpty(rhPath) ? null : System.IO.Path.GetDirectoryName(rhPath);
        if (string.IsNullOrEmpty(rhDir))
        {
          Print("Grasshopper file is unsaved. Please save the .gh file or provide a destination path.");
          return;
        }
        Print("Grasshopper file is unsaved; saving to the Rhino document folder.");
        filePath = System.IO.Path.Combine(rhDir, urlFileName);
      }
      else
      {
        var ghDir = System.IO.Path.GetDirectoryName(ghPath);
        filePath  = System.IO.Path.Combine(ghDir, urlFileName);
      }
    }
    else
    {
      // Accept either a folder or a full file path
      string raw = saveTo.Trim().Trim('"');
      raw = Environment.ExpandEnvironmentVariables(raw);

      var ghDoc  = GrasshopperDocument; // <-- use this here too
      var ghPath = ghDoc?.FilePath;
      string baseRoot = !string.IsNullOrEmpty(ghPath)
        ? System.IO.Path.GetDirectoryName(ghPath)
        : System.IO.Directory.GetCurrentDirectory();

      string candidate = raw;
      if (!System.IO.Path.IsPathRooted(candidate))
        candidate = System.IO.Path.GetFullPath(System.IO.Path.Combine(baseRoot, candidate));

      bool endsWithSlash =
        candidate.EndsWith(System.IO.Path.DirectorySeparatorChar.ToString()) ||
        candidate.EndsWith(System.IO.Path.AltDirectorySeparatorChar.ToString());

      bool treatAsFolder = endsWithSlash || System.IO.Directory.Exists(candidate);

      if (treatAsFolder)
      {
        System.IO.Directory.CreateDirectory(candidate);
        filePath = System.IO.Path.Combine(candidate, urlFileName);
      }
      else
      {
        string dir = System.IO.Path.GetDirectoryName(candidate);
        if (!string.IsNullOrEmpty(dir)) System.IO.Directory.CreateDirectory(dir);
        filePath = candidate;
      }
    }

    // --- Skip download if exists ---
    if (System.IO.File.Exists(filePath))
    {
      Print($"File already exists at {filePath}, skipping download.");
      epwPath = filePath;
      return;
    }

    // --- Download synchronously ---
    using (var http = new System.Net.Http.HttpClient())
    using (var resp = http.GetAsync(url, System.Net.Http.HttpCompletionOption.ResponseHeadersRead).Result)
    {
      resp.EnsureSuccessStatusCode();
      using (var fs = new System.IO.FileStream(filePath, System.IO.FileMode.Create, System.IO.FileAccess.Write, System.IO.FileShare.None))
      {
        resp.Content.CopyToAsync(fs).Wait();
      }
    }

    Print($"File downloaded successfully to {filePath}");
    epwPath = filePath;
  }
  catch (Exception ex)
  {
    Print($"Failed to download file: {ex.Message}");
  }
}


}

public static class FileDownloader
{
    /// <summary>
    /// Asynchronously downloads a file from the specified URL and saves it to the given file path.
    /// </summary>
    /// <param name="url">The URL of the file to download.</param>
    /// <param name="filePath">The local file path to save the downloaded file.</param>
    public static async Task DownloadFileAsync(string url, string filePath)
    {
        // Validate inputs
        if (string.IsNullOrWhiteSpace(url))
            throw new ArgumentException("URL cannot be null or empty.", nameof(url));

        if (string.IsNullOrWhiteSpace(filePath))
            throw new ArgumentException("File path cannot be null or empty.", nameof(filePath));

        // Ensure the directory exists
        var directory = Path.GetDirectoryName(filePath);
        if (!string.IsNullOrEmpty(directory) && !Directory.Exists(directory))
        {
            Directory.CreateDirectory(directory);
        }

        try
        {
            // Download file using HttpClient
            using var httpClient = new HttpClient();
            using var response = await httpClient.GetAsync(url, HttpCompletionOption.ResponseHeadersRead);
            response.EnsureSuccessStatusCode();

            // Save the file
            await using var fileStream = new FileStream(filePath, FileMode.Create, FileAccess.Write, FileShare.None);
            await response.Content.CopyToAsync(fileStream);
        }
        catch (Exception ex)
        {
            Console.WriteLine($"Error downloading file: {ex.Message}");
            throw;
        }
    }
}
# ---------- end c_script ----------
path_2 = FilePath("C:\Users\ilker\Desktop\wind_study\epw_files\TUR_Istanbul.170600_IWEC.epw")
windcomfortml = WindComfortPredictorML(
    Points=pt,
    WindSpeeds=windpredict.WindSpeed,
    EPWPath=c_script.epwPath,
    Z_ref=10,
    Z_0=1,
    Metric=comfort_metric,
    Interpolate=True,
    FastModeMoM=True,
    BoundaryConditions=windpredict.BoundaryConditions,
    TKE=windpredict.TurbulentKineticEnergy,
    WindSpeedsRoof=windpredict.WindSpeedRoof,
    TKERoof=windpredict.TurbulentKineticEnergyRoof,
    Buildings=brep)  # -> ComfortRank, ClassLetter, Class, ComfortMesh, LegendMesh, LegendPoints, LegendLetters, MetricName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
swatch = ColourSwatch(SwatchColor=RGB(0, 0, 0))
mesh = Mesh(windcomfortml.ComfortMesh)
mesh_2 = Mesh(windcomfortml.LegendMesh)
tag = TextTag3D(Location=windcomfortml.LegendPoints, Text=windcomfortml.CategoryExplanations, Size=11, Colour=swatch, Justification=8)
area = Area(Geometry=mesh_2)  # -> Area, Centroid
move_2 = Move(Geometry=area.Centroid, Motion=Vector(0, 50, 0))  # -> Geometry, Transform
tag_2 = TextTag3D(Location=move_2.Geometry, Text=windcomfortml.MetricName, Size=14, Colour=swatch, Justification=8)
