# Grasshopper definition 9_ML_basic.ghx (Grasshopper 1.0.8)
# plug-ins: Eddy3D

panel = Panel("""0
45
90
135
180
225
270
315""")

# ----
# Building Geometry &
# Boundary Conditions
panel_2 = Panel("5")
abl = ABL(WindDirections=panel, ReferenceVelocity=panel_2, ReferenceHeight="10", AerodynamicRoughnessLength=1, GroundLevel=0)

# ---- group: BUILDINGS
# Prepare Geometry
# the buildings should
#    consist of Breps!
# Step 1
buildings = Geometry([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])

# ---- group: TERRAIN
srf = Surface(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)

# ----
# Computational Domain
# Step 2
# Prepare Terrain
# the radius should be
# more than 500 meters!
pedestrian_level = Panel("1.8")
Z = UnitZ(Factor=pedestrian_level)
move = Move(Geometry=srf, Motion=Z)  # -> Geometry, Transform
cylindrical_domain = CylindricalDomain(
    Buildings=buildings,
    Terrain=srf,
    BoundaryCondition=abl,
    CellSize="10",
    InnerSize=300,
    OuterRadius=500,
    Height=300,
    RadialMultiplier=Slider(2, range=0..10),
    XDivisions=Slider(1, range=0..1))  # -> Domain, PreviewMesh

# ----
# write dataset to file!
boolean_toggle = BooleanToggle(False)

# ----
# Step 3
panel_3 = Panel("2")

# ----
# Create Case Folder
panel_4 = Panel("C:\Eddy3D-Cases\")
button = Button()
rset = RunSettings(
    Iterations="600",
    WriteInterval="600",
    TimestepsToKeep=3,
    TurbulenceModel=3,
    RelaxationFactors=0,
    NumericalSchemes=1,
    PotentialFlowInit=False,
    AgeOfAir=False,
    CPUCores="24",
    BlueCFDFolder=0,
    DebugDiagnostics=False,
    SIMPLEC=False)
concat = Concatenate(A=panel_4, subfolder="ML_Basic_Test_0")

mesh_settings = MeshSettings(
    BuildingMinLevel="2",
    BuildingMaxLevel="4",
    FeatureLevel=2,
    BoundingBoxLevel=0,
    GroundLevel="2",
    BoundaryLayers=1,
    CellsBetweenLevels=4,
    MeshMode="5",
    Preset=1)

simulation = Simulation(
    SimulationDomain=cylindrical_domain.Domain,
    WorkingDirectory=concat,
    MeshSettings=mesh_settings,
    RunSettings=rset,
    RunMeshing=Button(),
    MakeTrees=False,
    RunSimulation=Button())  # -> SimulationResult, MeshDone, SimDone, MeshRemainingTime, SimulationRemainingTime
residuals = VisualizeResiduals(Result=simulation.SimulationResult, Plot=":", visResiduals=True)

# ----
# Probing
brep2grid = BrepToGridPoints(Geometry=move.Geometry, Spacing=panel_3, Run=boolean_toggle)  # -> Points, Status
probing = Probing(
    Result=simulation.SimulationResult,
    ProbingPoints=brep2grid.Points,
    NameOfInstance="ttt",
    InterpolationScheme=3,
    NameOfField=0,
    Run=Toggle(False))  # -> ProbingPoints, ProbingResult

# ----
# Dataset Preparation
datacurator = DatasetCurator(
    Points=brep2grid.Points,
    Buildings=buildings,
    Case_dir=concat,
    U_ref=panel_2,
    Z_ref="10",
    Pedestrian_level=pedestrian_level,
    Wind_dir=panel,
    Run=boolean_toggle)  # -> SDF, Bldg_height, Z_relative, U_over_Uref, X_coords, Y_coords, Dir_sin, Dir_cos, CSV_Path
panel_5 = Panel(datacurator.CSV_Path)

# ----
# Read Dataset with Results
wind_direction_angle = ValueList({"0", "45", "90", "135", "180", "225", "270", "315"}, selected="0")

concatenate = Concatenate(Fragment_A=concat, Fragment_B="\Dataset\", A="ML_Basic_Test_0", B="_", C=wind_direction_angle, D=".csv")

dataset_reader = DatasetReader(CSVPath=concatenate, Run=Toggle(False))  # -> SDF, Bldg_height, Z_relative, U_over_Uref, Mag_U, X, Y, Dir_sin, Dir_cos, Brep
gradient = Gradient(
    LowerLimit=0,
    UpperLimit=1,
    Parameter=dataset_reader.Mag_U,
    stops=[0: RGB(48, 18, 59), 0.0294: RGB(56, 40, 112), 0.0588: RGB(63, 62, 156), 0.0882: RGB(68, 82, 193), 0.118: RGB(70, 102, 221), 0.147: RGB(71, 122, 241)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])
construct_point = ConstructPoint(XCoordinate=dataset_reader.X, YCoordinate=dataset_reader.Y, ZCoordinate=dataset_reader.Z_relative)
custom_preview = CustomPreview(Geometry=construct_point, Material=gradient)
