# Grasshopper definition MetaBlock.ghx (Grasshopper 1.0.8)
# plug-ins: Eddy3D

geo = Geometry([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])
safetytoggle = SafetyToggle()
safetytoggle_2 = SafetyToggle()
metablock = MetaBlock(Mesh=geo, APIURL="http://localhost:8000", StartServer=safetytoggle, Run=safetytoggle_2)  # -> Combined, Status
panel = Panel(metablock.Status)
mesh = Mesh(metablock.Combined)
