# Grasshopper definition Solar_radiation.ghx (Grasshopper 1.0.8)
# plug-ins: Outdoor, Eddy3D, Eddy3D-Radiance

context = Brep([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])
number_slider = Slider(1, range=0..1)

# ---- group: Ground Surface
brep = Brep(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)

# ----
join = BrepJoin(Breps=context)  # -> Breps, Closed
preview = CustomPreview(Geometry=join.Breps, Material=ColourSwatch(SwatchColor=RGB(255, 255, 255)))
brepgrid = BrepGridPoints(Geometry=brep, Spacing=number_slider)  # -> Points, Vectors, Mesh, Status
brepgrid_2 = BrepGridPoints(Geometry=join.Breps, Spacing=number_slider)  # -> Points, Vectors, Mesh, Status

# ----
# Description: Cumulative solar irradiation, in kWh/m2, mapped over a ground surface and its context faces. Weather loads the Istanbul file from Download Weather. Brep Grid Points samples the ground Brep and the joined context Breps at 1 m spacing, with normals. Sky Exposure gives each point a sky view fraction; Solar Irradiation adds beam, sky and ground-reflected light for every daylight hour of the year, an interactive preview, not a Radiance simulation. Flex Legend colors both surfaces on one range set by the context totals, and Text Tag prints rounded ground values. Replace the stored ground Brep and ten context Breps.
panel = Panel("istanbul")
weather = DownloadWeather(Station=panel)  # -> EPWFile, Logs, Stations, Station, ExtraFiles, SiteLatitude, SiteLongitude

sky_exposure = SkyExposure(Positions=brepgrid.Points, Context=join.Breps, Offset=0.918)
sky_exposure_2 = SkyExposure(Positions=brepgrid_2.Points, Context=join.Breps, Offset=0.918)

weather_2 = Weather(EPWFilePath=weather.EPWFile)

solarirr = SolarIrradiation(
    Context=join.Breps,
    Points=brepgrid_2.Points,
    Normals=brepgrid_2.Vectors,
    Weather=weather_2,
    Timestep=1,
    SkyView=sky_exposure_2,
    GroundReflectance=0.2,
    Offset=0.01,
    North=0,
    SolarIrradiationInputLayoutVersion=2)  # -> Total, Direct, Diffuse, Reflected, Colors, Report
bnd = Bounds(Numbers=solarirr.Total)
flexlegend = FlexLegend(
    Range=bnd,
    Plane=PlaneXY(0, 0, 0),
    ColorMap="Spectral",
    Points=brepgrid_2.Points,
    Normals=brepgrid_2.Vectors,
    Offset=0.5,
    Values=solarirr.Total,
    MetricType="solar radiation",
    LabelStyle="Text",
    Contours="Off",
    Smoothing=0,
    Aggregate="Mean",
    HighlightTop=0,
    FlexLegendInputLayoutVersion=3)  # -> LegendMesh, LegendPoints, LegendValues, FieldMesh, Colors, ResolvedRange, Contours, ContourValues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

solarirr_2 = SolarIrradiation(
    Context=join.Breps,
    Points=brepgrid.Points,
    Normals=brepgrid.Vectors,
    Weather=weather_2,
    Timestep=1,
    SkyView=sky_exposure,
    GroundReflectance=0.2,
    Offset=0.01,
    North=0,
    SolarIrradiationInputLayoutVersion=2)  # -> Total, Direct, Diffuse, Reflected, Colors, Report
round = Round(Number=solarirr_2.Total)  # -> Nearest, Floor, Ceiling
tag = TextTag(Location=brepgrid.Points, Text=round.Nearest, Colour=ColourSwatch(SwatchColor=RGB(255, 255, 255)))
flexlegend_2 = FlexLegend(
    Range=bnd,
    Plane=PlaneXY(0, 0, 0),
    Size=50,
    Steps=5,
    ColorMap="Spectral",
    Points=brepgrid.Points,
    Normals=brepgrid.Vectors,
    Offset=0.5,
    Values=solarirr_2.Total,
    MetricType="solar radiation",
    LabelStyle="Text",
    Contours="Off",
    Smoothing=0,
    Aggregate="Mean",
    HighlightTop=0,
    FlexLegendInputLayoutVersion=3)  # -> LegendMesh, LegendPoints, LegendValues, FieldMesh, Colors, ResolvedRange, Contours, ContourValues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

mesh = Mesh(flexlegend.FieldMesh)
