# Grasshopper definition Surrogate_hourly_thermal_comfort_analysis.ghx (Grasshopper 1.0.8)
# plug-ins: Outdoor, Eddy3D, Eddy3D-Radiance

panel = Panel("https://energyplus-weather.s3.amazonaws.com/north_and_central_america_wmo_region_4/USA/GA/USA_GA_Atlanta-Hartsfield-Jackson.Intl.AP.722190_TMY3/USA_GA_Atlanta-Hartsfield-Jackson.Intl.AP.722190_TMY3.epw")
# Description: Purpose: UTCI at sensors on a circular patch for single hours, with machine-learning wind.
# Fidelity: Screening - machine-learning wind (Yel 2.0); buildings only, no trees.
# Method: Wind Predictor at 7 m/s for 8 directions, VAF per Atlanta hour; MRT View Factors (192 sky patches, Fast) and MRT Solve feed UTCI (Simulation).
# Result: UTCI per sensor; Deconstruct UTCI reduces it to statistics.
# Needs: Nothing to install; ML Model downloads Yel 2.0 on first use. Runtime: minutes.
# Edit: Context Brep, sensor patch, weather file; add trees to model their shade.
cir = Circle(Plane=PlaneXY(0, 0, 0), Radius=60)
context = Brep([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])
srf = Surface(cir)
download_weather = DownloadWeather(Station=panel, ChartMonthFrom=1, ChartMonthTo=12)  # -> EPWFile, Logs, Stations, Station, ExtraFiles, SiteLatitude, SiteLongitude
brepgrid = BrepGridPoints(Geometry=srf, Spacing=2)  # -> Points, Vectors, Mesh, Status
deweather = DeconstructWeather(Weather=download_weather.EPWFile, Series="""Dry Bulb Temperature
Relative Humidity
Wind Speed
Wind Direction""")  # -> DryBulbTemperature, RelativeHumidity, WindSpeed, WindDirection
cir_2 = Circle(Plane=PlaneXY(0, 0, 0), Radius=504)
Z = UnitZ(Factor=1.8)
srf_2 = Surface(cir_2)
move = Move(Geometry=srf_2, Motion=Z)  # -> Geometry, Transform
mrt_surface = MRTSurface(Geometry=context, Simulated=True, PatchSize=3, LegacyOpaqueTrees=True)  # -> Surface, Mesh
sensors = MRTSensors(Sensors=brepgrid.Points, Normal=Vector(0, 0, 1), Height=1.1)  # -> Sensors, Points
series = Series(Start="0", Step="45", Count="8")
mlmodel = MLModel(Model="Yel 2.0", Run=Toggle(True), MLModelInputLayoutVersion=2)  # -> Status, FilePath, Progress
brepgrid_2 = BrepGridPoints(Geometry=move.Geometry, Spacing=2)  # -> Points, Vectors, Mesh, Status
boolean_toggle = BooleanToggle(True)
abl = AtmosphericBoundaryLayer(
    WindDirections=series,
    WindSpeed="7",
    ReferenceHeight=10,
    RoughnessLengthZ0=1,
    GroundHeight=0,
    TurbulentKEK=0.015,
    TurbulentEpsilonΕ=0.135,
    TurbulentOmegaΩ=100,
    TerrainType="Custom (z0 input)",
    InletProfile="Log law (Richards & Hoxey)",
    DisplacementHeight=0,
    AblOutputLayoutVersion=2)  # -> BoundaryConditions, WindVectors
mrt_view_factors = MRTViewFactors(
    Surfaces=mrt_surface.Surface,
    Sensors=sensors.Sensors,
    SkyDomeSubdivisions="3 — 192 sky patches",
    Fidelity="Fast",
    Engine="Auto",
    Run=boolean_toggle)  # -> VFModel, SkyDome, Log
windpredict = WindPredictor(
    Points=brepgrid_2.Points,
    Buildings=context,
    Model=mlmodel.FilePath,
    BoundaryConditions=abl.BoundaryConditions,
    PedestrianLevel=1.8,
    FilterMargin=100,
    Palette="jet",
    Interpolate="Smooth",
    Field="Velocity",
    Level="Pedestrian Level",
    SelectionPoints=brepgrid.Points,
    Radius=0.75,
    LegendScale=1,
    MeshType="Square",
    Engine="Auto",
    Run=Toggle(True),
    WindPredictorInputLayoutVersion=2,
    WindPredictorOutputLayoutVersion=2)  # -> Points, Values, GridMesh, LegendMesh, LegendPoints, LegendValues, BoundaryConditions, ValuesRoof
mrt_solve = MRTSolve(
    VFModel=mrt_view_factors.VFModel,
    EPW=download_weather.EPWFile,
    Engine="Native",
    Compute="Auto",
    Run=boolean_toggle,
    MrtSolveInputLayoutVersion=2)  # -> Probes, Result, Log
velocity_amplification_factors_vaf = VelocityAmplificationFactorsVAF(
    BoundaryConditions=abl.BoundaryConditions,
    WindVelocity=windpredict.Values,
    EPW=download_weather.EPWFile,
    ProbeHeight=1.8,
    Interpolate="False",
    Points=windpredict.Points,
    Factors="Annual (per hour)",
    PeakFactor=3.5)  # -> WindSpeed, VelocityAmplificationFactors, AnnualVAF, GustSpeed, SpeedRatios
utci_simulation = UTCISimulation(
    MRT=mrt_solve.Result,
    WindSpeed=velocity_amplification_factors_vaf.WindSpeed,
    AirTemperature=deweather.DryBulbTemperature,
    RelativeHumidity=deweather.RelativeHumidity,
    Transpose="Hours × Probes",
    Engine="Auto",
    Run=True,
    UtciInputLayoutVersion=2)  # -> UTCI, ComfortHours, Comfort, Result
deconstruct_utci = DeconstructUTCI(Result=utci_simulation.Result, DeUtciInputLayoutVersion=2, DeUtciOutputLayoutVersion=2)  # -> Mean, Min, Max, ComfortHours, Comfort, UTCI, Points
