# Grasshopper definition ViewShed.ghx (Grasshopper 1.0.8)
# plug-ins: Eddy3D-Radiance

geometry = Geometry(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)
geometry_2 = Geometry(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)
geometry_3 = Geometry([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])
mesh_brep = MeshBrep(
    Brep=geometry_2,
    Settings={GridMaxCount=0, GridMinCount=16, JaggedSeams=False, MaxEdgeLength=0, MinEdgeLength=0.0001, MinTolerance=0, Refine=True, RefineAngle=0, RelativeTolerance=0.65, SimplePlanes=True, Tolerance=0})
quad_remesh = QuadRemesh(Geometry=mesh_brep, Settings={aqc=True, as=50, dhe=True, gci=0, null=False, pme=2, sa=0, tqc=2000})
deconstruct_mesh = DeconstructMesh(Mesh=quad_remesh)  # -> Vertices, Faces, Colours, Normals
view_target = ViewTarget(
    Context=geometry_3,
    Points=deconstruct_mesh.Vertices,
    Target=geometry,
    TargetSamples=64,
    Offset=0.01,
    ColorScheme="Blue → Yellow")  # -> Visibility, Colors, TargetPoints, Report
viewshed = Viewshed(
    Context=geometry_3,
    Points=deconstruct_mesh.Vertices,
    ConeHalfAngle=60,
    Rays=500,
    Offset=0.01,
    ColorScheme="Blue → Yellow")  # -> Openness, Colors, Report
