# Grasshopper definition ViewShed.ghx (Grasshopper 1.0.8)
# plug-ins: Eddy3D-Radiance

geometry = Geometry(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)
geometry_2 = Geometry(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)
# Description: Visual openness and target visibility for points on a surface, by ray casting against surrounding geometry. Each observer Brep passes through Mesh Brep and Quad Remesh, and Deconstruct Mesh turns the vertices into points. Viewshed measures the unobstructed fraction of a view cone around each point: 26 degrees half-angle, 48 m view distance. With no normals wired, cones point straight up, a plan-view measure rather than a daylight metric. View Target rates how much of a target each point sees, the shared context blocking rays. Both return values from 0 to 1 and colors. Supply context, observer surfaces and target.
geometry_3 = Geometry([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])
mesh_brep = MeshBrep(
    Brep=geometry,
    Settings={GridMaxCount=0, GridMinCount=16, JaggedSeams=False, MaxEdgeLength=0, MinEdgeLength=0.0001, MinTolerance=0, Refine=True, RefineAngle=0, RelativeTolerance=0.65, SimplePlanes=True, Tolerance=0})
geometry_4 = Geometry(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)
mesh_brep_2 = MeshBrep(
    Brep=geometry_2,
    Settings={GridMaxCount=0, GridMinCount=16, JaggedSeams=False, MaxEdgeLength=0, MinEdgeLength=0.0001, MinTolerance=0, Refine=True, RefineAngle=0, RelativeTolerance=0.65, SimplePlanes=True, Tolerance=0})
quad_remesh = QuadRemesh(Geometry=mesh_brep, Settings={aqc=True, as=50, dhe=True, gci=0, null=False, pme=2, sa=0, tqc=2000})
quad_remesh_2 = QuadRemesh(Geometry=mesh_brep_2, Settings={aqc=True, as=50, dhe=True, gci=0, null=False, pme=2, sa=0, tqc=2000})
deconstruct_mesh = DeconstructMesh(Mesh=quad_remesh)  # -> Vertices, Faces, Colours, Normals
view_target = ViewTarget(
    Context=geometry_3,
    Points=deconstruct_mesh.Vertices,
    Target=geometry_4,
    TargetSamples=64,
    Offset=0.01,
    ColorScheme="Blue → Yellow")  # -> Visibility, Colors, TargetPoints, Report
deconstruct_mesh_2 = DeconstructMesh(Mesh=quad_remesh_2)  # -> Vertices, Faces, Colours, Normals
viewshed = Viewshed(
    Context=geometry_3,
    Points=deconstruct_mesh_2.Vertices,
    ConeHalfAngle=Slider(26, range=0..100),
    Rays=500,
    Offset=0.01,
    MaxDistance=Slider(48, range=0..100),
    ColorScheme="Viridis")  # -> Openness, Colors, Report, Cones
mesh = Mesh(viewshed.Cones)
