# Grasshopper definition Stormwater.ghx (Grasshopper 1.0.8)
# plug-ins: Eddy3D-Stormwater

# Description: Experimental surface-runoff check for a graded site: where can water pond, and which way does it run? The stored terrain Surface enters Stormwater Grid, which rasterises it at 1 m. Stormwater Run starts in Fast mode, terrain analytics only, so Deconstruct Stormwater draws depression capacity as a mesh and Stormwater Flowlines traces runoff paths up to 240 m, colored by contributing area. Design Storm, 100-year, 60-minute, alternating block, matters once Mode is Full for shallow-water depths; its IDF coefficients a, b, c are 1, 2, 3, so enter your own. Land Cover Runoff sits unconnected. Surface routing only, no pipes.
surface = Surface(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)
panel = Panel("""1
2
3""")
stormwater_grid = StormwaterGrid(Terrain=surface, CellSize=1, BuildingsAre="Walls", Supersample=1, DefaultManningsN=0.015, DefaultRunoffCoefficient=1)  # -> Grid, Preview, Summary
design_storm = DesignStorm(
    ReturnPeriod=100,
    Duration=60,
    IDFCoefficients=panel,
    Pattern="Alternating Block",
    BlockLength=5,
    ClimateAllowance="None (present day)")  # -> Storm, Intensities, TotalDepth, Summary
land_cover_runoff = LandCoverRunoff(Radius=500, SoilGroup="B — sandy loam (moderate)", Anchor=Point(0, 0, 0))  # -> Zones, Outlines, Classes, CurveNumbers
stormwater_run = StormwaterRun(Grid=stormwater_grid.Grid, Storm=design_storm.Storm, Mode="Fast (terrain only)", Run=True)  # -> Result, Summary, PeakDepth
deconstruct_stormwater = DeconstructStormwater(Result=stormwater_run.Result, Field="Depression capacity", Time=0, Cutoff=10)  # -> Mesh, Points, Values, Colors, Range
stormwater_flowlines = StormwaterFlowlines(Result=stormwater_run.Result, SeedSpacing=10, MinimumCatchment=0, MaximumLength=Slider(240, range=0..500), Time=0)  # -> Flowlines, Values, Colors, Range, Segments, SegmentColors
average = Average(Input=stormwater_flowlines.Values)  # -> flatten(ArithmeticMean)
deconstruct_domain = DeconstructDomain(Domain=stormwater_flowlines.Range)  # -> Start, End
custom_preview = CustomPreview(Geometry=deconstruct_stormwater.Mesh, Material=ColourSwatch(SwatchColor=RGB(0, 64, 255)))
explode = Explode(Curve=stormwater_flowlines.Flowlines, Recursive=True)  # -> Segments, Vertices
gradient = Gradient(
    LowerLimit=deconstruct_domain.Start,
    UpperLimit=deconstruct_domain.End,
    Parameter=average,
    stops=[0: RGB(234, 38, 0), 0.25: RGB(234, 126, 0), 0.5: RGB(254, 244, 84), 0.75: RGB(173, 203, 249), 1: RGB(75, 107, 169)])
stormwater_legend = StormwaterLegend(Style="Ponding depth", Range=stormwater_flowlines.Range, Plane=PlaneXY(0, 0, 0), Size=Slider(48, range=0..100), Steps=8)  # -> Swatches, Labels, LabelPlanes, Title
custom_preview_2 = CustomPreview(Geometry=stormwater_flowlines.Flowlines, Material=gradient)
