# Grasshopper definition WeatherMorphing.ghx (Grasshopper 1.0.8)
# plug-ins: Outdoor

download_weather = DownloadWeather(Search="Atlanta")  # -> EPWFile, Logs, Stations
morph_settings = MorphSettings(
    Ensemble=True,
    Interpolation="Engine default",
    Uncertainty="Engine default",
    WinterShift=0,
    SummerShift=0,
    PresentDay=False,
    Threads="8")
file_path = FilePath("/Users/patrickkastner/Desktop/Temp/FutureWeatherGenerator-CMIP6-Global-v5.0.0.jar")
morph_weather = MorphWeather(EPW=download_weather.EPWFile, Settings=morph_settings, FWGJar=file_path, Run=False)  # -> EPWFiles, Labels, Available, Logs
panel = Panel([morph_weather.Logs, morph_weather.EPWFiles, morph_weather.Labels, morph_weather.Available])
panel_2 = Panel(morph_weather.EPWFiles)
