# Grasshopper definition WisconsinFarm.ghx (Grasshopper 1.0.9)
# plug-ins: Eddy3D-LBM, Outdoor, Eddy3D, Eddy3D-Radiance, Eddy3D-FluidX3D

site_picker = SitePicker(
    SitePickerAddress="535th Street, Town of Martell, Pierce County, Wisconsin, 54767, United States",
    SitePickerLat=44.821472,
    SitePickerLon=-92.398313)  # -> Latitude, Longitude, Address
panel = Panel("200")
boolean_toggle = BooleanToggle(True)
panel_2 = Panel("600")
lidar_site = LiDARSite(
    Latitude=site_picker.Latitude,
    Longitude=site_picker.Longitude,
    Size="100",
    TerrainSize="100",
    Source="Auto",
    Roads=False,
    Run=boolean_toggle,
    LidarSiteInputLayoutVersion=4,
    LidarSiteOutputLayoutVersion=2)  # -> PointCloud, Footprints, RoofHints, Domain, Trees, TreeCrowns, LayerOutlines, LayerNames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
download_weather = DownloadWeather(
    Station="USA_WI_Volk.Field.ANGB.726436_TMYx",
    Latitude=site_picker.Latitude,
    Longitude=site_picker.Longitude,
    ChartMonthFrom=1,
    ChartMonthTo=12)  # -> EPWFile, Logs, Stations, Station, ExtraFiles, SiteLatitude, SiteLongitude
atmospheric_boundary_layer = AtmosphericBoundaryLayer(
    ReferenceHeight=10,
    RoughnessLengthZ0=1,
    GroundHeight=0,
    TurbulentKEK=0.015,
    TurbulentEpsilonΕ=0.135,
    TurbulentOmegaΩ=100,
    TerrainType="Custom (z0 input)",
    InletProfile="Log law (Richards & Hoxey)",
    DisplacementHeight=0,
    AblOutputLayoutVersion=2)  # -> BoundaryConditions, WindVectors
lbm_run_settings = LBMRunSettings(
    GridSpacing=1,
    Warmup=0,
    Averaging=0,
    ProbeHeight=1.5,
    ProbeSpacing=0,
    GPU=False,
    Runtime="Auto",
    Jitter=True,
    JitterAmplitude=5,
    VegetationDrag=0.25,
    PerturbedInflow=False,
    Ensemble=5,
    VegetationDensity="Custom (Vegetation Drag input)",
    Ground="None (bounce-back)",
    DisplacementHeight=0,
    OutletSponge=0,
    SyntheticTurbulence=True,
    Settle=0,
    GroundHeatFlux=0,
    BuildingHeatFlux=0,
    AirTemperature=20,
    Refine=False,
    IntegralLength=0,
    InstantSnapshots=False)
canopy = Canopy(Geometry=lidar_site.Trees, CrownTransmittance=0.2, PerCrossing=False, LeafOn=0, LeafOff=0)  # -> Canopy, Report
city_surface = CitySurface(
    PointCloud=lidar_site.PointCloud,
    Footprints=lidar_site.Footprints,
    Domain=lidar_site.Domain,
    LayerOutlines=lidar_site.LayerOutlines,
    LayerNames=lidar_site.LayerNames,
    LayerRoughness=lidar_site.LayerRoughness,
    Flatten=lidar_site.Flatten,
    RoofHints=lidar_site.RoofHints,
    LoD="LoD 2.2",
    CloudOffset=Vector(0, 0, 0),
    LayerPercentile=0.5,
    RoofPercentile=0.9,
    GroundSpacing=1,
    Smoothing=2,
    Buffer=0,
    Run=boolean_toggle,
    CitySurfaceInputLayoutVersion=10,
    ClayLook=True)  # -> Terrain, Buildings, Layers, LayerNames, Surface, RoofHeights, Report, LayerRoughness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
weather = Weather(EPWFilePath=download_weather.EPWFile)
bounding_box = BoundingBox(Content=city_surface.Surface, Plane=PlaneXY(0, 0, 0), UnionBox=True)  # -> Box, Box_2
geometry = Geometry(city_surface.Terrain)
geometry_2 = Geometry(city_surface.Buildings)
lbm_case = LBMCase(
    CaseName="Case",
    ABL=atmospheric_boundary_layer.BoundaryConditions,
    Domain=bounding_box.Box,
    Buildings=geometry_2,
    Terrain=geometry,
    Vegetation=lidar_site.Trees,
    Engine="Auto",
    Settings=lbm_run_settings,
    Write=Toggle(True),
    Clear=False,
    AutoName="nimble-gecko-grove-mirror",
    LbmCaseInputLayoutVersion=3)  # -> Logs, Case, Domain, Folder
mesh_join = MeshJoin(Meshes=[geometry, geometry_2])
deconstruct_mesh = DeconstructMesh(Mesh=mesh_join)  # -> Vertices, Faces, Colours, Normals
lbm_run = LBMRun(Case=lbm_case.Case, Run=False, LbmInputLayoutVersion=7, LbmShowSolverWindow2=True)  # -> Logs, Case, Domain, Folder, Progress, Done, Remaining, SimulatedTime, MaxSpeed
panel_3 = Panel(lbm_run.Logs)
sun_hours = SunHours(
    Context=mesh_join,
    Points=deconstruct_mesh.Vertices,
    Weather=weather,
    StartHour=0,
    EndHour=8760,
    Timestep=1,
    North=0,
    Offset=0.01,
    Canopy=canopy.Canopy,
    Engine="GPU",
    Date="Custom",
    SunHoursInputLayoutVersion=2)  # -> SunHours, Fraction, Colors, Report, MorningHours, AfternoonHours
flex_legend = FlexLegend(
    Values=sun_hours.SunHours,
    Points=deconstruct_mesh.Vertices,
    MetricType="sun hours",
    ColorMap="Magma",
    Contours="Bands + Lines",
    Plane=PlaneXY(0, 0, 0),
    LabelStyle="Text",
    Offset=0.5,
    Smoothing=0,
    Aggregate="Mean",
    HighlightTop=0,
    AnalysisMesh=mesh_join,
    Outlines=lidar_site.Footprints,
    FlexLegendInputLayoutVersion=5)  # -> LegendMesh, LegendPoints, LegendValues, FieldMesh, Colors, ResolvedRange, Contours, ContourValues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
fluidx3d_live_view = FluidX3DLiveView(
    Case=lbm_run.Case,
    Live=True,
    MaxSpeed=0,
    AvgWindow=360,
    Source="VTK frames",
    Appearance="Velocity + LIC",
    MaxSpeedup=1.5,
    Video=False)  # -> Mesh, Speeds, Time, Status, Histogram
