# Grasshopper definition Sunpath.ghx (Grasshopper 1.0.8)
# plug-ins: Outdoor, Eddy3D, Eddy3D-Radiance

# Description: Purpose: A sun path diagram for a city, as editable Rhino curves.
# Fidelity: Screening - solar geometry only, no weather or obstructions.
# Method: Sun Path reads latitude, longitude and time zone from the station's EPW and draws daily arcs and hourly analemmas.
# Result: Arcs for 21 June, 20 March and 21 December, hourly analemmas, a horizon circle and a text report at the origin.
# Needs: Nothing to install; Download Weather needs internet. Runtime: seconds.
# Edit: Station panel, Radius, North and Arc Days; wire sun vectors to plot positions.
panel = Panel("Istanbul")
weather = DownloadWeather(Station=panel, ChartMonthFrom=1, ChartMonthTo=12)  # -> EPWFile, Logs, Stations, Station, ExtraFiles, SiteLatitude, SiteLongitude
weather_2 = Weather(EPWFilePath=weather.EPWFile)
sunpath = SunPath(Weather=weather_2, Latitude=0, Longitude=0, TimeZone=0, Center=Point(0, 0, 0), Radius=100, North=0)  # -> Arcs, Analemmas, Suns, Compass, Report
