# Grasshopper definition WeatherMorphing.ghx (Grasshopper 1.0.8)
# plug-ins: Outdoor, Eddy3D, Eddy3D-Radiance

select_template = SelectTemplate()
# Description: Purpose: Future-climate weather files morphed from a present-day Atlanta EPW, set beside the baseline.
# Fidelity: Engineering - statistical morphing by the Future Weather Generator, not a climate simulation.
# Method: Morph Weather runs the generator jar with Morph Settings; two Deconstruct Weather components expose the baseline and a morphed file.
# Result: Morphed EPW files plus side-by-side temperature, humidity, wind and solar series.
# Needs: Eddy3D Setup > Morph weather (Future Weather Generator): Java 17+ and the jar, not shipped. Runtime: minutes to hours.
# Edit: Station, the jar File Path, Morph Settings; turn Run on.
eddy3d_setup = Eddy3DSetup(Open=False)
download_weather = DownloadWeather(Station="Atlanta", ChartMonthFrom=1, ChartMonthTo=12)  # -> EPWFile, Logs, Stations, Station, ExtraFiles, SiteLatitude, SiteLongitude
morph_settings = MorphSettings(
    Ensemble=True,
    Interpolation="Engine default",
    Uncertainty="Engine default",
    WinterShift=0,
    SummerShift=0,
    PresentDay=False,
    Threads="8",
    Method="Future Weather Generator")
file_path = FilePath("/Users/patrickkastner/Desktop/Temp/FutureWeatherGenerator-CMIP6-Global-v5.0.0.jar")
morph_weather = MorphWeather(EPW=download_weather.EPWFile, Settings=morph_settings, FWGJar=file_path, Run=False)  # -> EPWFiles, Labels, Available, Logs
list_item = ListItem(List=morph_weather.EPWFiles, Index=0, Wrap=True)
panel = Panel([morph_weather.Logs, morph_weather.EPWFiles, morph_weather.Labels, morph_weather.Available])
deconstruct_weather = DeconstructWeather(
    Weather=list_item,
    Series="""Dry Bulb Temperature
Relative Humidity
Wind Speed
Wind Direction
Solar Elevation
Solar Azimuth
Hour of Year""")  # -> DryBulbTemperature, RelativeHumidity, WindSpeed, WindDirection, SolarElevation, SolarAzimuth, HourOfYear
deconstruct_weather_2 = DeconstructWeather(
    Weather=download_weather.EPWFile,
    Series="""Dry Bulb Temperature
Relative Humidity
Wind Speed
Wind Direction
Solar Elevation
Solar Azimuth
Hour of Year""")  # -> DryBulbTemperature, RelativeHumidity, WindSpeed, WindDirection, SolarElevation, SolarAzimuth, HourOfYear
panel_2 = Panel(deconstruct_weather.DryBulbTemperature)
panel_3 = Panel(deconstruct_weather_2.DryBulbTemperature)
