# Grasshopper definition Noise.ghx (Grasshopper 1.0.9)
# plug-ins: Eddy3D-Noise, Outdoor, Eddy3D

boolean_toggle = BooleanToggle(True)
site_picker = SitePicker(
    SitePickerAddress="36, East 14th Street, Union Square, Manhattan Community Board 5, Manhattan, New York County, New York, 10003, United States",
    SitePickerLat=40.735204,
    SitePickerLon=-73.991737)  # -> Latitude, Longitude, Address
select_template = SelectTemplate()
lidar_site = LiDARSite(
    Latitude=site_picker.Latitude,
    Longitude=site_picker.Longitude,
    Size="200",
    Source="Auto",
    Roads=True,
    Run=boolean_toggle,
    LidarSiteInputLayoutVersion=4,
    LidarSiteOutputLayoutVersion=2)  # -> PointCloud, Footprints, RoofHints, Domain, Trees, TreeCrowns, LayerOutlines, LayerNames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
roads_from_osm = RoadsFromOSM(Latitude=site_picker.Latitude, Longitude=site_picker.Longitude, Radius="200", Fetch=True)  # -> Sources, Roads, Log
city_surface = CitySurface(
    PointCloud=lidar_site.PointCloud,
    Footprints=lidar_site.Footprints,
    Domain=lidar_site.Domain,
    LayerOutlines=lidar_site.LayerOutlines,
    LayerNames=lidar_site.LayerNames,
    LayerRoughness=lidar_site.LayerRoughness,
    Flatten=lidar_site.Flatten,
    RoofHints=lidar_site.RoofHints,
    LoD="LoD 1.2",
    CloudOffset=Vector(0, 0, 0),
    LayerPercentile=0.5,
    RoofPercentile=0.9,
    GroundSpacing="5",
    Smoothing=2,
    Buffer=0,
    Run=boolean_toggle,
    CitySurfaceInputLayoutVersion=10,
    ClayLook=True)  # -> Terrain, Buildings, Layers, LayerNames, Surface, RoofHeights, Report, LayerRoughness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
noise_receivers = NoiseReceivers(
    Buildings=city_surface.Buildings,
    Centre=Point(0, 0, 0),
    Radius="200",
    Spacing="5",
    Height=1.5,
    StoreyHeight=3,
    FacadeSpacing=5,
    Roofs=False)  # -> Receivers, GroundPoints, FacadePoints, RoofPoints
noise_run = NoiseRun(
    Sources=roads_from_osm.Sources,
    Receivers=noise_receivers.Receivers,
    Buildings=city_surface.Buildings,
    Terrain=city_surface.Terrain,
    Ground="Mixed",
    CellSize="5",
    Engine="GPU",
    Run=True,
    NoiseRunInputLayoutVersion=2)  # -> Result, Lden, Lnight, Points, Summary
noise_map = NoiseMap(Result=noise_run.Result, Metric="Lden")  # -> GroundMesh, FacadeMesh, Points, Values, Colors, LegendLabels, LegendColors, RoofMesh
mesh_join = MeshJoin(Meshes=[noise_map.GroundMesh, noise_map.FacadeMesh])
scalar_field_viewer = ScalarFieldViewer(
    Values=noise_map.Values,
    DisplayMode="Heatmap Mesh",
    ColorMap="Spectral",
    Mesh=mesh_join,
    Size=4,
    Fit="Gapless",
    ScalarFieldViewerInputLayoutVersion=2)  # -> Geometry, Colors, Range
flex_legend = FlexLegend(
    Values=noise_map.Values,
    Points=noise_map.Points,
    MetricType="custom",
    ColorMap="Spectral",
    Title="Lden",
    Contours="Bands",
    Plane=PlaneXY(0, 0, 0),
    Units="db(A)",
    LabelStyle="Text",
    Offset=0.5,
    Smoothing=0,
    Aggregate="Mean",
    HighlightTop=0,
    AnalysisMesh=mesh_join,
    FlexLegendInputLayoutVersion=5)  # -> LegendMesh, LegendPoints, LegendValues, FieldMesh, Colors, ResolvedRange, Contours, ContourValues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
