# Grasshopper definition umcf_utci.ghx (Grasshopper 1.0.8)
# plug-ins: Outdoor, Eddy3D, Eddy3D-Radiance

# ---- group: Run it only after the first installation of Eddy3D.
button = Button()

# ----
# Vegetation region
number_slider = Slider(2, range=0..10)
mesh = Mesh([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])
vegetation_mesh_settings = VegetationMeshSettings(FeatureRefinement=3, MinimumSurfaceRefinement=3, MaximumSurfaceRefinement=5)
vegetation_properties = VegetationProperties(EvaporationSides=1, DragCoefficientCd=0.2, AerodynamicResistanceC=131.035, showAllCoeffs=True)
triremesh = TriRemesh(Geometry=mesh, Sharp=Toggle(True), Length=number_slider, Iterations=25)  # -> Triangulation, Dual, Creases
custom_preview = CustomPreview(Geometry=triremesh.Triangulation, Material=ColourSwatch(SwatchColor=RGBA(147, 168, 145, 152)))
vegetation_region = VegetationRegion(VegetationMesh=triremesh.Triangulation, LeafAreaDensity=Slider(1, range=0..1), MeshSettings=vegetation_mesh_settings)

py3 = Python3Script()  # -> Directory
# ---------- py3: Python ----------
import os

# Gets the current user's home directory on both Windows and macOS
home_dir = os.path.expanduser("~")

# Concatenate with Eddy3d-cases
eddy_cases_dir = os.path.join(home_dir, "Eddy3D","Cases")

# Outputs
Directory = eddy_cases_dir
# ---------- end py3 ----------

# ----
# Timing/Weather settings
panel = Panel("https://energyplus-weather.s3.amazonaws.com/europe_wmo_region_6/TUR/TUR_Istanbul.170600_IWEC/TUR_Istanbul.170600_IWEC.epw")
c_script = CSharpScript(url=panel, saveTo=py3)  # -> out, epwPath; inputs url: String, saveTo: String
# ---------- c_script: C# ----------
// Grasshopper Script Instance
#region Usings
using System;
using System.Linq;
using System.Collections;
using System.Collections.Generic;
using System.Drawing;
using System.IO;
using System.Net.Http;
using System.Threading.Tasks;

using Rhino;
using Rhino.Geometry;

using Grasshopper;
using Grasshopper.Kernel;
using Grasshopper.Kernel.Data;
using Grasshopper.Kernel.Types;
#endregion

public class Script_Instance : GH_ScriptInstance
{
private void RunScript(string url, string saveTo, ref object epwPath)
{
  epwPath = null;

  try
  {
    // --- Validate URL ---
    if (string.IsNullOrWhiteSpace(url))
    {
      Print("URL is invalid.");
      return;
    }

    string urlFileName;
    try { urlFileName = System.IO.Path.GetFileName(new Uri(url).LocalPath); }
    catch { Print("URL is invalid."); return; }
    if (string.IsNullOrWhiteSpace(urlFileName)) urlFileName = "download.epw";

    // --- Decide destination path ---
    string filePath;

    if (string.IsNullOrWhiteSpace(saveTo))
    {
      // Use GH file's directory
      var ghDoc  = GrasshopperDocument; // <-- use this in C# Script
      var ghPath = ghDoc?.FilePath;

      if (string.IsNullOrEmpty(ghPath))
      {
        // fallback to Rhino document folder if available
        var rhPath = Rhino.RhinoDoc.ActiveDoc?.Path;
        var rhDir  = string.IsNullOrEmpty(rhPath) ? null : System.IO.Path.GetDirectoryName(rhPath);
        if (string.IsNullOrEmpty(rhDir))
        {
          Print("Grasshopper file is unsaved. Please save the .gh file or provide a destination path.");
          return;
        }
        Print("Grasshopper file is unsaved; saving to the Rhino document folder.");
        filePath = System.IO.Path.Combine(rhDir, urlFileName);
      }
      else
      {
        var ghDir = System.IO.Path.GetDirectoryName(ghPath);
        filePath  = System.IO.Path.Combine(ghDir, urlFileName);
      }
    }
    else
    {
      // Accept either a folder or a full file path
      string raw = saveTo.Trim().Trim('"');
      raw = Environment.ExpandEnvironmentVariables(raw);

      var ghDoc  = GrasshopperDocument; // <-- use this here too
      var ghPath = ghDoc?.FilePath;
      string baseRoot = !string.IsNullOrEmpty(ghPath)
        ? System.IO.Path.GetDirectoryName(ghPath)
        : System.IO.Directory.GetCurrentDirectory();

      string candidate = raw;
      if (!System.IO.Path.IsPathRooted(candidate))
        candidate = System.IO.Path.GetFullPath(System.IO.Path.Combine(baseRoot, candidate));

      bool endsWithSlash =
        candidate.EndsWith(System.IO.Path.DirectorySeparatorChar.ToString()) ||
        candidate.EndsWith(System.IO.Path.AltDirectorySeparatorChar.ToString());

      bool treatAsFolder = endsWithSlash || System.IO.Directory.Exists(candidate) || !System.IO.Path.HasExtension(candidate);

      if (treatAsFolder)
      {
        System.IO.Directory.CreateDirectory(candidate);
        filePath = System.IO.Path.Combine(candidate, urlFileName);
      }
      else
      {
        string dir = System.IO.Path.GetDirectoryName(candidate);
        if (!string.IsNullOrEmpty(dir)) System.IO.Directory.CreateDirectory(dir);
        filePath = candidate;
      }
    }

    // --- Skip download if exists ---
    if (System.IO.File.Exists(filePath))
    {
      Print($"File already exists at {filePath}, skipping download.");
      epwPath = filePath;
      return;
    }

    // --- Download synchronously ---
    using (var http = new System.Net.Http.HttpClient())
    using (var resp = http.GetAsync(url, System.Net.Http.HttpCompletionOption.ResponseHeadersRead).Result)
    {
      resp.EnsureSuccessStatusCode();
      using (var fs = new System.IO.FileStream(filePath, System.IO.FileMode.Create, System.IO.FileAccess.Write, System.IO.FileShare.None))
      {
        resp.Content.CopyToAsync(fs).Wait();
      }
    }

    Print($"File downloaded successfully to {filePath}");
    epwPath = filePath;
  }
  catch (Exception ex)
  {
    Print($"Failed to download file: {ex.Message}");
  }
}


}

public static class FileDownloader
{
    /// <summary>
    /// Asynchronously downloads a file from the specified URL and saves it to the given file path.
    /// </summary>
    /// <param name="url">The URL of the file to download.</param>
    /// <param name="filePath">The local file path to save the downloaded file.</param>
    public static async Task DownloadFileAsync(string url, string filePath)
    {
        // Validate inputs
        if (string.IsNullOrWhiteSpace(url))
            throw new ArgumentException("URL cannot be null or empty.", nameof(url));

        if (string.IsNullOrWhiteSpace(filePath))
            throw new ArgumentException("File path cannot be null or empty.", nameof(filePath));

        // Ensure the directory exists
        var directory = Path.GetDirectoryName(filePath);
        if (!string.IsNullOrEmpty(directory) && !Directory.Exists(directory))
        {
            Directory.CreateDirectory(directory);
        }

        try
        {
            // Download file using HttpClient
            using var httpClient = new HttpClient();
            using var response = await httpClient.GetAsync(url, HttpCompletionOption.ResponseHeadersRead);
            response.EnsureSuccessStatusCode();

            // Save the file
            await using var fileStream = new FileStream(filePath, FileMode.Create, FileAccess.Write, FileShare.None);
            await response.Content.CopyToAsync(fileStream);
        }
        catch (Exception ex)
        {
            Console.WriteLine($"Error downloading file: {ex.Message}");
            throw;
        }
    }
}
# ---------- end c_script ----------
weather = Weather(EPWFilePath=c_script.epwPath)
calendar = Calendar(Day=20, Hour=10, Month=2)
timing = TimingParameters(Weather=weather, DurationHours=1, HourOfYear=calendar)  # -> TimingSettings, HoursOfYear, AirTemperature, RelativeHumidity

# ---- group: One time patch!
install = InstallEngines(InstallRadiance=False, InstallEnergyPlus=False, InstallFluidX3D=False, ReinstallUMF=button, EngineMode=0)
panel_2 = Panel(install)

# ---- group: Terrain Region
terrain_surface_material = TerrainSurfaceMaterial(Material="Soil", DensityRho=1980, HeatCapacityCap=820, ThermalConductivity1Lambda1=1.35, ThermalConductivity2Lambda2=0)
soil_material = SoilMaterial()
terrain_region = TerrainRegion(SurfaceMaterial=terrain_surface_material, SoilMaterial=soil_material)

# ----
# Simulation/Mesh settings
number_slider_2 = Slider(90, range=0..100)
simulation_settings = SimulationSettings(
    WriteFormat="ascii",
    CPUCount=Slider(4, range=0..20),
    MaxFluidIterations=Slider(50, range=0..1000),
    PCEquationForm="pc-based",
    DampingThickness="30")
simulation_meshsettings = SimulationMeshSettings(BoxRefinementLevel=Slider(2, range=0..10), CellsBetweenLevels=Slider(3, range=0..10), IncludedAngle=number_slider_2)

# ----
# Box domain parameters
number_slider_3 = Slider(20, range=0..100)
box_domain_dimensions = BoxDomainDimensions(
    CellSize=Slider(20, range=0..100),
    FrontExtension=Slider(50, range=0..300),
    BackExtension=Slider(100, range=0..300),
    SideExtension=Slider(50, range=0..300),
    TopExtension=Slider(50, range=0..300),
    RefinementBoxExtension=number_slider_3)

pt = Point(Point(-101.1636756, 0, 0))
simulation_mesh_settings = SimulationMeshSettings()
deweather = DeconstructWeather(Weather=weather)  # -> DryBulbTemperature, RelativeHumidity, WindSpeed, WindDirection

# ---- group: 1. Write to folder
write = Button()

# ----
item = ListItem(List=deweather.WindSpeed, Index=expr("x-1", calendar), Wrap=True)
item_2 = ListItem(List=deweather.WindDirection, Index=calendar, Wrap=True)

# ----
# Air region
abl = AtmosphericBoundaryLayer(
    WindDirections=item_2,
    WindSpeed=item,
    ReferenceHeight=10,
    RoughnessLengthZ0=1,
    GroundHeight=0,
    TurbulentKEK=0.015,
    TurbulentEpsilonΕ=0.135,
    TurbulentOmegaΩ=100)  # -> BoundaryConditions, WindVectors, AirABLSettings
amplitude = Amplitude(Vector=abl.WindVectors, Amplitude=20)
air_region = AirRegion(ABLSettings=abl.AirABLSettings)
vector_display_ex = VectorDisplayEx(Point=pt, Vector=amplitude, Colour=RGB(255, 255, 255), Width=2)

# ---- group: if you run it before, just call it by"read"
read = Button()

# ---- group: to run a new case, first clear the existing one.
clear = Button()

# ----
case_name = Panel("TestingNow")
py3_2 = Python3Script()  # -> Directory
# ---------- py3_2: Python ----------
import os

# Gets the current user's home directory on both Windows and macOS
home_dir = os.path.expanduser("~")

# Concatenate with Eddy3d-cases
eddy_cases_dir = os.path.join(home_dir, "Eddy3D", "Cases")

# Outputs
Directory = eddy_cases_dir
# ---------- end py3_2 ----------
panel_3 = Panel(py3_2)

# ---- group: 2. Prepare and run
button_2 = Button()
button_3 = Button()

# ----
crv = Curve(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)

# ----
# Buildings
number_slider_4 = Slider(1, range=0..10)
mesh_2 = Mesh([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])
triremesh_2 = TriRemesh(Geometry=mesh_2, Sharp=Toggle(True), Length=number_slider_4, Iterations=25)  # -> Triangulation, Dual, Creases
bldgmesh = BuildingMeshSettings(FeatureRefinement=4, SurfaceLevelMin=3, SurfaceLevelMax=3, LayerCount=2)
custom_preview_2 = CustomPreview(Geometry=triremesh_2.Triangulation, Material=ColourSwatch(SwatchColor=RGB(255, 255, 255)))

building_material = BuildingMaterial(Material=Slider(0, range=0..15))
building_material_2 = BuildingMaterial(Material=Slider(1, range=0..15))

building = BuildingRegion(
    BuildingMesh=triremesh_2.Triangulation,
    OuterMaterial=building_material_2,
    InnerMaterial=building_material,
    OuterThickness=0.1,
    InnerThickness=0.1,
    MeshSettings=bldgmesh,
    BuildingTemperature=Slider(20, range=0..100))

umcfcase = UMCFCase(
    ReadCase=read,
    Write=write,
    ClearCase=clear,
    CaseName=case_name,
    WorkingDirectory=py3_2,
    AirRegion=air_region,
    VegetationRegion=vegetation_region,
    BuildingRegion=building,
    TerrainRegion=terrain_region,
    DomainParameters=box_domain_dimensions,
    TimingSettings=timing.TimingSettings,
    SimulationSettings=simulation_settings,
    SimulationMeshSettings=simulation_meshsettings)  # -> Logs, Case, DomainBox, RefinementBox, TotalMesh, Building

run = Run(Case=umcfcase.Case, Mesh=button_2, Simulate=button_3, RunAll=False, Parallel=True, DirectionIndex=-1, ShowZones=False)

# ----
# Refinement box preview
colour_swatch = ColourSwatch(SwatchColor=RGB(0, 0, 0))
deconstruct_brep = DeconstructBrep(Brep=umcfcase.RefinementBox)  # -> Faces, Edges, Vertices
custom_preview_3 = CustomPreview(Geometry=deconstruct_brep.Edges, Material=colour_swatch)

item_3 = ListItem(List=deconstruct_brep.Faces, Index=4, Wrap=True)

move = Move(Geometry=item_3, Motion=Vector(0, 0, 1.8))  # -> Geometry, Transform

entwine = Entwine(Branch00=move.Geometry, Branch01=crv, FlattenInputs=True)  # -> simplify(Result)

# ----
# Probing plane
list = ValueList({"Horizontal Plane": 0, "Vertical Plane": 1}, selected="Horizontal Plane")
number_slider_5 = Slider(1, range=0..10)

branch = TreeBranch(Tree=entwine, Path=list, MaintainPaths=False)
srf = Surface(branch)

brep2pts = BrepToGridPoints(Geometry=srf, Spacing=number_slider_5)  # -> Points, Vectors, Mesh, Status
probe = Probe(
    Case=umcfcase.Case,
    Points=brep2pts.Points,
    Field="TMean",
    Region="air",
    ProbeName="probing01",
    Run=False,
    AutoProbeName="merry-dingo-orchard-anchor",
    BakeTimeHistory=False,
    CullHugeVectors=True,
    CullInvalid=True,
    ShowRegion=True)  # -> Values, TimeSteps, SubResults

facen = FaceNormals(Mesh=srf)  # -> Centers, Normals
probe_2 = Probe(
    Case=umcfcase.Case,
    Points=brep2pts.Points,
    Field="UMean",
    Region="air",
    ProbeName="probing02",
    Run=False,
    AutoProbeName="merry-dingo-orchard-anchor",
    BakeTimeHistory=False,
    CullHugeVectors=True,
    CullInvalid=True,
    ShowRegion=True)  # -> Values, TimeSteps, SubResults
probe_3 = Probe(
    Case=umcfcase.Case,
    Points=brep2pts.Points,
    Field="wMean",
    Region="air",
    ProbeName="probing03",
    Run=False,
    AutoProbeName="merry-dingo-orchard-anchor",
    BakeTimeHistory=False,
    CullHugeVectors=True,
    CullInvalid=True,
    ShowRegion=True)  # -> Values, TimeSteps, SubResults

# ----
# Wind velocity (U) probe
number_slider_6 = Slider(0.2, range=0..3)
vector_length = VectorLength(Vector=probe_2.Values)
construct_domain = ConstructDomain(DomainStart=number_slider_6, DomainEnd=Slider(0.7, range=0..10))
bounds = Bounds(Numbers=vector_length)
remap_numbers = RemapNumbers(Value=vector_length, Source=bounds, Target=construct_domain)  # -> Mapped, Clipped
deconstruct_domain = DeconstructDomain(Domain=bounds)  # -> Start, End
amplitude_2 = Amplitude(Vector=probe_2.Values, Amplitude=remap_numbers.Mapped)
gradient = Gradient(
    LowerLimit=deconstruct_domain.End,
    UpperLimit=deconstruct_domain.Start,
    Parameter=vector_length,
    stops=[0: RGB(48, 18, 59), 0.0294: RGB(56, 40, 112), 0.0588: RGB(63, 62, 156), 0.0882: RGB(68, 82, 193), 0.118: RGB(70, 102, 221), 0.147: RGB(71, 122, 241)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])
vector_display_ex_2 = VectorDisplayEx(Point=brep2pts.Points, Vector=amplitude_2, Colour=gradient, Width=2)

rh = RelativeHumidity(SpecificHumidity=probe_3.Values, Temperature=probe.Values, Pressure=101325)

# ----
# Relative Humidity (%)
bounds_2 = Bounds(Numbers=rh)
deconstruct_domain_2 = DeconstructDomain(Domain=bounds_2)  # -> Start, End
gradient_2 = Gradient(
    LowerLimit=deconstruct_domain_2.End,
    UpperLimit=deconstruct_domain_2.Start,
    Parameter=rh,
    stops=[0: RGB(48, 18, 59), 0.0294: RGB(56, 40, 112), 0.0588: RGB(63, 62, 156), 0.0882: RGB(68, 82, 193), 0.118: RGB(70, 102, 221), 0.147: RGB(71, 122, 241)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])
preview = CustomPreview(Geometry=brep2pts.Points, Material=gradient_2)

circle = CircleCNR(Center=brep2pts.Points, Normal=facen.Normals, Radius=expr("x/2", number_slider_5))

# ----
# Temperature (T) probe
panel_4 = Panel("273")
expression = Expression(x=probe.Values, y=panel_4, Expression="x-y")
bounds_3 = Bounds(Numbers=expression)
deconstruct_domain_3 = DeconstructDomain(Domain=bounds_3)  # -> Start, End
gradient_3 = Gradient(
    LowerLimit=deconstruct_domain_3.Start,
    UpperLimit=deconstruct_domain_3.End,
    Parameter=expression,
    stops=[0: RGB(48, 18, 59), 0.0294: RGB(56, 40, 112), 0.0588: RGB(63, 62, 156), 0.0882: RGB(68, 82, 193), 0.118: RGB(70, 102, 221), 0.147: RGB(71, 122, 241)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])
srf_2 = Surface(circle)
preview_2 = CustomPreview(Geometry=srf_2, Material=gradient_3)

surface = MRTSurface(Geometry=srf, Type=1, Simulated=True, PatchSize=3, Temperature=expression, TemperaturePoints=brep2pts.Points)  # -> Surface, Mesh
sensors = MRTSensors(Mesh=surface.Mesh, Points=brep2pts.Points, Normal=Vector(0, 0, 1), Height=1.1)  # -> Sensors, Points
mrt = MRT(
    Surfaces=surface.Surface,
    Sensors=sensors.Sensors,
    EPW=c_script.epwPath,
    Run=False,
    Engine="Native",
    HoursOfYear=calendar)  # -> Points, MRT, SkyDome, Probes

# ---- group: UTCI calculation
comfort = ThermalComfort(AirTemperature=expression, RelativeHumidity=probe_3.Values, WindSpeed=vector_length, MRT=mrt.MRT, ActiveMetric="UTCI")  # -> Value, Stress, Details, MetricType
pt_2 = Point(Point(46.919285, -64.14896314, 0))
bnd = Bounds(Numbers=comfort.Value)
dedomain = DeconstructDomain(Domain=bnd)  # -> Start, End
panel_5 = Panel(comfort.Value)
cir = Circle(Plane=PlaneXY(0, 0, 0), Radius=1)
gradient_4 = Gradient(
    LowerLimit=dedomain.Start,
    UpperLimit=dedomain.End,
    Parameter=comfort.Value,
    stops=[0: RGB(48, 18, 59), 0.0294: RGB(56, 40, 112), 0.0588: RGB(63, 62, 156), 0.0882: RGB(68, 82, 193), 0.118: RGB(70, 102, 221), 0.147: RGB(71, 122, 241)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])
srf_3 = Surface(cir)

# ----
utcipetlegend = UTCIPETLegend(
    Values=comfort.Value,
    Plane=pt_2,
    Size=2,
    Mesh=surface.Mesh,
    Offset=5,
    SmoothColors=True,
    CircleRadius=0.5,
    SensorPoints=sensors.Points,
    Scale=2,
    Metric=comfort.MetricType)  # -> Colors, Categories, LegendMesh, LabelPoints, Labels, UTCIMesh, CenteredLabels
nullrep = ReplaceNulls(Items=panel_5, Replacements="0")  # -> Items, Count
rep = ReplaceText(Text=panel_5, Find="NaN", Replace="0", RecursiveReplace=False)

# ---- group: UTCI calculation (continued)
round = Round(Number=rep)  # -> Nearest, Floor, Ceiling
preview_3 = CustomPreview(Geometry=srf_3, Material=utcipetlegend.Colors)
mesh_3 = Mesh(utcipetlegend.UTCIMesh)
mesh_4 = Mesh(utcipetlegend.LegendMesh)
tag = TextTag(Location=brep2pts.Points, Text=round.Nearest, Colour=ColourSwatch(SwatchColor=RGB(0, 0, 0)))
tag_2 = TextTag3D(
    Location=utcipetlegend.LabelPoints,
    Text=utcipetlegend.Labels,
    Size=1,
    Colour=ColourSwatch(SwatchColor=RGB(0, 0, 0)),
    Justification=8)

# ----
panel_6 = Panel(rep)
