# Grasshopper definition 1_WindDirs_8.ghx (Grasshopper 1.0.7)

panel = Panel("15")
panel_3 = Panel("""0
45
90
135
180
225
270
315""")
series = Series(Start="0", Step="22.5", Count=Slider(16, range=0..100))
series_2 = Series(Start="0", Step="10", Count=Slider(36, range=0..100))
panel_4 = Panel("""0
10
20
30
40
50
60
70
80
90
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""")
panel_5 = Panel(series)
panel_6 = Panel(series_2)
panel_7 = Panel("""0
22.5
45
67.5
90
112.5
135
157.5
180
202.5
225
247.5
270
292.5
315
337.5""")
