# Grasshopper definition 3_SimpleWindAnalysis.ghx (Grasshopper 1.0.8)
# plug-ins: Eddy3D

# ----
# 1. Geometry &
# Boundary Conditions
number_slider = Slider(0, range=0..100)
abl = ABLFlow(WindDirections=number_slider)

select = SelectTemplate()

# ----
# 2. Simulation Domain
cluster = Cluster_2()
dombox = BoxDomain(Buildings=cluster, BoundaryCondition=abl, CellSize=Slider(10, range=0..10))  # -> Domain, PreviewMesh

# ----
# 3. Mesh & Simulation
panel = Panel("3_SimpleWindAnalysis")
panel_2 = Panel("1500")
button = Button()
button_2 = Button()
button_3 = Button()
rset = RunSettings(
    Iterations=1000,
    WriteInterval=20,
    TimestepsToKeep=3,
    TurbulenceModel=1,
    RelaxationFactors=3,
    NumericalSchemes=1,
    PotentialFlowInit=False,
    AgeOfAir=False,
    CPUCores="24",
    BlueCFDFolder=0,
    DebugDiagnostics=False,
    SIMPLEC=False)
mset = MeshSettings(
    BuildingMinLevel="3",
    BuildingMaxLevel="3",
    FeatureLevel=2,
    BoundingBoxLevel="3",
    GroundLevel=2,
    BoundaryLayers=1,
    CellsBetweenLevels=4,
    MeshMode=4,
    Preset=1)
windsim = WindSimulation(
    SimulationDomain=dombox.Domain,
    WorkingDirectory=panel,
    MeshSettings=mset,
    RunSettings=rset,
    RunMeshing=False,
    MakeTrees=False,
    RunSimulation=False)  # -> SimulationResult, MeshDone, SimDone, MeshRemainingTime, SimulationRemainingTime
residuals = VisualizeResiduals(Result=windsim.SimulationResult, Plot=":", visResiduals=False)

# ----
# 4. Probing points & probing
panel_3 = Panel("2")
unit_z = UnitZ(Factor=panel_3)
brep = Brep(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)
move = Move(Geometry=brep, Motion=unit_z)  # -> Geometry, Transform
brep_to_grid_points = BrepToGridPoints(Geometry=move.Geometry, Spacing=Slider(2, range=0..10), Run=True)  # -> Points, Status
probing = Probing(
    Result=windsim.SimulationResult,
    ProbingPoints=brep_to_grid_points.Points,
    NameOfInstance="ttt",
    InterpolationScheme=3,
    NameOfField=0,
    Run=Button())  # -> ProbingPoints, ProbingResult

# ----
# 5. Post-processing
# 5.1. Paraview
# 5.2. Wind vectors
points = Data(probing.ProbingPoints)
vectors = Data(probing.ProbingResult)
button_4 = Button()
paraview = Paraview(Result=windsim.SimulationResult, Run=1)
cluster_2 = Cluster(data=vectors)  # -> S, E, data_3
amplitude = Amplitude(Vector=vectors, Amplitude=Slider(3, range=0..10))
gradient = Gradient(
    LowerLimit=cluster_2.S,
    UpperLimit=cluster_2.E,
    Parameter=cluster_2.data_3,
    stops=[0.103: RGB(0, 0, 255), 0.22: RGB(0, 170, 255), 0.305: RGB(0, 255, 255), 0.398: RGB(0, 255, 188), 0.504: RGB(0, 255, 106), 0.605: RGB(91, 255, 0), 0.699: RGB(184, 255, 0), 0.799: RGB(255, 255, 0), 0.898: RGB(255, 170, 0)])
vdisex = VectorDisplayEx(Point=points, Vector=amplitude, Colour=gradient, Width=Slider(2, range=0..10))

# ----
# 6. Clean
button_5 = Button()
clean = CleanDirectories(ResultDirectory=panel, Mode=0, Run=button_5)

# ==== cluster Cluster
data = ClusterInput()
data_2 = Data(data)
data_3 = ClusterOutput(data_2)
bnd = Bounds(Numbers=data_2)
dedomain = DeconstructDomain(Domain=bnd)  # -> Start, End
S = ClusterOutput(dedomain.Start)
E = ClusterOutput(dedomain.End)

# ==== cluster Cluster_2
geo = Geometry([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])
mesh = Mesh(geo)
mjoin = MeshJoin(Meshes=mesh)
M = ClusterOutput(mjoin)
