# Grasshopper definition 3_SimpleWindAnalysisCylDomain.ghx (Grasshopper 1.0.8)
# plug-ins: Eddy3D

# ----
# 1. Geometry &
# Boundary Conditions
number_slider = Slider(0, range=0..359)

abl = ABLFlow(WindDirections=number_slider, ReferenceVelocity="5", ReferenceHeight="10")

# ---- group: BUILDINGS
buildings = Geometry([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])

# ----
# COST CFD Practice
bounding_box = BoundingBox(Content=buildings, Plane=PlaneXY(0, 0, 0), UnionBox=True)  # -> Box, Box_2
deconstruct_box = DeconstructBox(Box=bounding_box.Box)  # -> Plane, X, Y, Z
deconstruct_domain = DeconstructDomain(Domain=deconstruct_box.Z)  # -> Start, End
subtraction = Subtraction(A=deconstruct_domain.End, B=deconstruct_domain.Start)

# ---- group: 15H=OUTLET DISTANCE
multiplication = Multiplication(A=subtraction, B="15")

# ----
mesh_settings = MeshSettings(
    BuildingMinLevel=2,
    BuildingMaxLevel=3,
    FeatureLevel=2,
    BoundingBoxLevel=0,
    GroundLevel=2,
    BoundaryLayers=4,
    CellsBetweenLevels=5,
    MeshMode=1,
    Preset=0)

# ----
# 6. Clean
button = Button()

# ----
# 2. Simulation Domain
plane_surface = PlaneSurface(Plane=deconstruct_box.Plane, XSize=deconstruct_box.X, YSize=deconstruct_box.Y)
pedestrian_level = Panel("1.8")
panel = Panel(multiplication)
area = Area(Geometry=plane_surface)  # -> Area, Centroid
unit_z = UnitZ(Factor=pedestrian_level)

circle = Circle(Plane=area.Centroid, Radius=panel)

# ---- group: 6H=DOMAIN HEIGHT
division = Division(A=panel, B="3")

# ---- group: TERRAIN
surface = Surface(circle)

# ----
move = Move(Geometry=surface, Motion=unit_z)  # -> Geometry, Transform
area_2 = Area(Geometry=move.Geometry)  # -> Area, Centroid
scale = Scale(Geometry=move.Geometry, Center=area_2.Centroid, Factor=0.5)  # -> Geometry, Transform

domcyl = CylindricalDomain(
    Buildings=buildings,
    Terrain=surface,
    BoundaryCondition=abl,
    CellSize="10",
    OuterRadius=panel,
    Height=division,
    RadialMultiplier=Slider(1, range=0..1),
    XDivisions=Slider(2, range=0..10))  # -> Domain, PreviewMesh

# ----
# 3. Mesh & Simulation
panel_2 = Panel("3_SimpleWindAnalysis_CYL22")

rset = RunSettings(
    Iterations=1000,
    WriteInterval=20,
    TimestepsToKeep=3,
    TurbulenceModel=1,
    RelaxationFactors=3,
    NumericalSchemes=1,
    PotentialFlowInit=False,
    AgeOfAir=False,
    CPUCores="12",
    DebugDiagnostics=False,
    SIMPLEC=False)
windsim = WindSimulation(
    SimulationDomain=domcyl.Domain,
    WorkingDirectory=panel_2,
    MeshSettings=mesh_settings,
    RunSettings=rset,
    RunMeshing=Button(),
    MakeTrees=False,
    RunSimulation=Button(),
    SelectedEngine=0)  # -> SimulationResult, MeshDone, SimDone, MeshRemainingTime, SimulationRemainingTime

residuals = VisualizeResiduals(Result=windsim.SimulationResult, Plot=Button())

# ----
# 4. Probing points & probing
brep_to_grid_points = BrepToGridPoints(Geometry=scale.Geometry, Spacing="2", Run=True)  # -> Points, Status
probing = Probing(
    Result=windsim.SimulationResult,
    ProbingPoints=brep_to_grid_points.Points,
    NameOfInstance="ttt",
    InterpolationScheme=3,
    NameOfField=0,
    Run=Button())  # -> ProbingPoints, ProbingResult

clean = CleanDirectories(ResultDirectory=panel_2, Mode=0, Run=button)
paraview = Paraview(Result=windsim.SimulationResult)

# ----
# 5. Post-processing
# 5.1. Paraview
# 5.2. Grasshopper
# Wind vectors
points = Data(probing.ProbingPoints)
vectors = Data(probing.ProbingResult)
button_2 = Button()
cluster = Cluster(data=vectors)  # -> S, E, data_3
gradient = Gradient(
    LowerLimit=cluster.S,
    UpperLimit=cluster.E,
    Parameter=cluster.data_3,
    stops=[0.103: RGB(0, 0, 255), 0.22: RGB(0, 170, 255), 0.305: RGB(0, 255, 255), 0.398: RGB(0, 255, 188), 0.504: RGB(0, 255, 106), 0.605: RGB(91, 255, 0), 0.699: RGB(184, 255, 0), 0.799: RGB(255, 255, 0), 0.898: RGB(255, 170, 0)])

amplitude = Amplitude(Vector=vectors, Amplitude=Slider(3, range=0..10))

vdisex = VectorDisplayEx(Point=points, Vector=amplitude, Colour=gradient, Width=Slider(2, range=0..10))

# ==== cluster Cluster
data = ClusterInput()
data_2 = Data(data)
data_3 = ClusterOutput(data_2)
bnd = Bounds(Numbers=data_2)
dedomain = DeconstructDomain(Domain=bnd)  # -> Start, End
S = ClusterOutput(dedomain.Start)
E = ClusterOutput(dedomain.End)
