# Grasshopper definition 3_SimpleWindAnalysisWithTree.ghx (Grasshopper 1.0.8)
# plug-ins: Eddy3D

# ----
# 1. Geometry &
# Boundary Conditions
panel = Panel("0")
cluster = Cluster_2()
cluster_2 = Cluster_2()
abl = ABLFlow(WindDirections=panel)
cluster_3 = Cluster_3(G=cluster)

geo = Geometry(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)
geo_2 = Geometry(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)
geo_3 = Geometry([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])
tree = Tree(Geometry=geo, Type="dense")
tree_2 = Tree(Geometry=geo_2, Type="medium")
tree_3 = Tree(Geometry=geo_3, Type="dense")
# 2. Simulation Domain
relay = Relay([cluster_2, cluster_3])
dombox = BoxDomain(Buildings=relay, Trees=[tree, tree_2, tree_3], BoundaryCondition=abl, CellSize=20)  # -> Domain, PreviewMesh

# ----
# 3. Mesh & Simulation
panel_2 = Panel("3_SimpleWindAnalysisWithTree")

mesh_settings = MeshSettings(
    BuildingMinLevel=2,
    BuildingMaxLevel=3,
    FeatureLevel=2,
    BoundingBoxLevel=0,
    GroundLevel=2,
    BoundaryLayers=4,
    CellsBetweenLevels=5,
    MeshMode=1,
    Preset=0)
windsim = WindSimulation(
    SimulationDomain=dombox.Domain,
    WorkingDirectory=panel_2,
    MeshSettings=mesh_settings,
    RunMeshing=Button(),
    MakeTrees=False,
    RunSimulation=Button(),
    SelectedEngine=0)  # -> SimulationResult, MeshDone, SimDone, MeshRemainingTime, SimulationRemainingTime
live_residuals = LiveResiduals(Result=windsim.SimulationResult, Live=True, WindDirection=-1)

# ----
# 4. Probing points & probing
number_slider = Slider(6, range=0..10)
brep = Brep(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)
cluster_4 = Cluster_4(relay=number_slider)
mesh = MeshBrep(Brep=brep, Settings=cluster_4)
mjoin = MeshJoin(Meshes=relay)
probing = Probing(BuildingMesh=mjoin, GroundMesh=mesh, ConvertQuadsToTriangles_2=True)
demesh = DeconstructMesh(Mesh=probing)  # -> Vertices, Faces, Colours, Normals

probe = ProbeSimulation(
    Result=windsim.SimulationResult,
    ProbingPoints=demesh.Vertices,
    NameOfInstance="ttt",
    InterpolationScheme=3,
    NameOfField=0,
    Run=Button())  # -> ProbingPoints, ProbingResult

# ----
# 5. Post-processing
# 5.1. Paraview
# 5.2. Grasshopper
# Wind vectors
cluster_5 = Cluster(data=probe.ProbingResult)  # -> S, E, data_3
points = Data(probe.ProbingPoints)
vectors = Data(probe.ProbingResult)
button = Button()
number_slider_2 = Slider(5, range=0..10)
gradient = Gradient(
    LowerLimit=cluster_5.S,
    UpperLimit=number_slider_2,
    Parameter=cluster_5.data_3,
    stops=[0.103: RGB(0, 0, 255), 0.22: RGB(0, 170, 255), 0.305: RGB(0, 255, 255), 0.398: RGB(0, 255, 188), 0.504: RGB(0, 255, 106), 0.605: RGB(91, 255, 0), 0.699: RGB(184, 255, 0), 0.799: RGB(255, 255, 0), 0.898: RGB(255, 170, 0)])
vdisex = VectorDisplayEx(Point=points, Vector=vectors, Colour=gradient, Width=Slider(2, range=0..10))

# ----
# 6. Clean
button_2 = Button()
clean = CleanDirectories(ResultDirectory=windsim.SimulationResult, Mode=0, Run=button_2)

gradient_2 = Gradient(
    LowerLimit=cluster_5.S,
    UpperLimit=number_slider_2,
    Parameter=cluster_5.data_3,
    stops=[0.103: RGB(0, 0, 255), 0.22: RGB(0, 170, 255), 0.305: RGB(0, 255, 255), 0.398: RGB(0, 255, 188), 0.504: RGB(0, 255, 106), 0.605: RGB(91, 255, 0), 0.699: RGB(184, 255, 0), 0.799: RGB(255, 255, 0), 0.898: RGB(255, 170, 0)])
paraview = Paraview(Result=windsim.SimulationResult)
conmesh = ConstructMesh(Vertices=demesh.Vertices, Faces=demesh.Faces, Colours=gradient_2)

# ==== cluster Cluster
data = ClusterInput()
data_2 = Data(data)
data_3 = ClusterOutput(data_2)
bnd = Bounds(Numbers=data_2)
dedomain = DeconstructDomain(Domain=bnd)  # -> Start, End
S = ClusterOutput(dedomain.Start)
E = ClusterOutput(dedomain.End)

# ==== cluster Cluster_2
geo = Geometry([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])
mesh = Mesh(geo)
mjoin = MeshJoin(Meshes=mesh)
M = ClusterOutput(mjoin)

# ==== cluster Cluster_3
X = UnitX(Factor="150")
G = ClusterInput()
move = Move(Geometry=G, Motion=X)  # -> Geometry, Transform
G_2 = ClusterOutput(move.Geometry)

# ==== cluster Cluster_4
relay = ClusterInput()
custom_mesh_settings = SettingsCustom(
    StitchSeams=True,
    SimplePlanes=False,
    Refine=True,
    MinCount=16,
    MaxCount=400,
    AspectRatio=20,
    MaxDistance=0,
    MaxAngle=20,
    MinEdge=relay,
    MaxEdge=relay)
S = ClusterOutput(custom_mesh_settings)
