# Grasshopper definition 4_AnnualWindAnalysis.ghx (Grasshopper 1.0.8)
# plug-ins: Eddy3D

select_template = SelectTemplate()
# 1. Geometry &
# Boundary Conditions
panel = Panel("""0
45
90
135
180
225
270
315""")
panel_2 = Panel("""5
6
4
3
5
4
6
5""")
panel_3 = Panel("https://energyplus-weather.s3.amazonaws.com/asia_wmo_region_2/IND/IND_Ahmedabad.426470_IWEC/IND_Ahmedabad.426470_IWEC.epw")

abl = ABLFlow(WindDirections=panel, ReferenceVelocity=panel_2, ReferenceHeight="10", WeatherFile=panel_3)

buildings = Geometry([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])
circle = Circle(Plane=PlaneXY(0, 0, 0), Radius=Slider(150, range=0..1000))
unit_z = UnitZ(Factor=Slider(2, range=0..10))

# ---- group: Ground
surface = Surface(circle)

# ----
move = Move(Geometry=surface, Motion=unit_z)  # -> Geometry, Transform

# ----
# 2. Simulation Domain
domcyl = CylindricalDomain(
    Buildings=buildings,
    BoundaryCondition=abl,
    CellSize="10",
    RadialMultiplier=Slider(1, range=0..1),
    XDivisions=Slider(2, range=0..10))  # -> Domain, PreviewMesh

mesh_settings = MeshSettings(
    BuildingMinLevel=2,
    BuildingMaxLevel=3,
    FeatureLevel=2,
    BoundingBoxLevel=0,
    GroundLevel=2,
    BoundaryLayers=4,
    CellsBetweenLevels=5,
    MeshMode=1,
    Preset=0)

# ----
# 3. Mesh & Simulation
panel_4 = Panel("4_AnnualWindAnalysis")
windsim = WindSimulation(
    SimulationDomain=domcyl.Domain,
    WorkingDirectory=panel_4,
    MeshSettings=mesh_settings,
    RunMeshing=Button(),
    MakeTrees=False,
    RunSimulation=Button(),
    SelectedEngine=0)  # -> SimulationResult, MeshDone, SimDone, MeshETA, SimETA

live_residuals = LiveResiduals(Result=windsim.SimulationResult, Live=True, WindDirection=-1)
panel_5 = Panel(windsim.MeshDone)
panel_6 = Panel(windsim.MeshETA)

# ----
# 4. Probing points & probing
brep_to_grid_points = BrepToGridPoints(Breps=move.Geometry, Spacing="5", Run=True)  # -> Points, Status
probing = Probing(
    Result=windsim.SimulationResult,
    ProbingPoints=brep_to_grid_points.Points,
    NameOfInstance="ttt",
    InterpolationScheme=3,
    NameOfField=0,
    Run=Button())  # -> ProbingPoints, ProbingResult

panel_7 = Panel(windsim.SimDone)
panel_8 = Panel(windsim.SimETA)

# ----
# 6. Clean
button = Button()
clean = CleanDirectories(ResultDirectory=windsim.SimulationResult, Mode=2, Run=button)

# ----
# 5. Post-processing
# 5.1. Paraview
# Multi-directional / annual wind vectors
# 5.2. Grasshopper
# Set to -1 for average of entire year (takes 30 s to compute)
dir = Slider(0, range=0..7)
button_2 = Button()
vectors = Data(probing.ProbingResult)
points = Data(probing.ProbingPoints)
paraview = Paraview(Result=windsim.SimulationResult)
choose_dir = TreeBranch(Tree=vectors, Path=dir, MaintainPaths=True)
wind_factors = WindFactors(Result=windsim.SimulationResult, ProbingPoints=points, WindVelocity=vectors, Run=Button(), Interpolation=True)  # -> WindFactorsSpatial, WindFactorsAnnual
cluster = Cluster(data=choose_dir)  # -> S, E, data_3
gradient = Gradient(
    LowerLimit=cluster.S,
    UpperLimit=cluster.E,
    Parameter=cluster.data_3,
    stops=[0.103: RGB(0, 0, 255), 0.22: RGB(0, 170, 255), 0.305: RGB(0, 255, 255), 0.398: RGB(0, 255, 188), 0.504: RGB(0, 255, 106), 0.605: RGB(91, 255, 0), 0.699: RGB(184, 255, 0), 0.799: RGB(255, 255, 0), 0.898: RGB(255, 170, 0)])
dedata = DeconstructDataObjects(Data=wind_factors.WindFactorsAnnual, Select=Slider(1, range=0..10))
flip = FlipMatrix(Data=dedata)
vdisex = VectorDisplayEx(Point=points, Vector=choose_dir, Colour=gradient, Width=Slider(3, range=0..10))
avr = Average(Input=flip)  # -> flatten(ArithmeticMean)
cluster_2 = Cluster(data=avr)  # -> S, E, data_3
cluster_3 = Cluster_3(C=points, T=Vector(0, 0, 10))
gradient_2 = Gradient(
    LowerLimit=cluster_2.S,
    UpperLimit=cluster_2.E,
    Parameter=cluster_2.data_3,
    stops=[0.103: RGB(0, 0, 255), 0.22: RGB(0, 170, 255), 0.305: RGB(0, 255, 255), 0.398: RGB(0, 255, 188), 0.504: RGB(0, 255, 106), 0.605: RGB(91, 255, 0), 0.699: RGB(184, 255, 0), 0.799: RGB(255, 255, 0), 0.898: RGB(255, 170, 0)])
preview = CustomPreview(Geometry=cluster_3, Material=gradient_2)

pedestrian_wind_comfort = PedestrianWindComfort(
    WindFactorsSpatial=wind_factors.WindFactorsSpatial,
    WindFactorsAnnual=wind_factors.WindFactorsAnnual,
    WindComfortMetric=4,
    Weibull_Fit=True)  # -> WindComfortRank, WindComfortClassLetter, WindComfortClass; disabled
cir = Circle(Plane=probing.ProbingPoints, Radius=1)  # disabled
srf = Surface(cir)  # disabled

# ----
# Wind Comfort Metrics
cluster_4 = Cluster(data=pedestrian_wind_comfort.WindComfortRank)  # -> S, E, data_3; disabled
gradient_3 = Gradient(
    LowerLimit=cluster_4.S,
    UpperLimit=cluster_4.E,
    Parameter=cluster_4.data_3,
    stops=[0.103: RGB(0, 0, 255), 0.22: RGB(0, 170, 255), 0.305: RGB(0, 255, 255), 0.398: RGB(0, 255, 188), 0.504: RGB(0, 255, 106), 0.605: RGB(91, 255, 0), 0.699: RGB(184, 255, 0), 0.799: RGB(255, 255, 0), 0.898: RGB(255, 170, 0)])  # disabled
tag = TextTag(Location=probing.ProbingPoints, Text=pedestrian_wind_comfort.WindComfortClassLetter)  # disabled
preview_2 = CustomPreview(Geometry=srf, Material=gradient_3)  # disabled

# ==== cluster Cluster
data = ClusterInput()
data_2 = Data(data)
data_3 = ClusterOutput(data_2)
bnd = Bounds(Numbers=data_2)
dedomain = DeconstructDomain(Domain=bnd)  # -> Start, End
S = ClusterOutput(dedomain.Start)
E = ClusterOutput(dedomain.End)

# ==== cluster Cluster_3
C = ClusterInput()
cluster = Cluster_2(C=C)
T = ClusterInput()
move = Move(Geometry=cluster, Motion=T)  # -> Geometry, Transform
srf = ClusterOutput(cluster)

# ==== cluster Cluster_2
C = ClusterInput()
circle = CircleCNR(Center=C, Normal=Vector(0, 0, 1), Radius=2)
srf = Surface(circle)
srf_2 = ClusterOutput(srf)
