# Grasshopper definition 99_ValidationCaseJiang2003.ghx (Grasshopper 1.0.8)
# plug-ins: Eddy3D

# ----
# Mesh
panel = Panel("0.01")
panel_2 = Panel("0.001")

# ----
# Wind tunnel data
# Jiang et al., 2003
# Uy/U_ref
# z/H
cluster = Cluster()
divide = DivideCurve(Curve=cluster, Count="50", Kinks=False)  # -> Points, Tangents, Parameters
panel_3 = Panel("""0.1015
0.1869
0.2631
0.329
0.3837
0.4262
0.4554
0.4722
0.4733
0.4509
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""")
panel_4 = Panel("""0.0408164
0.0816328
0.1224488
0.1632652
0.2040816
0.244898
0.2857144
0.3265308
0.3673468
0.408164
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""")
cluster_2 = Cluster_2(Y=panel_3, A=panel_4)

# ----
# Box-shaped simulation domain
panel_5 = Panel("0.005")
geo = Geometry(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)
button = Button()
button_2 = Button()
button_3 = Button()

abl = ABLFlow(WindDirections="180", ReferenceVelocity="12", ReferenceHeight="0.5", AerodynamicRoughnessLength=panel_5)
domcyl = CylindricalDomain(Buildings=geo, BoundaryCondition=abl, CellSize="0.25", RadialMultiplier=2, XDivisions=1)  # -> Domain, PreviewMesh
dombox = BoxDomain(Buildings=geo, BoundaryCondition=abl, CellSize=20)  # -> Domain, PreviewMesh
cellsz = MeshCellSize(Domain=dombox.Domain, BaseCellSize="0.25", TargetCellSize=panel)  # -> RefinementLevel, RefinementLevel1
mset = MeshSettings(
    BuildingMinLevel=cellsz.RefinementLevel,
    BuildingMaxLevel=cellsz.RefinementLevel,
    FeatureLevel=cellsz.RefinementLevel1,
    BoundingBoxLevel=cellsz.RefinementLevel,
    GroundLevel=2,
    BoundaryLayers=1,
    CellsBetweenLevels=Slider(3, range=0..10),
    MeshMode=4,
    Preset=1)
windsim = WindSimulation(
    WorkingDirectory="99_ValidationCaseJiang2003_Box",
    MeshSettings=mset,
    RunMeshing=button,
    MakeTrees=False,
    RunSimulation=button)  # -> SimulationResult, MeshDone, SimDone, MeshRemainingTime, SimulationRemainingTime
residuals = VisualizeResiduals(Result=windsim.SimulationResult, Plot=":", visResiduals=True)

clean = Clean(ResultDirectory=windsim.SimulationResult, Mode=2, Run=Button())
paraview = Paraview(Result=windsim.SimulationResult, Run=2)
visprobes = VisualizeProbes(
    Result=windsim.SimulationResult,
    ProbingPoints=divide.Points,
    NameOfInstance="Validation",
    InterpolationScheme=0,
    NameOfField=Button(),
    Run=False)  # -> ProbingPoints, ProbingResult
cluster_3 = Cluster_3(V_2=visprobes.ProbingPoints, V=visprobes.ProbingResult)  # -> Z, R
pt = ConstructPoint(XCoordinate=0, YCoordinate=cluster_3.R, ZCoordinate=cluster_3.Z)
graph = QuickGraph([pt, cluster_2], SortOrder=0)

# ----
# Cylindrical simulation domain
panel_6 = Panel("99_ValidationCaseJiang2003_Cyl")
button_4 = Button()
button_5 = Button()
button_6 = Button()

windsim_2 = WindSimulation(
    SimulationDomain=domcyl.Domain,
    WorkingDirectory="C:\Users\pkastner\Eddy",
    MeshSettings=mset,
    RunMeshing=button_4,
    MakeTrees=False,
    RunSimulation=button_4)  # -> SimulationResult, MeshDone, SimDone, MeshRemainingTime, SimulationRemainingTime
residuals_2 = VisualizeResiduals(Result=windsim_2.SimulationResult, Plot=":", visResiduals=True)
clean_2 = CleanDirectories(ResultDirectory=windsim_2.SimulationResult, Mode=0, Run=Button())

paraview_2 = Paraview(Result=windsim_2.SimulationResult, Run=2)
visprobes_2 = VisualizeProbes(
    Result=windsim_2.SimulationResult,
    ProbingPoints=divide.Points,
    NameOfInstance="Validation",
    InterpolationScheme=0,
    NameOfField=Button(),
    Run=False)  # -> ProbingPoints, ProbingResult
cluster_4 = Cluster_3(V_2=visprobes_2.ProbingPoints, V=visprobes_2.ProbingResult)  # -> Z, R
pt_2 = ConstructPoint(XCoordinate=0, YCoordinate=cluster_4.R, ZCoordinate=cluster_4.Z)
graph_2 = QuickGraph([pt_2, cluster_2], SortOrder=0)

# ==== cluster Cluster
pt = ConstructPoint(XCoordinate="0.125", YCoordinate="0.125", ZCoordinate="0.5")
pt_2 = ConstructPoint(XCoordinate="0.125", YCoordinate="0.125", ZCoordinate="0.01")
ln = Line(StartPoint=pt_2, EndPoint=pt)
L = ClusterOutput(ln)

# ==== cluster Cluster_2
Y = ClusterInput()
A = ClusterInput()
division = Division(A=A, B="4")
pt = ConstructPoint(XCoordinate="0.125", YCoordinate=Y, ZCoordinate=division)
pt_2 = ClusterOutput(pt)

# ==== cluster Cluster_3
V = ClusterInput()
V_2 = ClusterInput()
devec = DeconstructVector(Vector=V)  # -> XComponent, YComponent, ZComponent
devec_2 = DeconstructVector(Vector=V_2)  # -> XComponent, YComponent, ZComponent
division = Division(A=devec.YComponent, B="12")
Z = ClusterOutput(devec_2.ZComponent)
R = ClusterOutput(division)
