# Grasshopper definition FluidX3D.ghx (Grasshopper 1.0.8)
# plug-ins: Eddy3D

# ---- group: Input Geometry
brep = Brep([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])

# ----
abl = ABLFlow(ReferenceVelocity="5")
install = InstallEngines(InstallEnergyPlus=False, InstallRadiance=False, InstallBlueCFD=False, InstallFluidX3D=Button())
fxset = FluidX3DRunSettings(VRAMBudgetMB="256", SimulationTimeS="5000", ExportEveryS="10", GroundElevation=0)
panel = Panel(install)
dombox = BoxDomain(Buildings=brep, BoundaryCondition=abl, CellSize=20)  # -> Domain, PreviewMesh
custom_preview = CustomPreview(Geometry=brep, Material=ColourSwatch(SwatchColor=RGB(255, 255, 255)))
mbox = MeshBox(Base=dombox.PreviewMesh, XCount=10, YCount=10, ZCount=10)

# ---- group: Run the simulation
button = Button()

# ---- group: Probin plane
# Switch off and on
# "Update flow field"
# boolean toggle, afterwards.
list = ValueList({"Vertical Plane": 0, "Horizontal Plane": 1}, selected="Horizontal Plane")

# ----
sensor_spacing = Panel("4")
crv = Curve(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)
cluster = Cluster(factor="1.8", base=dombox.PreviewMesh)
debrep = DeconstructBrep(Brep=crv)  # -> Faces, Edges, Vertices
srf = Surface(crv)

# ---- group: Update flow field
boolean_toggle = BooleanToggle(True)

# ----
windsim = WindSimulation(
    SimulationDomain=dombox.Domain,
    WorkingDirectory="FluidX3D-Test_2",
    RunSettings=fxset,
    RunMeshing=False,
    MakeTrees=False,
    RunSimulation=button,
    SelectedEngine=2)  # -> SimulationResult, MeshDone, SimDone, MeshRemainingTime, SimulationRemainingTime
item = ListItem(List=debrep.Edges, Index=1, Wrap=True)
brep_to_grid_points = BrepToGridPoints(Geometry=cluster, Spacing=sensor_spacing, Run=True)  # -> Points, Status
item_2 = ListItem(List=debrep.Edges, Index=0, Wrap=True)
divlength = DivideLength(Curve=item, Length=Slider(10, range=0..10))  # -> Points, Tangents, Parameters
divlength_2 = DivideLength(Curve=item_2, Length=Slider(10, range=0..10))  # -> Points, Tangents, Parameters
lng = ListLength(List=divlength_2.Parameters)
lng_2 = ListLength(List=divlength.Parameters)
sdivide = DivideSurface(Surface=srf, UCount=lng, VCount=lng_2)  # -> flatten(Points), Normals, Parameters
entwine = Entwine(Branch00=sdivide.Points, Branch01=brep_to_grid_points.Points, FlattenInputs=True)  # -> simplify(Result)
branch = TreeBranch(Tree=entwine, Path=list, MaintainPaths=False)
fxprobe = FluidX3DProbeVTK(
    SimulationResult=windsim.SimulationResult,
    ProbePoints=branch,
    QField=0,
    TimeMode=2,
    TargetTimeS=0,
    TimeIntervalS=Slider(2000, range=0..10000),
    Run=boolean_toggle)  # -> ProbePoints, UByTime, RhoByTime, UAverage, RhoAverage, SampledTimes, SampledSteps, SampledFiles, OutsideCount

# ---- group: visualise vectors
tree_branch = TreeBranch(Tree=simplify(fxprobe.UByTime), Path="{1}", MaintainPaths=False)

# ----
bnd = Bounds(Numbers=tree_branch)
dedomain = DeconstructDomain(Domain=bnd)  # -> Start, End
amp = Amplitude(Vector=tree_branch, Amplitude=4)

# ---- group: visualise vectors (continued)
gradient = Gradient(
    LowerLimit=0,
    UpperLimit=dedomain.End,
    Parameter=fxprobe.UAverage,
    stops=[0.103: RGB(0, 0, 255), 0.22: RGB(0, 170, 255), 0.305: RGB(0, 255, 255), 0.398: RGB(0, 255, 188), 0.504: RGB(0, 255, 106), 0.605: RGB(91, 255, 0), 0.699: RGB(184, 255, 0), 0.799: RGB(255, 255, 0), 0.898: RGB(255, 170, 0)])
vdisex = VectorDisplayEx(Point=fxprobe.ProbePoints, Vector=amp, Colour=gradient, Width=Slider(2, range=0..10))

# ==== cluster Cluster
base = ClusterInput()
mesh_box = MeshBox(Base=base, XCount=1, YCount=1, ZCount=1)
deconstruct_mesh = DeconstructMesh(Mesh=mesh_box)  # -> Vertices, Faces, Colours, Normals
panel = Panel("""0
1
2
3""")
list_item = ListItem(List=deconstruct_mesh.Vertices, Index=panel, Wrap=True)
factor = ClusterInput()
unit_z = UnitZ(Factor=factor)
surface_from_points = SurfaceFromPoints(Points=list_item, UCount=2, Interpolate=True)
move = Move(Geometry=surface_from_points, Motion=unit_z)  # -> Geometry, Transform
geometry = ClusterOutput(move.Geometry)
