# Grasshopper definition FluidX3D_animated.ghx (Grasshopper 1.0.8)
# plug-ins: Eddy3D

# ---- group: Input Geometry
brep = Brep([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])

# ----
abl = ABLFlow(ReferenceVelocity="5")
fxset = FluidX3DRunSettings(VRAMBudgetMB="256", SimulationTimeS="5000", ExportEveryS="10", GroundElevation=0)
dombox = BoxDomain(Buildings=brep, BoundaryCondition=abl, CellSize=20)  # -> Domain, PreviewMesh
install = InstallEngines(InstallEnergyPlus=False, InstallRadiance=False, InstallBlueCFD=False, InstallFluidX3D=Button())
custom_preview = CustomPreview(Geometry=brep, Material=ColourSwatch(SwatchColor=RGB(255, 255, 255)))
panel = Panel(install)

# ---- group: Run the simulation
button = Button()

# ---- group: Animation
trigger = Trigger(Interval=200, TimerInterval=200, Target=[boolean_toggle, reset_it_before_animating])  # disabled

# ----
sensor_spacing = Panel("4")
cluster = Cluster(factor="1.8", base=dombox.PreviewMesh)
reset_it_before_animating = DataRecorder("10", DataLimit=-10, RecordData=True)
boolean_toggle = BooleanToggle(True)
windsim = WindSimulation(
    SimulationDomain=dombox.Domain,
    WorkingDirectory="FluidX3D-Test",
    RunSettings=fxset,
    RunMeshing=False,
    MakeTrees=False,
    RunSimulation=button,
    SelectedEngine=2)  # -> SimulationResult, MeshDone, SimDone, MeshRemainingTime, SimulationRemainingTime
brep_to_grid_points = BrepToGridPoints(Geometry=cluster, Spacing=sensor_spacing, Run=True)  # -> Points, Status
mass_addition = MassAddition(Input=reset_it_before_animating)  # -> Result, PartialResults
panel_2 = Panel(mass_addition.Result)
fxprobe = FluidX3DProbeVTK(
    SimulationResult=windsim.SimulationResult,
    ProbePoints=brep_to_grid_points.Points,
    QField=0,
    TimeMode=2,
    TargetTimeS=0,
    TimeIntervalS=panel_2,
    Run=boolean_toggle)  # -> ProbePoints, UByTime, RhoByTime, UAverage, RhoAverage, SampledTimes, SampledSteps, SampledFiles, OutsideCount

# ---- group: Timestep Text
concatenate = Concatenate(FragmentA="Timestep=", FragmentB=panel_2)
text_tag_3d = TextTag3D(
    Location=PlaneXY(177.7871212, -69.43469102, 2.975514223),
    Text=concatenate,
    Size=Slider(7, range=0..10),
    Colour=ColourSwatch(SwatchColor=RGB(31, 31, 31)),
    Justification=7)

# ---- group: visualise vectors
gradient = Gradient(
    LowerLimit=0,
    UpperLimit="5",
    Parameter=fxprobe.UAverage,
    stops=[0.103: RGB(0, 0, 255), 0.22: RGB(0, 170, 255), 0.305: RGB(0, 255, 255), 0.398: RGB(0, 255, 188), 0.504: RGB(0, 255, 106), 0.605: RGB(91, 255, 0), 0.699: RGB(184, 255, 0), 0.799: RGB(255, 255, 0), 0.898: RGB(255, 170, 0)])
tree_branch = TreeBranch(Tree=simplify(fxprobe.UByTime), Path="{1}", MaintainPaths=True)
vdisex = VectorDisplayEx(Point=fxprobe.ProbePoints, Vector=tree_branch, Colour=gradient, Width=Slider(3, range=0..10))

# ==== cluster Cluster
base = ClusterInput()
mesh_box = MeshBox(Base=base, XCount=1, YCount=1, ZCount=1)
deconstruct_mesh = DeconstructMesh(Mesh=mesh_box)  # -> Vertices, Faces, Colours, Normals
panel = Panel("""0
1
2
3""")
list_item = ListItem(List=deconstruct_mesh.Vertices, Index=panel, Wrap=True)
factor = ClusterInput()
unit_z = UnitZ(Factor=factor)
surface_from_points = SurfaceFromPoints(Points=list_item, UCount=2, Interpolate=True)
move = Move(Geometry=surface_from_points, Motion=unit_z)  # -> Geometry, Transform
geometry = ClusterOutput(move.Geometry)
