# Grasshopper definition FluidX3D.ghx (Grasshopper 1.0.8)
# plug-ins: Eddy3D-LBM, Outdoor, Eddy3D-FluidX3D

boolean_toggle = BooleanToggle(True)
# Description: Purpose: Wind around buildings on the GPU, watched live in the viewport.
# Fidelity: Engineering - transient lattice-Boltzmann CFD, not validated for this site; FluidX3D's licence excludes commercial use.
# Method: LBM Case with FluidX3D Run Settings: 2 m grid, 720 s simulated, ABL inflow of 5 m/s at 10 m.
# Result: FluidX3D Live View colours a probe mesh while it runs; Scalar and Vector Field Viewers show probed values.
# Needs: Eddy3D Setup > LBM CFD (FluidX3D), built locally; needs a GPU. Runtime: minutes.
# Edit: Geometry, grid spacing, simulated time, inflow.
site_picker = SitePicker(SitePickerLat=47.37307, SitePickerLon=8.545647)  # -> Latitude, Longitude, Address
lidar_site = LiDARSite(
    Latitude=site_picker.Latitude,
    Longitude=site_picker.Longitude,
    Size="200",
    TerrainSize="400",
    Source="Auto",
    Roads=False,
    Run=boolean_toggle,
    LidarSiteInputLayoutVersion=4,
    LidarSiteOutputLayoutVersion=2)  # -> PointCloud, Footprints, RoofHints, Domain, Trees, TreeCrowns, LayerOutlines, LayerNames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
atmospheric_boundary_layer = AtmosphericBoundaryLayer(
    ReferenceHeight=10,
    RoughnessLengthZ0=1,
    GroundHeight=0,
    TurbulentKEK=0.015,
    TurbulentEpsilonΕ=0.135,
    TurbulentOmegaΩ=100,
    TerrainType="Custom (z0 input)",
    InletProfile="Log law (Richards & Hoxey)",
    DisplacementHeight=0,
    AblOutputLayoutVersion=2)  # -> BoundaryConditions, WindVectors
fluidx3d_run_settings = FluidX3DRunSettings(
    Memory=0,
    SimTime="720",
    ExportInterval=10,
    GroundZ=0,
    Interactive=False,
    GridSpacing="2",
    Live=False,
    LiveHeight=6,
    SyntheticTurbulence=True,
    Warmup=0,
    Averaging=0,
    IntegralLength=0,
    Settle=True,
    OpenFaces=True,
    FluidX3DRunSettingsInputLayoutVersion=2)
city_surface = CitySurface(
    PointCloud=lidar_site.PointCloud,
    Footprints=lidar_site.Footprints,
    Domain=lidar_site.Domain,
    LayerOutlines=lidar_site.LayerOutlines,
    LayerNames=lidar_site.LayerNames,
    LayerRoughness=lidar_site.LayerRoughness,
    Flatten=lidar_site.Flatten,
    RoofHints=lidar_site.RoofHints,
    LoD="LoD 1.2",
    Engine="Auto",
    CloudOffset=Vector(0, 0, 0),
    LayerPercentile=0.5,
    RoofPercentile=0.9,
    GroundSpacing=1,
    Smoothing=2,
    Buffer=0,
    RoofFit="Auto",
    FlatTerrain=True,
    Run=boolean_toggle,
    CitySurfaceInputLayoutVersion=10,
    ClayLook=True)  # -> Terrain, Buildings, Layers, LayerNames, Surface, RoofHeights, Report, LayerRoughness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
bounding_box = BoundingBox(Content=city_surface.Surface, Plane=PlaneXY(0, 0, 0), UnionBox=True)  # -> Box, Box_2
panel = Panel(fluidx3d_run_settings)
lbm_case = LBMCase(
    CaseName="Case",
    ABL=atmospheric_boundary_layer.BoundaryConditions,
    Domain=bounding_box.Box,
    Buildings=city_surface.Buildings,
    Terrain=city_surface.Terrain,
    Engine="Auto",
    Settings=fluidx3d_run_settings,
    Write=Button(),
    Clear=False,
    AutoName="nimble-gecko-grove-mirror",
    LbmCaseInputLayoutVersion=3)  # -> Logs, Case, Domain, Folder
unit_z = UnitZ(Factor="20")
unit_z_2 = UnitZ(Factor=1)
move = Move(Geometry=bounding_box.Box, Motion=unit_z)  # -> Geometry, Transform
lbm_run = LBMRun(Case=lbm_case.Case, Run=Button(), LbmInputLayoutVersion=7, LbmShowSolverWindow2=True)  # -> Logs, Case, Domain, Folder, Progress, Done, Remaining, SimulatedTime, MaxSpeed
quad_remesh_settings = QuadRemeshSettings(
    TargetCount=Slider(10000, range=0..10000),
    AdaptiveSize=0,
    AdaptiveCount=False,
    HardEdges=False,
    SeamEdges=0,
    Symmetry=0,
    GuideCurves=0)
deconstruct_brep = DeconstructBrep(Brep=lbm_run.Domain)  # -> Faces, Edges, Vertices
list_item = ListItem(List=deconstruct_brep.Faces, Index=Slider(4, range=0..10), Wrap=True)
move_2 = Move(Geometry=list_item, Motion=unit_z_2)  # -> Geometry, Transform
quad_remesh = QuadRemesh(Geometry=move_2.Geometry, Settings=quad_remesh_settings)
deconstruct_mesh = DeconstructMesh(Mesh=quad_remesh)  # -> Vertices, Faces, Colours, Normals
fluidx3d_live_view = FluidX3DLiveView(
    Case=lbm_run.Case,
    Mesh=quad_remesh,
    Live=True,
    MaxSpeed=0,
    AvgWindow=360,
    Source="VTK frames",
    Buildings=city_surface.Buildings,
    Appearance="Velocity + LIC",
    MaxSpeedup=1.5,
    Video=False)  # -> Mesh, Speeds, Time, Status, Histogram
probe = Probe(
    Case=lbm_run.Case,
    Points=deconstruct_mesh.Vertices,
    Field="U",
    Time="latestTime",
    Run=False,
    BakeTimeHistory=False,
    CullHugeVectors=True,
    CullInvalid=True,
    ShowCulled=False,
    ShowRegion=False)  # -> Values, TimeSteps, SubResults, Points
scalar_field_viewer = ScalarFieldViewer(
    Values=probe.Values,
    Points=deconstruct_mesh.Vertices,
    DisplayMode="Heatmap Mesh",
    ColorMap="Viridis",
    Mesh=quad_remesh,
    Size=4,
    Fit="Gapless",
    ScalarFieldViewerInputLayoutVersion=2)  # -> Geometry, Colors, Range
vector_field_viewer = VectorFieldViewer(
    Velocity=probe.Values,
    Points=deconstruct_mesh.Vertices,
    DisplayMode="Vector Field",
    ColorMap="Viridis",
    Scale=1,
    VectorPlane="3D",
    ArrowheadScaling="Fixed",
    SeedCount=120,
    VectorFieldViewerInputLayoutVersion=2)  # -> Geometry, Colors, Range
