# Grasshopper definition LiveTunnel2D.ghx (Grasshopper 1.0.8)
# plug-ins: Eddy3D-LBM, Outdoor

site_picker = SitePicker(
    SitePickerAddress="Sihlbrücke, Langstrasse, Kreis 4, Zurich, District Zurich, Zurich, 8004, Switzerland",
    SitePickerLat=47.373525,
    SitePickerLon=8.532252)  # -> Latitude, Longitude, Address
boolean_toggle = BooleanToggle(True)
lidar_site = LiDARSite(
    Latitude=site_picker.Latitude,
    Longitude=site_picker.Longitude,
    Size="100",
    Source="Auto",
    Roads=True,
    Run=boolean_toggle,
    LidarSiteInputLayoutVersion=4,
    LidarSiteOutputLayoutVersion=2)  # -> PointCloud, Footprints, RoofHints, Domain, Trees, TreeCrowns, LayerOutlines, LayerNames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
geometry = Geometry(lidar_site.Footprints)
city_surface = CitySurface(
    PointCloud=lidar_site.PointCloud,
    Footprints=lidar_site.Footprints,
    Domain=lidar_site.Domain,
    LayerOutlines=lidar_site.LayerOutlines,
    LayerNames=lidar_site.LayerNames,
    LayerRoughness=lidar_site.LayerRoughness,
    Flatten=lidar_site.Flatten,
    RoofHints=lidar_site.RoofHints,
    LoD="LoD 1.3",
    Engine="GPU",
    CloudOffset=Vector(0, 0, 0),
    LayerPercentile=0.5,
    RoofPercentile=0.9,
    GroundSpacing="5",
    Smoothing=2,
    Buffer=0,
    Run=boolean_toggle,
    CitySurfaceInputLayoutVersion=10,
    ClayLook=True)  # -> Terrain, Buildings, Layers, LayerNames, Surface, RoofHeights, Report, LayerRoughness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
bounding_box = BoundingBox(Content=city_surface.Surface, Plane=PlaneXY(0, 0, 0), UnionBox=True)  # -> Box, Box_2
live_wind_tunnel = LiveWindTunnel(
    Context=city_surface.Terrain,
    Buildings=city_surface.Buildings,
    WindSpeed=2,
    WindDirection=Vector(1, 0, 0),
    CellSize=0,
    CutHeight=Slider(10, range=0..10),
    View="LIC",
    Live=True,
    Average=0,
    Engine="Auto",
    Mean=True,
    Forces=False,
    Tunnel=bounding_box.Box)  # -> Field, Speed, Pressure, Vorticity, Force, Cd, Status
