# Grasshopper definition OpenLB.ghx (Grasshopper 1.0.8)
# plug-ins: Eddy3D-LBM, Outdoor

# Description: Purpose: Time-averaged pedestrian wind around buildings from lattice-Boltzmann LES.
# Fidelity: Engineering - OpenLB D3Q19 with Smagorinsky LES, not validated for this site.
# Method: LBM Case with LBM Run Settings: 6 m grid, GPU on, inflow jitter on; runtime tries Podman, then Docker, then native.
# Result: The time-averaged pedestrian-level wind field in a Vector Field Viewer beside the domain wireframe.
# Needs: Eddy3D Setup > LBM CFD (OpenLB); the GPU build needs NVIDIA. Runtime: minutes to hours.
# Edit: Geometry; Grid Spacing (halving it costs 8x the memory and about 16x the time).
site_picker = SitePicker(SitePickerAddress="Munich, Bavaria, Germany", SitePickerLat=48.137108, SitePickerLon=11.575382)  # -> Latitude, Longitude, Address
size = ValueList({"Small": 200, "Medium": 400, "Large": 800, "Huge": 1600}, selected="Medium")
size_2 = ValueList({"Small": 200, "Medium": 400, "Large": 800, "Huge": 1600}, selected="Small")
size_3 = ValueList({"Small": 200, "Medium": 400, "Large": 800, "Huge": 1600}, selected="Large")
boolean_toggle = BooleanToggle(True)
lidar_site = LiDARSite(
    Latitude=site_picker.Latitude,
    Longitude=site_picker.Longitude,
    Size=size_2,
    TerrainSize=size,
    Source="Bavaria (Germany)",
    Roads=False,
    RingSize=size_3,
    Run=boolean_toggle,
    LidarSiteInputLayoutVersion=4,
    LidarSiteOutputLayoutVersion=2)  # -> PointCloud, Footprints, RoofHints, Domain, Trees, TreeCrowns, LayerOutlines, LayerNames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
city_surface = CitySurface(
    PointCloud=lidar_site.PointCloud,
    Footprints=lidar_site.Footprints,
    Domain=lidar_site.Domain,
    LayerNames="Layer",
    Flatten=False,
    LoD="LoD 1.3",
    Engine="Auto",
    CloudOffset=Vector(0, 0, 0),
    LayerPercentile=0.5,
    RoofPercentile=0.9,
    GroundSpacing=1,
    Smoothing=2,
    Buffer=0,
    RoofFit="Auto",
    FlatTerrain=True,
    Run=boolean_toggle,
    CitySurfaceInputLayoutVersion=10,
    ClayLook=True)  # -> Terrain, Buildings, Layers, LayerNames, Surface, RoofHeights, Report, LayerRoughness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
atmospheric_boundary_layer = AtmosphericBoundaryLayer(
    ReferenceHeight=10,
    RoughnessLengthZ0=1,
    GroundHeight=0,
    TurbulentKEK=0.015,
    TurbulentEpsilonΕ=0.135,
    TurbulentOmegaΩ=100,
    TerrainType="Custom (z0 input)",
    InletProfile="Log law (Richards & Hoxey)",
    DisplacementHeight=0,
    AblOutputLayoutVersion=2)  # -> BoundaryConditions, WindVectors
lbm_run_settings = LBMRunSettings(
    GridSpacing="8",
    Warmup=60,
    Averaging="30",
    ProbeHeight=1.5,
    ProbeSpacing="8",
    GPU=True,
    Runtime="Auto",
    Jitter=True,
    JitterAmplitude=5,
    VegetationDrag=0.25,
    PerturbedInflow=False,
    Ensemble=5,
    VegetationDensity="Custom (Vegetation Drag input)",
    Ground="None (bounce-back)",
    DisplacementHeight=0,
    OutletSponge=0,
    SyntheticTurbulence=True,
    Settle=0,
    GroundHeatFlux=0,
    BuildingHeatFlux=0,
    AirTemperature=20,
    Refine=False,
    IntegralLength=0,
    InstantSnapshots=False)
geometry = Geometry(city_surface.Buildings)
cluster = Cluster(content=geometry)
lbm_case = LBMCase(
    CaseName="Case",
    ABL=atmospheric_boundary_layer.BoundaryConditions,
    Domain=cluster,
    Buildings=city_surface.Buildings,
    Terrain=city_surface.Terrain,
    Engine="Auto",
    Settings=lbm_run_settings,
    Write=Button(),
    Clear=False,
    AutoName="polite-narwhal-plateau-feather",
    LbmCaseInputLayoutVersion=3)  # -> Logs, Case, Domain, Folder
lbm_run = LBMRun(Case=lbm_case.Case, Run=Button(), LbmInputLayoutVersion=7, LbmShowSolverWindow2=True)  # -> Logs, Case, Domain, Folder, Progress, Done, Remaining, SimulatedTime, MaxSpeed
panel = Panel([lbm_run.Progress, lbm_run.Remaining])
panel_2 = Panel(lbm_run.Logs)
lbm_field = LBMField(Case=lbm_run.Case, Refresh=Button())  # -> Points, Velocity, Speed, Status, Spread, Species, Concentration, TemperatureRise
vector_field_viewer = VectorFieldViewer(
    Velocity=lbm_field.Velocity,
    Points=lbm_field.Points,
    DisplayMode="LIC",
    ColorMap="Turbo",
    Scale=1,
    VectorPlane="3D",
    ArrowheadScaling="Fixed",
    SeedCount=120,
    VectorFieldViewerInputLayoutVersion=2)  # -> Geometry, Colors, Range

# ==== cluster Cluster
content = ClusterInput()
bounding_box = BoundingBox(Content=content, Plane=PlaneXY(0, 0, 0), UnionBox=True)  # -> Box, Box_2
deconstruct_brep = DeconstructBrep(Brep=bounding_box.Box)  # -> Faces, Edges, Vertices
list_item = ListItem(List=deconstruct_brep.Faces, Index=Slider(4, range=0..10), Wrap=True)
area = Area(Geometry=list_item)  # -> Area, Centroid
scale = Scale(Geometry=bounding_box.Box, Center=area.Centroid, Factor="2")  # -> Geometry, Transform
geometry = ClusterOutput(scale.Geometry)
