# Grasshopper definition ML_basic.ghx (Grasshopper 1.0.8)
# plug-ins: Outdoor

panel = Panel("""0
45
90
135
180
225
270
315""")

# ----
# Building Geometry &
# Boundary Conditions
panel_2 = Panel("5")
abl = ABL(
    WindDirections=panel,
    ReferenceVelocity=panel_2,
    ReferenceHeight="10",
    AerodynamicRoughnessLength=1,
    GroundLevel=0,
    TurbulentEpsilonΕ=0.135,
    TurbulentOmegaΩ=100)  # -> BoundaryCondition, WindVectors

# ---- group: BUILDINGS
# Prepare Geometry
# the buildings should
#    consist of Breps!
# Step 1
buildings = Geometry([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])

# ---- group: TERRAIN
srf = Surface(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)

# ----
# Computational Domain
# Step 2
# Prepare Terrain
# the radius should be
# more than 500 meters!
pedestrian_level = Panel("1.8")
Z = UnitZ(Factor=pedestrian_level)
move = Move(Geometry=srf, Motion=Z)  # -> Geometry, Transform

cyldomain = CylinderDomain(
    CoreCellSize="10",
    InnerCoreSize=-1,
    OuterRadius=-1,
    Height=-1,
    RadialMultiplier=2,
    CoreDivisions=1,
    RefinementBoxExtension=-1,
    RadialGrading=7,
    CoreRoundness=0.65,
    VerticalGrading=35)

# ----
# Create Case Folder
panel_3 = Panel("C:\Eddy3D-Cases\")
button = Button()
rset = RunSettings(
    Iterations="600",
    WriteInterval="600",
    TimestepsToKeep=3,
    TurbulenceModel="realizableKE",
    RelaxationFactors=0,
    NumericalSchemes="SIMPLE",
    PotentialFlowInit=False,
    AgeOfAir="4",
    CPUCores="24",
    BlueCFDFolder=0,
    DebugDiagnostics=False,
    SIMPLEC=False,
    Convergence=0.0001,
    AutoStopOnPlateau=False)  # -> RunSettings, DebugLogs
concat = Concatenate(A=panel_3, subfolder="ML_Basic_Test_0")

button_2 = Button()
mesh_settings = MeshSettings(
    BuildingMinLevel="2",
    BuildingMaxLevel="4",
    FeatureLevel=2,
    BoundingBoxLevel=0,
    GroundLevel="2",
    MeshMode="5",
    AdaptiveGrading=True)
outcase = OutdoorCase(
    WorkingDirectory=concat,
    BoundaryConditions=abl.BoundaryCondition,
    DomainParameters=cyldomain,
    Buildings=buildings,
    Terrain=srf,
    MeshSettings=mesh_settings,
    RunSettings=rset.RunSettings,
    Write=False,
    ClearCase=False,
    AutoName="gentle-marmot-wharf-satchel",
    PreviewBuildings=False,
    PreviewDimensions=True,
    PreviewGrid3D=False,
    PreviewGroundGrid=True,
    PreviewRefinementBox=True,
    PreviewWindArrows=True)  # -> Logs, WriteLogs, Case, Domain, RefinementBox, Buildings

# ----
# write dataset to file!
boolean_toggle = BooleanToggle(True)

# ----
# Step 3
panel_4 = Panel("2")

# ----
# Probing
brep2grid = BrepToGridPoints(Geometry=move.Geometry, Spacing=panel_4)  # -> Points, Status

# ----
# Dataset Preparation
datacurator = DatasetCurator(
    Points=brep2grid.Points,
    Buildings=buildings,
    Case_dir=concat,
    U_ref=panel_2,
    Z_ref="10",
    Pedestrian_level=pedestrian_level,
    Wind_dir=panel,
    Run=boolean_toggle)  # -> SDF, Bldg_height, Z_relative, U_over_Uref, X_coords, Y_coords, Dir_sin, Dir_cos, CSV_Path
panel_5 = Panel(datacurator.CSV_Path)

probe = Probe(
    Case=outcase.Case,
    Points=brep2grid.Points,
    Field="U",
    ProbeName="ttt",
    Run=False,
    BakeTimeHistory=False,
    CullHugeVectors=True,
    CullInvalid=True,
    ShowRegion=False)  # -> Values, TimeSteps, SubResults

# ----
# Read Dataset with Results
wind_direction_angle = ValueList({"0", "45", "90", "135", "180", "225", "270", "315"}, selected="0")

concatenate = Concatenate(Fragment_A=concat, Fragment_B="\Dataset\", A="ML_Basic_Test_0", B="_", C=wind_direction_angle, D=".csv")

dataset_reader = DatasetReader(CSVPath=concatenate, Run=Toggle(False))  # -> SDF, Bldg_height, Z_relative, U_over_Uref, Mag_U, X, Y, Dir_sin, Dir_cos, Brep
gradient = Gradient(
    LowerLimit=0,
    UpperLimit=1,
    Parameter=dataset_reader.Mag_U,
    stops=[0: RGB(48, 18, 59), 0.0294: RGB(56, 40, 112), 0.0588: RGB(63, 62, 156), 0.0882: RGB(68, 82, 193), 0.118: RGB(70, 102, 221), 0.147: RGB(71, 122, 241)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])
construct_point = ConstructPoint(XCoordinate=dataset_reader.X, YCoordinate=dataset_reader.Y, ZCoordinate=dataset_reader.Z_relative)
custom_preview = CustomPreview(Geometry=construct_point, Material=gradient)
