# Grasshopper definition MRT_Mixed.ghx (Grasshopper 1.0.8)
# plug-ins: Outdoor, Eddy3D-Radiance

number_slider = Slider(2, range=0..10)
# Description: Annual mean radiant temperature at ground and building sensors, from the staged pipeline on the fast path, with surfaces at air temperature and no Radiance or EnergyPlus. Two MRT Surface components tag the ground and 22 context Breps. Two Brep Grid Points at 2 m feed two MRT Sensors, ground probes lifted 1.1 m, building probes offset 0.5 m along their normals, both wired into MRT View Factors. MRT Solve reads Atlanta weather from Download Weather. Deconstruct MRT supplies a colored mesh and Text Tag values; Fisheye View draws one sensor's dome. Two Buttons start the run; replace both Breps.
geo = Geometry(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)
context = Brep([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])

hoy = HourOfYear(
    StartMonth=Slider(1, range=1..12),
    StartDay=Slider(1, range=1..30),
    StartHour=Slider(0, range=0..23),
    EndMonth=Slider(12, range=1..12),
    EndDay=Slider(31, range=1..31),
    EndHour=Slider(23, range=0..23))  # -> HoursOfYear, DateTimes
calendar = Calendar(Day=24, Hour=15, Month=7)

preview = CustomPreview(Geometry=context, Material=ColourSwatch(SwatchColor=RGB(255, 255, 255)))
brepgrid = BrepGridPoints(Geometry=geo, Spacing=number_slider)  # -> Points, Vectors, Mesh, Status
brepgrid_2 = BrepGridPoints(Geometry=context, Spacing=number_slider)  # -> Points, Vectors, Mesh, Status

# ---- group: Weather File
panel = Panel("https://energyplus-weather.s3.amazonaws.com/north_and_central_america_wmo_region_4/USA/GA/USA_GA_Atlanta-Hartsfield-Jackson.Intl.AP.722190_TMY3/USA_GA_Atlanta-Hartsfield-Jackson.Intl.AP.722190_TMY3.epw")

# ----
mrt_surface = MRTSurface(Geometry=geo, Simulated=True, PatchSize=3, LegacyOpaqueTrees=True)  # -> Surface, Mesh
mrt_surface_2 = MRTSurface(Geometry=context, Simulated=True, PatchSize=3, LegacyOpaqueTrees=True)  # -> Surface, Mesh
mrt_sensors = MRTSensors(Sensors=brepgrid.Points, Normal=brepgrid.Vectors, Height=1.1)  # -> Sensors, Points
mrt_sensors_2 = MRTSensors(Sensors=brepgrid_2.Points, Normal=brepgrid_2.Vectors, Height=0.5)  # -> Sensors, Points
panel_2 = Panel("Istanbul")
merge = Merge(Data1=mrt_sensors.Sensors, Data2=mrt_sensors_2.Sensors)
mrt_view_factors = MRTViewFactors(
    Surfaces=[mrt_surface_2.Surface, mrt_surface.Surface],
    Sensors=[mrt_sensors.Sensors, mrt_sensors_2.Sensors],
    SkyDomeSubdivisions="3 — 192 sky patches",
    Fidelity="Fast",
    Run=Button())  # -> VFModel, SkyDome, Log
download_weather = DownloadWeather(Station=panel)  # -> EPWFile, Logs, Stations, Station, ExtraFiles, SiteLatitude, SiteLongitude
mrt_solve = MRTSolve(VFModel=mrt_view_factors.VFModel, EPW=download_weather.EPWFile, Engine="Native", Run=Button())  # -> Probes, Result, Log
panel_3 = Panel(mrt_view_factors.Log)
fisheye_view = FisheyeView(
    VFModel=mrt_view_factors.VFModel,
    Sensor=Slider(7583, range=0..10000),
    Radius=Slider(12, range=0..100),
    Rings="48",
    Display="Dome")  # -> Fisheye, SVF
geometry = Geometry(fisheye_view.Fisheye)
deconstruct_mrt = DeconstructMRT(Result=mrt_solve.Result, Statistic="Mean", Radius=0.7, DeMrtOutputLayoutVersion=2)  # -> Mean, Min, Max, MRT, Mesh
panel_4 = Panel(mrt_solve.Log)
mesh = Mesh(deconstruct_mrt.Mesh)

# ---- group: Mean
bnd = Bounds(Numbers=deconstruct_mrt.Mean)
round = Round(Number=deconstruct_mrt.Mean)  # -> Nearest, Floor, Ceiling
dedomain = DeconstructDomain(Domain=bnd)  # -> Start, End
gradient = Gradient(
    LowerLimit=dedomain.Start,
    UpperLimit=dedomain.End,
    Parameter=deconstruct_mrt.Mean,
    stops=[0: RGB(48, 18, 59), 0.0294: RGB(56, 40, 112), 0.0588: RGB(63, 62, 156), 0.0882: RGB(68, 82, 193), 0.118: RGB(70, 102, 221), 0.147: RGB(71, 122, 241)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])
tag = TextTag(Location=brepgrid.Points, Text=round.Nearest, Colour=ColourSwatch(SwatchColor=RGB(255, 255, 255)))
