# Grasshopper definition MRT_Radiance.ghx (Grasshopper 1.0.8)
# plug-ins: Outdoor, Eddy3D, Eddy3D-Radiance

# Description: One MRT component runs the high-fidelity chain, Radiance shortwave with interreflection plus EnergyPlus surface temperatures for the longwave exchange. A script downloads an Istanbul IWEC weather file into the Eddy3D Cases folder. Brep Grid Points meshes the ground and ten context Breps at 2 m spacing, MRT Sensors makes a probe per mesh face, and MRT Surface tags the ground. MRT Settings uses Standard quality with Auto parallelism across cores. Deconstruct MRT returns the annual mean per probe for Gradient and Text Tag display. Install Engines installs Radiance and EnergyPlus; Run ships off. Replace the Breps and the EPW URL.
context = Brep([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])

# ---- group: Ground Surface
brep = Brep(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)

# ----
preview = CustomPreview(Geometry=context, Material=ColourSwatch(SwatchColor=RGB(255, 255, 255)))
data = Data([context, brep])

panel = Panel("https://energyplus-weather.s3.amazonaws.com/europe_wmo_region_6/TUR/TUR_Istanbul.170600_IWEC/TUR_Istanbul.170600_IWEC.epw")
py3 = Python3Script()  # -> Directory
# ---------- py3: Python ----------
import os

# Gets the current user's home directory on both Windows and macOS
home_dir = os.path.expanduser("~")

# Concatenate with Eddy3d-cases
eddy_cases_dir = os.path.join(home_dir, "Eddy3D","Cases")

# Outputs
Directory = eddy_cases_dir
# ---------- end py3 ----------
c_script = CSharpScript(url=panel, saveTo=py3)  # -> out, epwPath; inputs url: String, saveTo: String
# ---------- c_script: C# ----------
// Grasshopper Script Instance
#region Usings
using System;
using System.Linq;
using System.Collections;
using System.Collections.Generic;
using System.Drawing;
using System.IO;
using System.Net.Http;
using System.Threading.Tasks;

using Rhino;
using Rhino.Geometry;

using Grasshopper;
using Grasshopper.Kernel;
using Grasshopper.Kernel.Data;
using Grasshopper.Kernel.Types;
#endregion

public class Script_Instance : GH_ScriptInstance
{
private void RunScript(string url, string saveTo, ref object epwPath)
{
  epwPath = null;

  try
  {
    // --- Validate URL ---
    if (string.IsNullOrWhiteSpace(url))
    {
      Print("URL is invalid.");
      return;
    }

    string urlFileName;
    try { urlFileName = System.IO.Path.GetFileName(new Uri(url).LocalPath); }
    catch { Print("URL is invalid."); return; }
    if (string.IsNullOrWhiteSpace(urlFileName)) urlFileName = "download.epw";

    // --- Decide destination path ---
    string filePath;

    if (string.IsNullOrWhiteSpace(saveTo))
    {
      // Use GH file's directory
      var ghDoc  = GrasshopperDocument; // <-- use this in C# Script
      var ghPath = ghDoc?.FilePath;

      if (string.IsNullOrEmpty(ghPath))
      {
        // fallback to Rhino document folder if available
        var rhPath = Rhino.RhinoDoc.ActiveDoc?.Path;
        var rhDir  = string.IsNullOrEmpty(rhPath) ? null : System.IO.Path.GetDirectoryName(rhPath);
        if (string.IsNullOrEmpty(rhDir))
        {
          Print("Grasshopper file is unsaved. Please save the .gh file or provide a destination path.");
          return;
        }
        Print("Grasshopper file is unsaved; saving to the Rhino document folder.");
        filePath = System.IO.Path.Combine(rhDir, urlFileName);
      }
      else
      {
        var ghDir = System.IO.Path.GetDirectoryName(ghPath);
        filePath  = System.IO.Path.Combine(ghDir, urlFileName);
      }
    }
    else
    {
      // Accept either a folder or a full file path
      string raw = saveTo.Trim().Trim('"');
      raw = Environment.ExpandEnvironmentVariables(raw);

      var ghDoc  = GrasshopperDocument; // <-- use this here too
      var ghPath = ghDoc?.FilePath;
      string baseRoot = !string.IsNullOrEmpty(ghPath)
        ? System.IO.Path.GetDirectoryName(ghPath)
        : System.IO.Directory.GetCurrentDirectory();

      string candidate = raw;
      if (!System.IO.Path.IsPathRooted(candidate))
        candidate = System.IO.Path.GetFullPath(System.IO.Path.Combine(baseRoot, candidate));

      bool endsWithSlash =
        candidate.EndsWith(System.IO.Path.DirectorySeparatorChar.ToString()) ||
        candidate.EndsWith(System.IO.Path.AltDirectorySeparatorChar.ToString());

      bool treatAsFolder = endsWithSlash || System.IO.Directory.Exists(candidate) || !System.IO.Path.HasExtension(candidate);

      if (treatAsFolder)
      {
        System.IO.Directory.CreateDirectory(candidate);
        filePath = System.IO.Path.Combine(candidate, urlFileName);
      }
      else
      {
        string dir = System.IO.Path.GetDirectoryName(candidate);
        if (!string.IsNullOrEmpty(dir)) System.IO.Directory.CreateDirectory(dir);
        filePath = candidate;
      }
    }

    // --- Skip download if exists ---
    if (System.IO.File.Exists(filePath))
    {
      Print($"File already exists at {filePath}, skipping download.");
      epwPath = filePath;
      return;
    }

    // --- Download synchronously ---
    using (var http = new System.Net.Http.HttpClient())
    using (var resp = http.GetAsync(url, System.Net.Http.HttpCompletionOption.ResponseHeadersRead).Result)
    {
      resp.EnsureSuccessStatusCode();
      using (var fs = new System.IO.FileStream(filePath, System.IO.FileMode.Create, System.IO.FileAccess.Write, System.IO.FileShare.None))
      {
        resp.Content.CopyToAsync(fs).Wait();
      }
    }

    Print($"File downloaded successfully to {filePath}");
    epwPath = filePath;
  }
  catch (Exception ex)
  {
    Print($"Failed to download file: {ex.Message}");
  }
}


}

public static class FileDownloader
{
    /// <summary>
    /// Asynchronously downloads a file from the specified URL and saves it to the given file path.
    /// </summary>
    /// <param name="url">The URL of the file to download.</param>
    /// <param name="filePath">The local file path to save the downloaded file.</param>
    public static async Task DownloadFileAsync(string url, string filePath)
    {
        // Validate inputs
        if (string.IsNullOrWhiteSpace(url))
            throw new ArgumentException("URL cannot be null or empty.", nameof(url));

        if (string.IsNullOrWhiteSpace(filePath))
            throw new ArgumentException("File path cannot be null or empty.", nameof(filePath));

        // Ensure the directory exists
        var directory = Path.GetDirectoryName(filePath);
        if (!string.IsNullOrEmpty(directory) && !Directory.Exists(directory))
        {
            Directory.CreateDirectory(directory);
        }

        try
        {
            // Download file using HttpClient
            using var httpClient = new HttpClient();
            using var response = await httpClient.GetAsync(url, HttpCompletionOption.ResponseHeadersRead);
            response.EnsureSuccessStatusCode();

            // Save the file
            await using var fileStream = new FileStream(filePath, FileMode.Create, FileAccess.Write, FileShare.None);
            await response.Content.CopyToAsync(fileStream);
        }
        catch (Exception ex)
        {
            Console.WriteLine($"Error downloading file: {ex.Message}");
            throw;
        }
    }
}
# ---------- end c_script ----------

brep_grid_points = BrepGridPoints(Geometry=data, Spacing=Slider(2, range=0..10))  # -> Points, Vectors, Mesh, Status
surface = MRTSurface(Geometry=brep, Simulated=True, PatchSize=3, LegacyOpaqueTrees=True)  # -> Surface, Mesh
mrt_settings = MRTSettings(
    SmallFaceCutoff=0.1,
    RadianceReflections=True,
    EnergyPlusSurfaces=True,
    EngineTimeout=60,
    RadianceQuality="Standard",
    Parallelize="Auto (one per core)",
    MrtSettingsInputLayoutVersion=3)
mrt_sensors = MRTSensors(Sensors=brep_grid_points.Mesh, Height=1.1)  # -> Sensors, Points
mrt = MRT(
    Surfaces=surface.Surface,
    Sensors=mrt_sensors.Sensors,
    EPW=c_script.epwPath,
    Settings=mrt_settings,
    Engine="Native",
    Run=False,
    AutoProject="sturdy-ferret-quay-umbrella",
    MrtInputLayoutVersion=3,
    MrtOutputLayoutVersion=3,
    ShowSkyDome=True)  # -> SkyDome, Probes, Result
install_engines = InstallEngines(
    PullImage=False,
    InstallRadiance=False,
    InstallEnergyPlus=False,
    InstallFluidX3D=False,
    CheckContainerEngine=False,
    InstallLBM=False,
    InstallLBMNative=False,
    EngineMode=2)
mesh = Mesh(mrt.SkyDome)
deconstruct_mrt = DeconstructMRT(Result=mrt.Result, Statistic="Mean", Radius=0.75, DeMrtOutputLayoutVersion=2)  # -> Mean, Min, Max, MRT, Mesh
cluster = Cluster(data=deconstruct_mrt.Mean)

# ---- group: Mean
bnd = Bounds(Numbers=deconstruct_mrt.Mean)
panel_2 = Panel(deconstruct_mrt.Mean)
dedomain = DeconstructDomain(Domain=bnd)  # -> Start, End
gradient = Gradient(
    LowerLimit=cluster,
    UpperLimit=dedomain.End,
    Parameter=deconstruct_mrt.Mean,
    stops=[0: RGB(48, 18, 59), 0.0294: RGB(56, 40, 112), 0.0588: RGB(63, 62, 156), 0.0882: RGB(68, 82, 193), 0.118: RGB(70, 102, 221), 0.147: RGB(71, 122, 241)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])
cir = Circle(Plane=PlaneXY(0, 0, 0), Radius=1)
srf = Surface(cir)
preview_2 = CustomPreview(Geometry=srf, Material=gradient)
round = Round(Number=panel_2)  # -> Nearest, Floor, Ceiling
tag = TextTag(Text=round.Nearest, Colour=ColourSwatch(SwatchColor=RGB(255, 255, 255)))

# ==== cluster Cluster
data = ClusterInput()
data_2 = Data(data)
sort = SortList(Keys=data_2)  # -> Keys, ValuesA
lng = ListLength(List=data_2)
multiplication = Multiplication(A=lng, B=Slider(0.05, range=0..1))
round = Round(Number=multiplication)  # -> Nearest, Floor, Ceiling
item = ListItem(List=sort.Keys, Index=round.Floor, Wrap=True)
number = Number(item)
number_2 = ClusterOutput(number)
