# Grasshopper definition Solar_Access.ghx (Grasshopper 1.0.8)
# plug-ins: Outdoor, Eddy3D, Eddy3D-Radiance

# SOLAR ACCESS
# The whole solar chain against an answer you can
# work out on paper. Units: METERS.
# 
# THE GNOMON ORACLE
# The geometry is a single vertical pole: 0.5 m
# square section, 10 m tall, standing on the
# origin, from TestSolarShadowGeometryE2E. A pole
# of height h under a sun at elevation alpha casts
# its tip at horizontal distance h / tan(alpha),
# directly away from the sun. That is exact
# trigonometry with no model in it, and it is the
# oldest instrument in the subject.
# 
# WHY IT IS WORTH CHECKING: a sign flip on azimuth,
# north measured clockwise instead of counter-
# clockwise, or x and y transposed all produce
# shadows of exactly the right LENGTH pointing in
# the wrong DIRECTION - smooth, plausible output,
# no error anywhere, and a facade study that
# recommends shading the wrong elevation. Watch the
# shadow against the Sun Path compass, not against
# itself.
# 
# SITE Ithaca NY: 42.44 N, -76.50 E, UTC-5. Set on
# both Sun Path and Sun Vectors. North 0.
# 
# GROUND 40 x 40 m centred on the pole, gridded by
# Facade Grid at 1 m with a 0.05 m offset. Max Tilt
# 90 keeps horizontal faces, which is what makes a
# GROUND grid rather than a facade one. The grid
# carries per-cell areas, so Sun Stats and Sunlight
# Compliance weight by area rather than point count.
# 
# *** PERIOD: ONE DAY, NOT ONE YEAR ***
# Sun Hours ships at Start 4344 / End 4368 - the
# 24 hours of 21 June. Widening it to 0 / 8760 is
# 1,600 points x 8,760 sun samples of ray casting
# and turns a seconds-long recompute into a very
# long one. Raise Timestep before you raise the
# period: an hour moves the sun ~15 deg, so against
# a sharp shadow edge an hourly step misses
# transitions.
# 
# WEATHER: opening this document downloads the
# Ithaca EPW from climate.onebuilding.org and
# caches it under ~/Eddy3D. Download Weather hands
# back a PATH; the Weather component turns that
# into the record Sun Hours, Shadow and Solar
# Irradiation actually accept. Leaving the Search
# panel empty instead makes five components go red.
# 
# CANOPY is left unwired on both Sun Hours and
# Solar Irradiation. If you wire it, wire it by
# NAME, not by remembered index: Sun Hours' input
# order changed and old documents get migrated, so
# a hard-coded position lands on the wrong socket.
# 
# Sunlight Compliance is on EN 17037 (Standard 0).
# Design aid - its thresholds are editable and not
# certified.
# 
# Nothing here writes a file or runs an engine.
pt = ConstructPoint(XCoordinate=-0.25, YCoordinate=-0.25, ZCoordinate=0)
pt_2 = ConstructPoint(XCoordinate=0.25, YCoordinate=0.25, ZCoordinate=10)
dom = ConstructDomain(DomainStart=-20, DomainEnd=20)
weather = DownloadWeather(Search="Ithaca")  # -> EPWFile, Logs, Stations
box = Box2Pt(PointA=pt, PointB=pt_2, Plane=PlaneXY(0, 0, 0))
planesrf = PlaneSurface(Plane=PlaneXY(0, 0, 0), XSize=dom, YSize=dom)
weather_2 = Weather(EPWFilePath=weather.EPWFile)
facgrid = FacadeGrid(Geometry=planesrf, Spacing=1, Offset=0.05, MaxTilt=90, Flip=False)  # -> Points, Normals, Areas, Grid, Report
sunvec = SunVectors(
    Latitude=42.44,
    Longitude=-76.5,
    TimeZone=-5,
    FromMonth=1,
    FromDay=1,
    ToMonth=12,
    ToDay=31,
    StartHour=0,
    EndHour=24,
    Timestep=1,
    North=0,
    DaylightSaving=False,
    ElevationCutoff=0)  # -> SunVectors, Directions, Hours, Report
solarirr = SolarIrradiation(
    Context=box,
    Points=facgrid.Points,
    Normals=facgrid.Normals,
    Weather=weather_2,
    Timestep=1,
    GroundReflectance=0.2,
    Offset=0.01,
    North=0,
    SolarIrradiationInputLayoutVersion=2)  # -> Total, Direct, Diffuse, Reflected, Colors, Report
sunhrs = SunHours(
    Context=box,
    Points=facgrid.Points,
    Normals=facgrid.Normals,
    Weather=weather_2,
    StartHour=4344,
    EndHour=4368,
    Timestep=1,
    North=0,
    Offset=0.01,
    SunHoursInputLayoutVersion=2)  # -> SunHours, Fraction, Colors, Report
shadow = Shadow(
    Context=box,
    Points=facgrid.Points,
    Normals=facgrid.Normals,
    Weather=weather_2,
    Offset=0.01,
    North=0,
    ShadowInputLayoutVersion=2)  # -> Lit, Colors, SunlitPoints, Report
suncomply = SunlightCompliance(
    Standard=0,
    SunHours=sunhrs.SunHours,
    Areas=facgrid.Areas,
    AvailableHours=0,
    AvailableWinterHours=0,
    AmenityHours=2,
    AmenityAreaFraction=0.5,
    APSHAnnualFraction=0.25,
    APSHWinterFraction=0.05)  # -> Passes, Value, Threshold, PointPasses, Report
# POLLUTANT CANYON
# Street-canyon dispersion. Units: METERS.
# Built on the shipped BoxDomain workflow.
# 
# GEOMETRY, from TestPollutantCanyonContainerE2E:
# two building blocks (40,30,0)-(80,50,20) and
# (40,70,0)-(80,90,20), leaving a canyon along X
# between y=50 and y=70. Base cell size 5 m, to
# match the fixture's 120 x 120 x 40 m blockMesh
# over 24 x 24 x 8 cells.
# 
# POLLUTANT SOURCE volume (40,52,0)-(55,68,10),
# species "exhaust", 0.01 kg/s. The volume is
# deliberately many cells across - a box near the
# cell size is exactly how a topoSet zone comes
# out empty.
# 
# PROBE RAKE on the canyon centreline at
# pedestrian height, wind along +X:
#   (25, 60, 2)   upwind   - must stay near 0
#   (47.5, 60, 2) in-source - carries the emission
#   (75, 60, 2)   downwind - diluted, above upwind
# Probe Field is set to "exhaust", so it reads the
# tracer concentration (kg/m3), not velocity.
# 
# Run Settings Iterations = 80, the fixture's
# short-run count.
# 
# PRUNED from BoxDomain: the sample Tree branch,
# the sample building geometry, the 6208-point
# sample probe cloud, and the Wind Field Viewer /
# Wind Legend / Streamlines branch that read it.
# That cloud is another site's, and it shipped
# with a stale cached result (341 velocities for
# 6208 points) that showed as an orange component.
# 
# Action toggles ship OFF. Order: Outdoor Case >
# Write, Run > Mesh, Run > Create Zones,
# Run > Simulate.
sunpath = SunPath(Latitude=42.44, Longitude=-76.5, TimeZone=-5, Center=Point(0, 0, 0), Radius=25, North=0, SunVectors=sunvec.SunVectors)  # -> Arcs, Analemmas, Suns, Compass, Report
sunstats = SunStats(Values=sunhrs.SunHours, Grid=facgrid.Grid, Areas=facgrid.Areas, Threshold=2)  # -> Min, Mean, Median, Max, AreaAbove, FractionAbove, Report
