# Grasshopper definition Solar_radiation.ghx (Grasshopper 1.0.8)
# plug-ins: Outdoor, Eddy3D, Eddy3D-Radiance

number_slider = Slider(2, range=0..10)

# ---- group: Ground Surface
brep = Brep(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)

# ----
brepgrid = BrepGridPoints(Geometry=brep, Spacing=number_slider)  # -> Points, Vectors, Mesh, Status
context = Brep([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])
join = BrepJoin(Breps=context)  # -> Breps, Closed
preview = CustomPreview(Geometry=join.Breps, Material=ColourSwatch(SwatchColor=RGB(255, 255, 255)))
sky_exposure = SkyExposure(Positions=brepgrid.Points, Context=join.Breps, Offset=0.918)
brepgrid_2 = BrepGridPoints(Geometry=join.Breps, Spacing=number_slider)  # -> Points, Vectors, Mesh, Status

weather = DownloadWeather(Search="istanbul")  # -> EPWFile, Logs, Stations

weather_2 = Weather(EPWFilePath=weather.EPWFile)
sky_exposure_2 = SkyExposure(Positions=brepgrid_2.Points, Context=join.Breps, Offset=0.918)

solarirr = SolarIrradiation(
    Context=join.Breps,
    Points=brepgrid_2.Points,
    Normals=brepgrid_2.Vectors,
    Weather=weather_2,
    Timestep=1,
    SkyView=sky_exposure_2,
    GroundReflectance=0.2,
    Offset=0.01,
    North=0,
    SolarIrradiationInputLayoutVersion=2)  # -> Total, Direct, Diffuse, Reflected, Colors, Report
bnd = Bounds(Numbers=solarirr.Total)
dedomain = DeconstructDomain(Domain=bnd)  # -> Start, End
panel = Panel(solarirr.Total)
gradient = Gradient(
    LowerLimit=dedomain.Start,
    UpperLimit=dedomain.End,
    Parameter=solarirr.Total,
    stops=[0: RGB(48, 18, 59), 0.0294: RGB(56, 40, 112), 0.0588: RGB(63, 62, 156), 0.0882: RGB(68, 82, 193), 0.118: RGB(70, 102, 221), 0.147: RGB(71, 122, 241)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])
round = Round(Number=panel)  # -> Nearest, Floor, Ceiling
preview_2 = CustomPreview(Geometry=brepgrid_2.Points, Material=gradient)
tag = TextTag(Location=brepgrid.Points, Text=round.Nearest, Colour=ColourSwatch(SwatchColor=RGB(255, 255, 255)))

solarirr_2 = SolarIrradiation(
    Context=join.Breps,
    Points=brepgrid.Points,
    Normals=brepgrid.Vectors,
    Weather=weather_2,
    Timestep=1,
    SkyView=sky_exposure,
    GroundReflectance=0.2,
    Offset=0.01,
    North=0,
    SolarIrradiationInputLayoutVersion=2)  # -> Total, Direct, Diffuse, Reflected, Colors, Report
panel_2 = Panel(solarirr_2.Total)
gradient_2 = Gradient(
    LowerLimit=dedomain.Start,
    UpperLimit=dedomain.End,
    Parameter=solarirr_2.Total,
    stops=[0: RGB(48, 18, 59), 0.0294: RGB(56, 40, 112), 0.0588: RGB(63, 62, 156), 0.0882: RGB(68, 82, 193), 0.118: RGB(70, 102, 221), 0.147: RGB(71, 122, 241)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])
round_2 = Round(Number=panel_2)  # -> Nearest, Floor, Ceiling
preview_3 = CustomPreview(Geometry=brepgrid.Points, Material=gradient_2)
tag_2 = TextTag(Location=brepgrid.Points, Text=round_2.Nearest, Colour=ColourSwatch(SwatchColor=RGB(255, 255, 255)))
