# Grasshopper definition Sun_Hours.ghx (Grasshopper 1.0.8)
# plug-ins: Eddy3D-Noise, Outdoor, Eddy3D-Radiance

boolean_toggle = BooleanToggle(True)
boolean_toggle_2 = BooleanToggle(True)
site_picker = SitePicker(
    SitePickerAddress="36, East 14th Street, Union Square, Manhattan Community Board 5, Manhattan, New York County, New York, 10003, United States",
    SitePickerLat=40.735204,
    SitePickerLon=-73.991737)  # -> Latitude, Longitude, Address
lidar_site = LiDARSite(
    Latitude=site_picker.Latitude,
    Longitude=site_picker.Longitude,
    Size=400,
    Source="Auto",
    Roads=False,
    Run=boolean_toggle,
    LidarSiteInputLayoutVersion=4)  # -> PointCloud, Footprints, Domain, Frame, Report, TreeCrowns, LayerOutlines, LayerNames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
lidar_site_2 = LiDARSite(
    Latitude=site_picker.Latitude,
    Longitude=site_picker.Longitude,
    Size="200",
    Source="Auto",
    Roads=True,
    Run=boolean_toggle_2,
    LidarSiteInputLayoutVersion=4)  # -> PointCloud, Footprints, Domain, Frame, Report, TreeCrowns, LayerOutlines, LayerNames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
site_context = SiteContext(
    Latitude=site_picker.Latitude,
    Longitude=site_picker.Longitude,
    Radius=500,
    TerrainRadius=0,
    Buildings=True,
    Terrain=True,
    Trees=True,
    LandCover=True,
    FallbackHeight=9,
    BuildingSource="Global Building Atlas",
    TerrainSource="GEDTM30",
    Fetch=boolean_toggle,
    SiteContextInputLayoutVersion=3)  # -> Buildings, BuildingHeights, HeightSources, Terrain, SiteElevation, TreeCrowns, TreePoints, TreeHeights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
roads_from_osm = RoadsFromOSM(Latitude=site_picker.Latitude, Longitude=site_picker.Longitude, Radius="300", Fetch=True)  # -> Sources, Roads, Log
geometry = Geometry(lidar_site_2.Footprints)
weather = DownloadWeather(Station="New York", ChartMonthFrom=1, ChartMonthTo=12)  # -> EPWFile, Logs, Stations, Station, ExtraFiles, SiteLatitude, SiteLongitude
city_surface = CitySurface(
    PointCloud=lidar_site_2.PointCloud,
    Footprints=lidar_site_2.Footprints,
    Domain=lidar_site_2.Domain,
    CloudOffset=Vector(0, 0, 0),
    LayerOutlines=lidar_site_2.LayerOutlines,
    LayerNames=lidar_site_2.LayerNames,
    Flatten=lidar_site_2.Flatten,
    LayerRoughness=lidar_site_2.LayerRoughness,
    LayerPercentile=0.5,
    RoofPercentile=0.9,
    GroundSpacing="5",
    Smoothing=2,
    LoD="LoD 1.3",
    Buffer=0,
    RoofHints=lidar_site_2.RoofHints,
    Engine="GPU",
    Run=boolean_toggle_2,
    CitySurfaceInputLayoutVersion=8)  # -> Terrain, Buildings, Layers, LayerNames, Surface, RoofHeights, Report, LayerRoughness, TreeCrowns, LowVegetation
noise_receivers = NoiseReceivers(
    Buildings=city_surface.Buildings,
    Centre=Point(0, 0, 0),
    Radius=150,
    Spacing=2,
    Height=1.5,
    StoreyHeight=3,
    FacadeSpacing=5)  # -> Receivers, GroundPoints, FacadePoints
point = Point(noise_receivers.GroundPoints)
point_2 = Point(noise_receivers.FacadePoints)
noise_run = NoiseRun(
    Sources=roads_from_osm.Sources,
    Receivers=noise_receivers.Receivers,
    Buildings=city_surface.Buildings,
    Terrain=city_surface.Terrain,
    Ground="Mixed",
    CellSize="5",
    Engine="GPU",
    Run=True,
    NoiseRunInputLayoutVersion=2)  # -> Result, Lden, Lnight, Points, Summary
noise_map = NoiseMap(Result=noise_run.Result, Metric="Lden")  # -> GroundMesh, FacadeMesh, Points, Values, Colors, LegendLabels, LegendColors
mesh = Mesh(noise_map.GroundMesh)
mesh_2 = Mesh(noise_map.FacadeMesh)
number_slider = Slider(3, range=0..10)
brepgrid = BrepGridPoints(Geometry=city_surface.Terrain, Spacing=number_slider)  # -> Points, Vectors, Mesh, Status
brepgrid_2 = BrepGridPoints(Geometry=city_surface.Buildings, Spacing=number_slider)  # -> Points, Vectors, Mesh, Status
sky_exposure = SkyExposure(Positions=brepgrid.Points, Context=city_surface.Buildings, Offset=0.918, Engine="Auto")
surfacetemp_material = SurfaceTempMaterial(MaterialList="grass_ground")
surfacetemp_material_2 = SurfaceTempMaterial(MaterialList="brick_wall")
surfacetemp = SurfaceTemp(
    Points=brepgrid.Points,
    Vectors=brepgrid.Vectors,
    EPW=weather.EPWFile,
    Material=surfacetemp_material,
    IndoorTemp=22,
    SkyView=sky_exposure,
    Compute="Auto",
    Run=True,
    SurfaceTempInputLayoutVersion=2,
    SurfaceTempPersistResults=False)
surfacetemp_2 = SurfaceTemp(
    Points=brepgrid_2.Points,
    Vectors=brepgrid_2.Vectors,
    EPW=weather.EPWFile,
    Material=surfacetemp_material_2,
    IndoorTemp=22,
    SkyView=sky_exposure,
    Compute="Auto",
    Run=True,
    SurfaceTempInputLayoutVersion=2,
    SurfaceTempPersistResults=False)
deconstruct_surfacetemp = DeconstructSurfaceTemp(Result=surfacetemp)  # -> Mean, Min, Max, SurfaceTemp
deconstruct_surfacetemp_2 = DeconstructSurfaceTemp(Result=surfacetemp_2)  # -> Mean, Min, Max, SurfaceTemp
mesh_join = MeshJoin(Meshes=[brepgrid_2.Mesh, brepgrid.Mesh])
merge = Merge(Data1=brepgrid.Points, Data2=brepgrid_2.Points)  # -> flatten(Result)
merge_2 = Merge(Data1=deconstruct_surfacetemp.Mean, Data2=deconstruct_surfacetemp_2.Mean)  # -> flatten(Result)
scalar_field_viewer = ScalarFieldViewer(Points=merge, Values=merge_2, DisplayMode="Heatmap Mesh", Mesh=mesh_join, PointSize=4, ColorMap="Turbo")  # -> Geometry, Colors, Range
flex_legend = FlexLegend(
    Values=merge_2,
    Points=merge,
    MetricType="sun hours",
    ColorMap="Inferno",
    Contours="Off",
    Plane=PlaneXY(0, 0, 0),
    LabelStyle="Text",
    Offset=0.5,
    Smoothing=0,
    Aggregate="Mean",
    HighlightTop=0,
    FlexLegendInputLayoutVersion=4)  # -> LegendMesh, LegendPoints, LegendValues, FieldMesh, Colors, ResolvedRange, Contours, ContourValues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; disabled
