# Grasshopper definition SurfaceTemp.ghx (Grasshopper 1.0.8)
# plug-ins: Outdoor, Eddy3D, Eddy3D-Radiance

# ---- group: wind direction
list = ValueList({"North": 0, "Northeast": 45, "East": 90, "Southeast": 135, "South": 180, "Southwest": 225, "West": 270, "Northwest": 315}, selected="North")

# ----
panel = Panel("https://energyplus-weather.s3.amazonaws.com/europe_wmo_region_6/TUR/TUR_Istanbul.170600_IWEC/TUR_Istanbul.170600_IWEC.epw")
py3 = Python3Script()  # -> Directory
# ---------- py3: Python ----------
import os

# Gets the current user's home directory on both Windows and macOS
home_dir = os.path.expanduser("~")

# Concatenate with Eddy3d-cases
eddy_cases_dir = os.path.join(home_dir, "Eddy3D","Cases")

# Outputs
Directory = eddy_cases_dir
# ---------- end py3 ----------
c_script = CSharpScript(url=panel, saveTo=py3)  # -> out, epwPath; inputs url: String, saveTo: String
# ---------- c_script: C# ----------
// Grasshopper Script Instance
#region Usings
using System;
using System.Linq;
using System.Collections;
using System.Collections.Generic;
using System.Drawing;
using System.IO;
using System.Net.Http;
using System.Threading.Tasks;

using Rhino;
using Rhino.Geometry;

using Grasshopper;
using Grasshopper.Kernel;
using Grasshopper.Kernel.Data;
using Grasshopper.Kernel.Types;
#endregion

public class Script_Instance : GH_ScriptInstance
{
private void RunScript(string url, string saveTo, ref object epwPath)
{
  epwPath = null;

  try
  {
    // --- Validate URL ---
    if (string.IsNullOrWhiteSpace(url))
    {
      Print("URL is invalid.");
      return;
    }

    string urlFileName;
    try { urlFileName = System.IO.Path.GetFileName(new Uri(url).LocalPath); }
    catch { Print("URL is invalid."); return; }
    if (string.IsNullOrWhiteSpace(urlFileName)) urlFileName = "download.epw";

    // --- Decide destination path ---
    string filePath;

    if (string.IsNullOrWhiteSpace(saveTo))
    {
      // Use GH file's directory
      var ghDoc  = GrasshopperDocument; // <-- use this in C# Script
      var ghPath = ghDoc?.FilePath;

      if (string.IsNullOrEmpty(ghPath))
      {
        // fallback to Rhino document folder if available
        var rhPath = Rhino.RhinoDoc.ActiveDoc?.Path;
        var rhDir  = string.IsNullOrEmpty(rhPath) ? null : System.IO.Path.GetDirectoryName(rhPath);
        if (string.IsNullOrEmpty(rhDir))
        {
          Print("Grasshopper file is unsaved. Please save the .gh file or provide a destination path.");
          return;
        }
        Print("Grasshopper file is unsaved; saving to the Rhino document folder.");
        filePath = System.IO.Path.Combine(rhDir, urlFileName);
      }
      else
      {
        var ghDir = System.IO.Path.GetDirectoryName(ghPath);
        filePath  = System.IO.Path.Combine(ghDir, urlFileName);
      }
    }
    else
    {
      // Accept either a folder or a full file path
      string raw = saveTo.Trim().Trim('"');
      raw = Environment.ExpandEnvironmentVariables(raw);

      var ghDoc  = GrasshopperDocument; // <-- use this here too
      var ghPath = ghDoc?.FilePath;
      string baseRoot = !string.IsNullOrEmpty(ghPath)
        ? System.IO.Path.GetDirectoryName(ghPath)
        : System.IO.Directory.GetCurrentDirectory();

      string candidate = raw;
      if (!System.IO.Path.IsPathRooted(candidate))
        candidate = System.IO.Path.GetFullPath(System.IO.Path.Combine(baseRoot, candidate));

      bool endsWithSlash =
        candidate.EndsWith(System.IO.Path.DirectorySeparatorChar.ToString()) ||
        candidate.EndsWith(System.IO.Path.AltDirectorySeparatorChar.ToString());

      bool treatAsFolder = endsWithSlash || System.IO.Directory.Exists(candidate);

      if (treatAsFolder)
      {
        System.IO.Directory.CreateDirectory(candidate);
        filePath = System.IO.Path.Combine(candidate, urlFileName);
      }
      else
      {
        string dir = System.IO.Path.GetDirectoryName(candidate);
        if (!string.IsNullOrEmpty(dir)) System.IO.Directory.CreateDirectory(dir);
        filePath = candidate;
      }
    }

    // --- Skip download if exists ---
    if (System.IO.File.Exists(filePath))
    {
      Print($"File already exists at {filePath}, skipping download.");
      epwPath = filePath;
      return;
    }

    // --- Download synchronously ---
    using (var http = new System.Net.Http.HttpClient())
    using (var resp = http.GetAsync(url, System.Net.Http.HttpCompletionOption.ResponseHeadersRead).Result)
    {
      resp.EnsureSuccessStatusCode();
      using (var fs = new System.IO.FileStream(filePath, System.IO.FileMode.Create, System.IO.FileAccess.Write, System.IO.FileShare.None))
      {
        resp.Content.CopyToAsync(fs).Wait();
      }
    }

    Print($"File downloaded successfully to {filePath}");
    epwPath = filePath;
  }
  catch (Exception ex)
  {
    Print($"Failed to download file: {ex.Message}");
  }
}


}

public static class FileDownloader
{
    /// <summary>
    /// Asynchronously downloads a file from the specified URL and saves it to the given file path.
    /// </summary>
    /// <param name="url">The URL of the file to download.</param>
    /// <param name="filePath">The local file path to save the downloaded file.</param>
    public static async Task DownloadFileAsync(string url, string filePath)
    {
        // Validate inputs
        if (string.IsNullOrWhiteSpace(url))
            throw new ArgumentException("URL cannot be null or empty.", nameof(url));

        if (string.IsNullOrWhiteSpace(filePath))
            throw new ArgumentException("File path cannot be null or empty.", nameof(filePath));

        // Ensure the directory exists
        var directory = Path.GetDirectoryName(filePath);
        if (!string.IsNullOrEmpty(directory) && !Directory.Exists(directory))
        {
            Directory.CreateDirectory(directory);
        }

        try
        {
            // Download file using HttpClient
            using var httpClient = new HttpClient();
            using var response = await httpClient.GetAsync(url, HttpCompletionOption.ResponseHeadersRead);
            response.EnsureSuccessStatusCode();

            // Save the file
            await using var fileStream = new FileStream(filePath, FileMode.Create, FileAccess.Write, FileShare.None);
            await response.Content.CopyToAsync(fileStream);
        }
        catch (Exception ex)
        {
            Console.WriteLine($"Error downloading file: {ex.Message}");
            throw;
        }
    }
}
# ---------- end c_script ----------

# ---- group: Wind Speed
panel_2 = Panel("5")

# ----
swatch = ColourSwatch(SwatchColor=RGB(0, 0, 0))
abl = AtmosphericBoundaryLayer(WindDirections=list, WindSpeed=panel_2, TurbulentEpsilonΕ=0.135, TurbulentOmegaΩ=100)  # -> BoundaryConditions, WindVectors
compass = WindCompass(DirectionIndex=list, Radius=420, BasePoint=Point(0, 0, 0), Color=swatch, ArrowScale=0.5)  # -> Circle, Arrow

# ---- group: Legend Settings
dom = ConstructDomain(DomainStart=0, DomainEnd=panel_2)

# ----
list_2 = ValueList({"Velocity": 0, "Turbulent Kinetic Energy": 1}, selected="Velocity")
entwine = Entwine(Branch00=dom, FlattenInputs=True)  # -> simplify(Result)
branch = TreeBranch(Tree=entwine, Path=list_2, MaintainPaths=True)

# ---- group: Terrain- Do not change, try to center your geometry accordingly. / TERRAIN
srf = Surface(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)

# ---- group: Ground Surface
brep = Brep(srf)

# ----
token = FilePath("D:\GithubProjects\Conditional_Transformer\TokenHF\HF_Token.txt")
mlmodel = MLModel(Run=True, Model="Yel 2.0", HFToken=token)  # -> Status, FilePath, Progress

# ---- group: Terrain- Do not change, try to center your geometry accordingly.
move = Move(Geometry=srf, Motion=Vector(0, 0, 1.8))  # -> Geometry, Transform
brepgrid = BrepGridPoints(Geometry=move.Geometry, Spacing="10")  # -> Pts, Msg, Mesh, Status

# ----
vec = VectorXYZ(XComponent=0, YComponent=0, ZComponent=0)  # -> Vector, Length
deweather = DeconstructWeather(
    Weather=c_script.epwPath,
    Fields=["Dry Bulb Temperature", "Relative Humidity", "Wind Speed", "Wind Direction"],
    SelectedWeatherFields="""Dry Bulb Temperature
Relative Humidity
Wind Speed
Wind Direction""")  # -> DryBulbTemperature, RelativeHumidity, WindSpeed, WindDirection

brepgrid_2 = BrepGridPoints(Geometry=brep, Spacing=Slider(10, range=0..10))  # -> Points, Vectors, Mesh, Status
srf_2 = Surface(brep)
context = Brep([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])
preview = CustomPreview(Geometry=context, Material=ColourSwatch(SwatchColor=RGB(255, 255, 255)))
sky_exposure = SkyExposure(Positions=brepgrid_2.Points, Context=context, Offset=0.918)
surface = MRTSurface(Geometry=srf_2, Type=0, Simulated=True, PatchSize=3)  # -> Surface, Mesh
sensors = MRTSensors(Points=brepgrid_2.Points, Normal=Vector(0, 0, 1))  # -> Sensors, Points
surfacetemp_material = SurfaceTempMaterial(MaterialList="grass_ground")
hoy = HourOfYear(
    StartMonth=Slider(1, range=1..12),
    StartDay=Slider(1, range=1..30),
    StartHour=Slider(12, range=0..23),
    EndMonth=Slider(1, range=1..12),
    EndDay=Slider(1, range=1..31),
    EndHour=Slider(12, range=0..23))  # -> HoursOfYear, DateTimes
calendar = Calendar(Day=16, Hour=12, Month=7)
surfacetemp = SurfaceTemp(
    Points=brepgrid_2.Points,
    Vectors=brepgrid_2.Vectors,
    EPW=c_script.epwPath,
    Material=surfacetemp_material,
    HOY=calendar,
    IndoorTemp=22,
    SkyView=sky_exposure)
bnd = Bounds(Numbers=surfacetemp)
mrt = MRT(Surfaces=surface.Surface, Sensors=sensors.Sensors, EPW=c_script.epwPath, Run=False, Engine="Native")  # -> Points, MRT, SkyDome, Probes
panel_3 = Panel(surfacetemp)
dedomain = DeconstructDomain(Domain=bnd)  # -> Start, End
gradient = Gradient(
    LowerLimit=dedomain.Start,
    UpperLimit=dedomain.End,
    Parameter=surfacetemp,
    stops=[0: RGB(48, 18, 59), 0.0294: RGB(56, 40, 112), 0.0588: RGB(63, 62, 156), 0.0882: RGB(68, 82, 193), 0.118: RGB(70, 102, 221), 0.147: RGB(71, 122, 241)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])
round = Round(Number=panel_3)  # -> Nearest, Floor, Ceiling
cir = Circle(Plane=brepgrid_2.Points, Radius=1)
srf_3 = Surface(cir)
tag = TextTag(Location=brepgrid_2.Points, Text=round.Nearest, Colour=ColourSwatch(SwatchColor=RGB(255, 255, 255)))
preview_2 = CustomPreview(Geometry=srf_3, Material=gradient)

panel_4 = Panel(mlmodel.Status)
windpredict = WindPredictor(
    Points=brepgrid.Pts,
    Buildings=context,
    Model=mlmodel.FilePath,
    BoundaryConditions=abl.BoundaryConditions,
    Pedestrian_level=1.8,
    FilterMargin=0,
    Palette="jet",
    LegendDomain=branch,
    Interpolate="Smooth",
    Field="Velocity",
    Level="Roof Level")  # -> X, Y, Values, GridMesh, LegendMesh, LegendPoints, LegendValues, BoundaryConditions, ValuesRoof

rep = ReplaceText(Text=windpredict.Values, Find="NaN", Replace="0", RecursiveReplace=False)
amp = Amplitude(Vector=abl.WindVectors, Amplitude=rep)

vaf = VelocityAmplificationFactorsVAF(BoundaryConditions=abl.BoundaryConditions, WindVelocity=amp, EPW=c_script.epwPath, ProbeHeight=1.8, Interpolate=True)  # -> WindSpeed, VelocityAmplificationFactors
utcisim = UTCISimulation(
    MRT=mrt.MRT,
    WindSpeed=vaf.WindSpeed,
    AirTemperature=deweather.DryBulbTemperature,
    RelativeHumidity=deweather.RelativeHumidity,
    Transpose=True)  # -> UTCI, ComfortHours, Comfort

branch_2 = TreeBranch(Tree=utcisim.UTCI, Path=calendar, MaintainPaths=True)
bnd_2 = Bounds(Numbers=branch_2)
dedomain_2 = DeconstructDomain(Domain=bnd_2)  # -> Start, End
round_2 = Round(Number=panel_3)  # -> Nearest, Floor, Ceiling
cir_2 = Circle(Plane=brepgrid_2.Points, Radius=3)
gradient_2 = Gradient(
    LowerLimit=dedomain_2.Start,
    UpperLimit=dedomain_2.End,
    Parameter=branch_2,
    stops=[0: RGB(48, 18, 59), 0.0294: RGB(56, 40, 112), 0.0588: RGB(63, 62, 156), 0.0882: RGB(68, 82, 193), 0.118: RGB(70, 102, 221), 0.147: RGB(71, 122, 241)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])
srf_4 = Surface(cir_2)
tag_2 = TextTag(Location=brepgrid_2.Points, Text=round_2.Nearest, Colour=ColourSwatch(SwatchColor=RGB(255, 255, 255)))
preview_3 = CustomPreview(Geometry=srf_4, Material=gradient_2)

bnd_3 = Bounds(Numbers=windpredict.Values)
mesh = Mesh(windpredict.GridMesh)
mesh_2 = Mesh(windpredict.LegendMesh)
tag_3 = TextTag3D(Location=windpredict.LegendPoints, Text=windpredict.LegendValues, Size=14, Colour=swatch, Justification=5)
area = Area(Geometry=mesh_2)  # -> Area, Centroid
Y = UnitY(Factor=-100)
Y_2 = UnitY(Factor=-50)
move_2 = Move(Geometry=area.Centroid, Motion=Y)  # -> Geometry, Transform
move_3 = Move(Geometry=move_2.Geometry, Motion=Y_2)  # -> Geometry, Transform
concat = Concatenate(
    FragmentA="Incoming wind direction & speed: ",
    FragmentB=compass.Arrow,
    FragmentC=", ",
    FragmentD=panel_2,
    FragmentE=" m/s")
tag_4 = TextTag3D(Location=move_3.Geometry, Text=concat, Size=16, Colour=swatch, Justification=5)

# ---- group: Wind speed range
panel_5 = Panel(bnd_3)

# ----
concat_2 = Concatenate(FragmentA="Min - Max: ", FragmentB=panel_5)
tag_5 = TextTag3D(Location=move_2.Geometry, Text=concat_2, Size=16, Colour=swatch, Justification=5)
