# Grasshopper definition SurfaceTemps_FFT.ghx (Grasshopper 1.0.8)
# plug-ins: Outdoor, Eddy3D-Radiance

# ---- group: Ground Surface
brep = Brep(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)

# ----
brepgrid = BrepGridPoints(Geometry=brep, Spacing=Slider(2, range=0..10))  # -> Points, Vectors, Mesh, Status
context = Brep([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])

panel = Panel("https://energyplus-weather.s3.amazonaws.com/europe_wmo_region_6/TUR/TUR_Istanbul.170600_IWEC/TUR_Istanbul.170600_IWEC.epw")
py3 = Python3Script()  # -> Directory
# ---------- py3: Python ----------
import os

# Gets the current user's home directory on both Windows and macOS
home_dir = os.path.expanduser("~")

# Concatenate with Eddy3d-cases
eddy_cases_dir = os.path.join(home_dir, "Eddy3D","Cases")

# Outputs
Directory = eddy_cases_dir
# ---------- end py3 ----------
c_script = CSharpScript(url=panel, saveTo=py3)  # -> out, epwPath; inputs url: String, saveTo: String
# ---------- c_script: C# ----------
// Grasshopper Script Instance
#region Usings
using System;
using System.Linq;
using System.Collections;
using System.Collections.Generic;
using System.Drawing;
using System.IO;
using System.Net.Http;
using System.Threading.Tasks;

using Rhino;
using Rhino.Geometry;

using Grasshopper;
using Grasshopper.Kernel;
using Grasshopper.Kernel.Data;
using Grasshopper.Kernel.Types;
#endregion

public class Script_Instance : GH_ScriptInstance
{
private void RunScript(string url, string saveTo, ref object epwPath)
{
  epwPath = null;

  try
  {
    // --- Validate URL ---
    if (string.IsNullOrWhiteSpace(url))
    {
      Print("URL is invalid.");
      return;
    }

    string urlFileName;
    try { urlFileName = System.IO.Path.GetFileName(new Uri(url).LocalPath); }
    catch { Print("URL is invalid."); return; }
    if (string.IsNullOrWhiteSpace(urlFileName)) urlFileName = "download.epw";

    // --- Decide destination path ---
    string filePath;

    if (string.IsNullOrWhiteSpace(saveTo))
    {
      // Use GH file's directory
      var ghDoc  = GrasshopperDocument; // <-- use this in C# Script
      var ghPath = ghDoc?.FilePath;

      if (string.IsNullOrEmpty(ghPath))
      {
        // fallback to Rhino document folder if available
        var rhPath = Rhino.RhinoDoc.ActiveDoc?.Path;
        var rhDir  = string.IsNullOrEmpty(rhPath) ? null : System.IO.Path.GetDirectoryName(rhPath);
        if (string.IsNullOrEmpty(rhDir))
        {
          Print("Grasshopper file is unsaved. Please save the .gh file or provide a destination path.");
          return;
        }
        Print("Grasshopper file is unsaved; saving to the Rhino document folder.");
        filePath = System.IO.Path.Combine(rhDir, urlFileName);
      }
      else
      {
        var ghDir = System.IO.Path.GetDirectoryName(ghPath);
        filePath  = System.IO.Path.Combine(ghDir, urlFileName);
      }
    }
    else
    {
      // Accept either a folder or a full file path
      string raw = saveTo.Trim().Trim('"');
      raw = Environment.ExpandEnvironmentVariables(raw);

      var ghDoc  = GrasshopperDocument; // <-- use this here too
      var ghPath = ghDoc?.FilePath;
      string baseRoot = !string.IsNullOrEmpty(ghPath)
        ? System.IO.Path.GetDirectoryName(ghPath)
        : System.IO.Directory.GetCurrentDirectory();

      string candidate = raw;
      if (!System.IO.Path.IsPathRooted(candidate))
        candidate = System.IO.Path.GetFullPath(System.IO.Path.Combine(baseRoot, candidate));

      bool endsWithSlash =
        candidate.EndsWith(System.IO.Path.DirectorySeparatorChar.ToString()) ||
        candidate.EndsWith(System.IO.Path.AltDirectorySeparatorChar.ToString());

      bool treatAsFolder = endsWithSlash || System.IO.Directory.Exists(candidate) || !System.IO.Path.HasExtension(candidate);

      if (treatAsFolder)
      {
        System.IO.Directory.CreateDirectory(candidate);
        filePath = System.IO.Path.Combine(candidate, urlFileName);
      }
      else
      {
        string dir = System.IO.Path.GetDirectoryName(candidate);
        if (!string.IsNullOrEmpty(dir)) System.IO.Directory.CreateDirectory(dir);
        filePath = candidate;
      }
    }

    // --- Skip download if exists ---
    if (System.IO.File.Exists(filePath))
    {
      Print($"File already exists at {filePath}, skipping download.");
      epwPath = filePath;
      return;
    }

    // --- Download synchronously ---
    using (var http = new System.Net.Http.HttpClient())
    using (var resp = http.GetAsync(url, System.Net.Http.HttpCompletionOption.ResponseHeadersRead).Result)
    {
      resp.EnsureSuccessStatusCode();
      using (var fs = new System.IO.FileStream(filePath, System.IO.FileMode.Create, System.IO.FileAccess.Write, System.IO.FileShare.None))
      {
        resp.Content.CopyToAsync(fs).Wait();
      }
    }

    Print($"File downloaded successfully to {filePath}");
    epwPath = filePath;
  }
  catch (Exception ex)
  {
    Print($"Failed to download file: {ex.Message}");
  }
}


}

public static class FileDownloader
{
    /// <summary>
    /// Asynchronously downloads a file from the specified URL and saves it to the given file path.
    /// </summary>
    /// <param name="url">The URL of the file to download.</param>
    /// <param name="filePath">The local file path to save the downloaded file.</param>
    public static async Task DownloadFileAsync(string url, string filePath)
    {
        // Validate inputs
        if (string.IsNullOrWhiteSpace(url))
            throw new ArgumentException("URL cannot be null or empty.", nameof(url));

        if (string.IsNullOrWhiteSpace(filePath))
            throw new ArgumentException("File path cannot be null or empty.", nameof(filePath));

        // Ensure the directory exists
        var directory = Path.GetDirectoryName(filePath);
        if (!string.IsNullOrEmpty(directory) && !Directory.Exists(directory))
        {
            Directory.CreateDirectory(directory);
        }

        try
        {
            // Download file using HttpClient
            using var httpClient = new HttpClient();
            using var response = await httpClient.GetAsync(url, HttpCompletionOption.ResponseHeadersRead);
            response.EnsureSuccessStatusCode();

            // Save the file
            await using var fileStream = new FileStream(filePath, FileMode.Create, FileAccess.Write, FileShare.None);
            await response.Content.CopyToAsync(fileStream);
        }
        catch (Exception ex)
        {
            Console.WriteLine($"Error downloading file: {ex.Message}");
            throw;
        }
    }
}
# ---------- end c_script ----------

preview = CustomPreview(Geometry=context, Material=ColourSwatch(SwatchColor=RGB(255, 255, 255)))
sky_exposure = SkyExposure(Positions=brepgrid.Points, Context=context, Offset=0.918)
surfacetemp_material = SurfaceTempMaterial(MaterialList="grass_ground")
hoy = HourOfYear(
    StartMonth=Slider(1, range=1..12),
    StartDay=Slider(7, range=1..30),
    StartHour=Slider(0, range=0..23),
    EndMonth=Slider(12, range=1..12),
    EndDay=Slider(31, range=1..31),
    EndHour=Slider(23, range=0..23))  # -> HoursOfYear, DateTimes
surfacetemp = SurfaceTemp(
    Points=brepgrid.Points,
    Vectors=brepgrid.Vectors,
    EPW=c_script.epwPath,
    Material=surfacetemp_material,
    IndoorTemp=22,
    SkyView=sky_exposure,
    Run=True,
    SurfaceTempPersistResults=False)
calendar = Calendar(Day=24, Hour=0, Month=7)
deconstruct_surfacetemp = DeconstructSurfaceTemp(Result=surfacetemp)  # -> Mean, Min, Max, SurfaceTemp

# ---- group: Mean
bnd = Bounds(Numbers=deconstruct_surfacetemp.Mean)
cir = Circle(Plane=brepgrid.Points, Radius=1)
dedomain = DeconstructDomain(Domain=bnd)  # -> Start, End
panel_2 = Panel(deconstruct_surfacetemp.Mean)
gradient = Gradient(
    LowerLimit=dedomain.Start,
    UpperLimit=dedomain.End,
    Parameter=deconstruct_surfacetemp.Mean,
    stops=[0: RGB(48, 18, 59), 0.0294: RGB(56, 40, 112), 0.0588: RGB(63, 62, 156), 0.0882: RGB(68, 82, 193), 0.118: RGB(70, 102, 221), 0.147: RGB(71, 122, 241)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])
srf = Surface(cir)
round = Round(Number=panel_2)  # -> Nearest, Floor, Ceiling
preview_2 = CustomPreview(Geometry=srf, Material=gradient)
tag = TextTag(Location=brepgrid.Points, Text=round.Nearest, Colour=ColourSwatch(SwatchColor=RGB(255, 255, 255)))

# ---- group: Max
bnd_2 = Bounds(Numbers=deconstruct_surfacetemp.Max)  # disabled
dedomain_2 = DeconstructDomain(Domain=bnd_2)  # -> Start, End; disabled
panel_3 = Panel(deconstruct_surfacetemp.Max)  # disabled
gradient_2 = Gradient(
    LowerLimit=dedomain_2.Start,
    UpperLimit=dedomain_2.End,
    Parameter=deconstruct_surfacetemp.Max,
    stops=[0: RGB(255, 254, 255), 1: RGB(0, 0, 0)])  # disabled
cir_2 = Circle(Plane=brepgrid.Points, Radius=1)  # disabled
panel_4 = Panel("-200")  # disabled
unit_y = UnitY(Factor=panel_4)  # disabled
move = Move(Geometry=cir_2, Motion=unit_y)  # -> Geometry, Transform; disabled
move_2 = Move(Geometry=brepgrid.Points, Motion=unit_y)  # -> Geometry, Transform; disabled
round_2 = Round(Number=panel_3)  # -> Nearest, Floor, Ceiling; disabled
swatch = ColourSwatch(SwatchColor=RGB(255, 255, 255))  # disabled
preview_3 = CustomPreview(Geometry=move.Geometry, Material=gradient_2)  # disabled
tag_2 = TextTag(Location=move_2.Geometry, Text=round_2.Nearest, Colour=swatch)  # disabled
