# Grasshopper definition Surrogate_hourly_thermal_comfort_analysis.ghx (Grasshopper 1.0.8)
# plug-ins: Outdoor, Eddy3D, Eddy3D-Radiance

# ---- group: Weather File
panel = Panel("https://energyplus-weather.s3.amazonaws.com/north_and_central_america_wmo_region_4/USA/GA/USA_GA_Atlanta-Hartsfield-Jackson.Intl.AP.722190_TMY3/USA_GA_Atlanta-Hartsfield-Jackson.Intl.AP.722190_TMY3.epw")
py3 = Python3Script()  # -> Directory
# ---------- py3: Python ----------
import os

# Gets the current user's home directory on both Windows and macOS
home_dir = os.path.expanduser("~")

# Concatenate with Eddy3d-cases
eddy_cases_dir = os.path.join(home_dir, "Eddy3D","Cases")

# Outputs
Directory = eddy_cases_dir
# ---------- end py3 ----------
c_script = CSharpScript(url=panel, saveTo=py3)  # -> out, epwPath; inputs url: String, saveTo: String
# ---------- c_script: C# ----------
// Grasshopper Script Instance
#region Usings
using System;
using System.Linq;
using System.Collections;
using System.Collections.Generic;
using System.Drawing;
using System.IO;
using System.Net.Http;
using System.Threading.Tasks;

using Rhino;
using Rhino.Geometry;

using Grasshopper;
using Grasshopper.Kernel;
using Grasshopper.Kernel.Data;
using Grasshopper.Kernel.Types;
#endregion

public class Script_Instance : GH_ScriptInstance
{
private void RunScript(string url, string saveTo, ref object epwPath)
{
  epwPath = null;

  try
  {
    // --- Validate URL ---
    if (string.IsNullOrWhiteSpace(url))
    {
      Print("URL is invalid.");
      return;
    }

    string urlFileName;
    try { urlFileName = System.IO.Path.GetFileName(new Uri(url).LocalPath); }
    catch { Print("URL is invalid."); return; }
    if (string.IsNullOrWhiteSpace(urlFileName)) urlFileName = "download.epw";

    // --- Decide destination path ---
    string filePath;

    if (string.IsNullOrWhiteSpace(saveTo))
    {
      // Use GH file's directory
      var ghDoc  = GrasshopperDocument; // <-- use this in C# Script
      var ghPath = ghDoc?.FilePath;

      if (string.IsNullOrEmpty(ghPath))
      {
        // fallback to Rhino document folder if available
        var rhPath = Rhino.RhinoDoc.ActiveDoc?.Path;
        var rhDir  = string.IsNullOrEmpty(rhPath) ? null : System.IO.Path.GetDirectoryName(rhPath);
        if (string.IsNullOrEmpty(rhDir))
        {
          Print("Grasshopper file is unsaved. Please save the .gh file or provide a destination path.");
          return;
        }
        Print("Grasshopper file is unsaved; saving to the Rhino document folder.");
        filePath = System.IO.Path.Combine(rhDir, urlFileName);
      }
      else
      {
        var ghDir = System.IO.Path.GetDirectoryName(ghPath);
        filePath  = System.IO.Path.Combine(ghDir, urlFileName);
      }
    }
    else
    {
      // Accept either a folder or a full file path
      string raw = saveTo.Trim().Trim('"');
      raw = Environment.ExpandEnvironmentVariables(raw);

      var ghDoc  = GrasshopperDocument; // <-- use this here too
      var ghPath = ghDoc?.FilePath;
      string baseRoot = !string.IsNullOrEmpty(ghPath)
        ? System.IO.Path.GetDirectoryName(ghPath)
        : System.IO.Directory.GetCurrentDirectory();

      string candidate = raw;
      if (!System.IO.Path.IsPathRooted(candidate))
        candidate = System.IO.Path.GetFullPath(System.IO.Path.Combine(baseRoot, candidate));

      bool endsWithSlash =
        candidate.EndsWith(System.IO.Path.DirectorySeparatorChar.ToString()) ||
        candidate.EndsWith(System.IO.Path.AltDirectorySeparatorChar.ToString());

      bool treatAsFolder = endsWithSlash || System.IO.Directory.Exists(candidate) || !System.IO.Path.HasExtension(candidate);

      if (treatAsFolder)
      {
        System.IO.Directory.CreateDirectory(candidate);
        filePath = System.IO.Path.Combine(candidate, urlFileName);
      }
      else
      {
        string dir = System.IO.Path.GetDirectoryName(candidate);
        if (!string.IsNullOrEmpty(dir)) System.IO.Directory.CreateDirectory(dir);
        filePath = candidate;
      }
    }

    // --- Skip download if exists ---
    if (System.IO.File.Exists(filePath))
    {
      Print($"File already exists at {filePath}, skipping download.");
      epwPath = filePath;
      return;
    }

    // --- Download synchronously ---
    using (var http = new System.Net.Http.HttpClient())
    using (var resp = http.GetAsync(url, System.Net.Http.HttpCompletionOption.ResponseHeadersRead).Result)
    {
      resp.EnsureSuccessStatusCode();
      using (var fs = new System.IO.FileStream(filePath, System.IO.FileMode.Create, System.IO.FileAccess.Write, System.IO.FileShare.None))
      {
        resp.Content.CopyToAsync(fs).Wait();
      }
    }

    Print($"File downloaded successfully to {filePath}");
    epwPath = filePath;
  }
  catch (Exception ex)
  {
    Print($"Failed to download file: {ex.Message}");
  }
}


}

public static class FileDownloader
{
    /// <summary>
    /// Asynchronously downloads a file from the specified URL and saves it to the given file path.
    /// </summary>
    /// <param name="url">The URL of the file to download.</param>
    /// <param name="filePath">The local file path to save the downloaded file.</param>
    public static async Task DownloadFileAsync(string url, string filePath)
    {
        // Validate inputs
        if (string.IsNullOrWhiteSpace(url))
            throw new ArgumentException("URL cannot be null or empty.", nameof(url));

        if (string.IsNullOrWhiteSpace(filePath))
            throw new ArgumentException("File path cannot be null or empty.", nameof(filePath));

        // Ensure the directory exists
        var directory = Path.GetDirectoryName(filePath);
        if (!string.IsNullOrEmpty(directory) && !Directory.Exists(directory))
        {
            Directory.CreateDirectory(directory);
        }

        try
        {
            // Download file using HttpClient
            using var httpClient = new HttpClient();
            using var response = await httpClient.GetAsync(url, HttpCompletionOption.ResponseHeadersRead);
            response.EnsureSuccessStatusCode();

            // Save the file
            await using var fileStream = new FileStream(filePath, FileMode.Create, FileAccess.Write, FileShare.None);
            await response.Content.CopyToAsync(fileStream);
        }
        catch (Exception ex)
        {
            Console.WriteLine($"Error downloading file: {ex.Message}");
            throw;
        }
    }
}
# ---------- end c_script ----------

# ---- group: Tree - handled as solid obstructions in the wind analysis
mesh = Mesh([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])
preview = CustomPreview(Geometry=mesh, Material=ColourSwatch(SwatchColor=RGBA(147, 168, 145, 152)))

# ---- group: Buildings
context = Brep([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])
preview_2 = CustomPreview(Geometry=context, Material=ColourSwatch(SwatchColor=RGB(255, 255, 255)))

# ----
merge = Merge(Data1=context, Data2=mesh)

# ---- group: Terrain (do not change)
cir = Circle(Plane=PlaneXY(0, 0, 0), Radius=504)
Z = UnitZ(Factor=1.8)
srf = Surface(cir)
move = Move(Geometry=srf, Motion=Z)  # -> Geometry, Transform

# ----
surfsettings = SurfaceSettings(
    Thickness=0.1,
    Conductivity=2.3,
    Density=2400,
    SpecificHeat=840,
    ThermalAbsorptance=0.9,
    SolarAbsorptance=0.7,
    VisibleAbsorptance=0.7)
surfsettings_2 = SurfaceSettings(
    Thickness=0.1,
    Conductivity=2.3,
    Density=2400,
    SpecificHeat=840,
    ThermalAbsorptance=0.9,
    SolarAbsorptance=0.7,
    VisibleAbsorptance=0.7)
tree = TreeSettings(Reflectivity=0.2, Emissivity=0.95)
mrt_surface = MRTSurface(Geometry=mesh, Type="Tree", Simulated=False, PatchSize=3, Material=tree)  # -> Surface, Mesh
mlmodel = MLModel(Model="Yel 2.0", Run=Toggle(True), MLModelInputLayoutVersion=2)  # -> Status, FilePath, Progress

# ---- group: Ground surface
cir_2 = Circle(Plane=PlaneXY(0, 0, 0), Radius=100)
srf_2 = Surface(cir_2)

# ----
move_2 = Move(Geometry=srf_2, Motion="0,0,1.8")  # -> Geometry, Transform

# ---- group: Ground surface (continued)
brepgrid = BrepGridPoints(Geometry=move_2.Geometry, Spacing=2)  # -> Points, Vectors, Mesh, Status

# ----
mrt_surface_2 = MRTSurface(Geometry=srf_2, Type="Ground", Simulated=False, PatchSize=3, Material=surfsettings_2)  # -> Surface, Mesh
sensors = MRTSensors(Sensors=brepgrid.Points, Normal=brepgrid.Vectors, Height=0)  # -> Sensors, Points

# ---- group: EPW extracted values
panel_2 = Panel("1")
calendar = Calendar(Day=7, Hour=8, Month=9)
deweather = DeconstructWeather(Variables=c_script.epwPath, Series="""Dry Bulb Temperature
Relative Humidity
Wind Speed
Wind Direction""")  # -> DryBulbTemperature, RelativeHumidity, WindSpeed, WindDirection

# ---- group: EPW extracted values / hour of the year, index arrangement
subtraction = Subtraction(A=calendar, B=panel_2)

# ---- group: EPW extracted values (continued)
item = ListItem(List=deweather.DryBulbTemperature, Index=subtraction, Wrap=True)
item_2 = ListItem(List=deweather.RelativeHumidity, Index=subtraction, Wrap=True)
item_3 = ListItem(List=deweather.WindSpeed, Index=subtraction, Wrap=True)
item_4 = ListItem(List=deweather.WindDirection, Index=subtraction, Wrap=True)

# ---- group: Surrogate
brepgrid_2 = BrepGridPoints(Geometry=move.Geometry, Spacing=2)  # -> Points, Vectors, Mesh, Status
abl = AtmosphericBoundaryLayer(
    WindDirections=item_4,
    WindSpeed=item_3,
    ReferenceHeight=10,
    RoughnessLengthZ0=1,
    GroundHeight=0,
    TurbulentKEK=0.015,
    TurbulentEpsilonΕ=0.135,
    TurbulentOmegaΩ=100,
    TerrainType="Custom (z0 input)",
    AblOutputLayoutVersion=2)  # -> BoundaryConditions, WindVectors
windpredict = WindPredictor(
    Points=brepgrid_2.Points,
    Buildings=merge,
    Model=mlmodel.FilePath,
    BoundaryConditions=abl.BoundaryConditions,
    PedestrianLevel=1.8,
    FilterMargin=100,
    Palette="jet",
    Interpolate="Smooth",
    Field="Velocity",
    Level="Pedestrian Level",
    SelectionPoints=brepgrid.Points,
    Radius=0.75,
    LegendScale=1,
    MeshType="Square",
    Run=True)  # -> X, Y, Values, GridMesh, LegendMesh, LegendPoints, LegendValues, BoundaryConditions, ValuesRoof

# ---- group: Surrogate / Wind speed output
mesh_2 = Mesh(windpredict.GridMesh)

# ----
mrt_surface_3 = MRTSurface(Geometry=context, Type="Building", Simulated=False, PatchSize=3, Material=surfsettings)  # -> Surface, Mesh

merge_2 = Merge(Data1=mrt_surface_3.Surface, Data2=mrt_surface_2.Surface, Data3=mrt_surface.Surface)

vf = MRTViewFactors(Surfaces=merge_2, Sensors=sensors.Sensors, SkyDomeSubdivisions="5 — 3,072 sky patches", Fidelity="Balanced", Run=False)  # -> VFModel, SkyDome, Log
solve = MRTSolve(VFModel=vf.VFModel, EPW=c_script.epwPath, Engine="Native", Run=False)  # -> Probes, Result, Log
deconstruct_mrt = DeconstructMRT(Result=solve.Result, HOY=calendar, Statistic="Mean", Radius=0.75, DeMrtOutputLayoutVersion=2)  # -> Mean, Min, Max, MRT, Mesh

# ---- group: MRT Output
mesh_3 = Mesh(deconstruct_mrt.Mesh)

# ---- group: UTCI calculation
comfort = ThermalComfort(AirTemperature=item, RelativeHumidity=item_2, WindSpeed=windpredict.Values, MRT=deconstruct_mrt.MRT, ActiveMetric="UTCI")  # -> Value, Stress, Details, MetricType
bnd = Bounds(Numbers=comfort.Value)
panel_3 = Panel(comfort.Value)
dedomain = DeconstructDomain(Domain=bnd)  # -> Start, End
gradient = Gradient(
    LowerLimit=dedomain.Start,
    UpperLimit=dedomain.End,
    Parameter=comfort.Value,
    stops=[0: RGB(48, 18, 59), 0.0294: RGB(56, 40, 112), 0.0588: RGB(63, 62, 156), 0.0882: RGB(68, 82, 193), 0.118: RGB(70, 102, 221), 0.147: RGB(71, 122, 241)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])
round = Round(Number=panel_3)  # -> Nearest, Floor, Ceiling
tag = TextTag(Location=brepgrid.Points, Text=round.Nearest, Colour=ColourSwatch(SwatchColor=RGB(0, 0, 0)))

# ----
legend = ThermalComfortLegend(
    Values=comfort.Value,
    Plane=PlaneXY(0, 0, 0),
    Size=2,
    GroundSurface=srf_2,
    Offset=5,
    SmoothColors=True,
    CircleRadius=0.75,
    SensorPoints=brepgrid.Points,
    Scale=2,
    Metric=comfort.MetricType,
    UtciLegendShowValues=False)  # -> Colors, Categories, LegendMesh, LabelPoints, Labels, UTCIMesh, CenteredLabels

# ---- group: UTCI calculation (continued)
mesh_4 = Mesh(legend.LegendMesh)
mesh_5 = Mesh(legend.UTCIMesh)
tag_2 = TextTag3D(Location=legend.LabelPoints, Text=legend.Labels, Size=1, Colour=ColourSwatch(SwatchColor=RGB(0, 0, 0)), Justification=8)
