# Grasshopper definition UTCI_surrogate.ghx (Grasshopper 1.0.8)
# plug-ins: Outdoor, Eddy3D, Eddy3D-Radiance

cir = Circle(Plane=PlaneXY(0, 0, 0), Radius=50)
srf = Surface(cir)
brepgrid = BrepGridPoints(Geometry=srf, Spacing=Slider(2, range=0..10))  # -> Points, Vectors, Mesh, Status
context = Brep([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])
cir_2 = Circle(Plane=PlaneXY(0, 0, 0), Radius=Slider(504, range=0..1000))
Z = UnitZ(Factor=1.8)
preview = CustomPreview(Geometry=context, Material=ColourSwatch(SwatchColor=RGB(255, 255, 255)))
srf_2 = Surface(cir_2)

panel = Panel("https://energyplus-weather.s3.amazonaws.com/north_and_central_america_wmo_region_4/USA/GA/USA_GA_Atlanta-Hartsfield-Jackson.Intl.AP.722190_TMY3/USA_GA_Atlanta-Hartsfield-Jackson.Intl.AP.722190_TMY3.epw")
py3 = Python3Script()  # -> Directory
# ---------- py3: Python ----------
import os

# Gets the current user's home directory on both Windows and macOS
home_dir = os.path.expanduser("~")

# Concatenate with Eddy3d-cases
eddy_cases_dir = os.path.join(home_dir, "Eddy3D","Cases")

# Outputs
Directory = eddy_cases_dir
# ---------- end py3 ----------
c_script = CSharpScript(url=panel, saveTo=py3)  # -> out, epwPath; inputs url: String, saveTo: String
# ---------- c_script: C# ----------
// Grasshopper Script Instance
#region Usings
using System;
using System.Linq;
using System.Collections;
using System.Collections.Generic;
using System.Drawing;
using System.IO;
using System.Net.Http;
using System.Threading.Tasks;

using Rhino;
using Rhino.Geometry;

using Grasshopper;
using Grasshopper.Kernel;
using Grasshopper.Kernel.Data;
using Grasshopper.Kernel.Types;
#endregion

public class Script_Instance : GH_ScriptInstance
{
private void RunScript(string url, string saveTo, ref object epwPath)
{
  epwPath = null;

  try
  {
    // --- Validate URL ---
    if (string.IsNullOrWhiteSpace(url))
    {
      Print("URL is invalid.");
      return;
    }

    string urlFileName;
    try { urlFileName = System.IO.Path.GetFileName(new Uri(url).LocalPath); }
    catch { Print("URL is invalid."); return; }
    if (string.IsNullOrWhiteSpace(urlFileName)) urlFileName = "download.epw";

    // --- Decide destination path ---
    string filePath;

    if (string.IsNullOrWhiteSpace(saveTo))
    {
      // Use GH file's directory
      var ghDoc  = GrasshopperDocument; // <-- use this in C# Script
      var ghPath = ghDoc?.FilePath;

      if (string.IsNullOrEmpty(ghPath))
      {
        // fallback to Rhino document folder if available
        var rhPath = Rhino.RhinoDoc.ActiveDoc?.Path;
        var rhDir  = string.IsNullOrEmpty(rhPath) ? null : System.IO.Path.GetDirectoryName(rhPath);
        if (string.IsNullOrEmpty(rhDir))
        {
          Print("Grasshopper file is unsaved. Please save the .gh file or provide a destination path.");
          return;
        }
        Print("Grasshopper file is unsaved; saving to the Rhino document folder.");
        filePath = System.IO.Path.Combine(rhDir, urlFileName);
      }
      else
      {
        var ghDir = System.IO.Path.GetDirectoryName(ghPath);
        filePath  = System.IO.Path.Combine(ghDir, urlFileName);
      }
    }
    else
    {
      // Accept either a folder or a full file path
      string raw = saveTo.Trim().Trim('"');
      raw = Environment.ExpandEnvironmentVariables(raw);

      var ghDoc  = GrasshopperDocument; // <-- use this here too
      var ghPath = ghDoc?.FilePath;
      string baseRoot = !string.IsNullOrEmpty(ghPath)
        ? System.IO.Path.GetDirectoryName(ghPath)
        : System.IO.Directory.GetCurrentDirectory();

      string candidate = raw;
      if (!System.IO.Path.IsPathRooted(candidate))
        candidate = System.IO.Path.GetFullPath(System.IO.Path.Combine(baseRoot, candidate));

      bool endsWithSlash =
        candidate.EndsWith(System.IO.Path.DirectorySeparatorChar.ToString()) ||
        candidate.EndsWith(System.IO.Path.AltDirectorySeparatorChar.ToString());

      bool treatAsFolder = endsWithSlash || System.IO.Directory.Exists(candidate);

      if (treatAsFolder)
      {
        System.IO.Directory.CreateDirectory(candidate);
        filePath = System.IO.Path.Combine(candidate, urlFileName);
      }
      else
      {
        string dir = System.IO.Path.GetDirectoryName(candidate);
        if (!string.IsNullOrEmpty(dir)) System.IO.Directory.CreateDirectory(dir);
        filePath = candidate;
      }
    }

    // --- Skip download if exists ---
    if (System.IO.File.Exists(filePath))
    {
      Print($"File already exists at {filePath}, skipping download.");
      epwPath = filePath;
      return;
    }

    // --- Download synchronously ---
    using (var http = new System.Net.Http.HttpClient())
    using (var resp = http.GetAsync(url, System.Net.Http.HttpCompletionOption.ResponseHeadersRead).Result)
    {
      resp.EnsureSuccessStatusCode();
      using (var fs = new System.IO.FileStream(filePath, System.IO.FileMode.Create, System.IO.FileAccess.Write, System.IO.FileShare.None))
      {
        resp.Content.CopyToAsync(fs).Wait();
      }
    }

    Print($"File downloaded successfully to {filePath}");
    epwPath = filePath;
  }
  catch (Exception ex)
  {
    Print($"Failed to download file: {ex.Message}");
  }
}


}

public static class FileDownloader
{
    /// <summary>
    /// Asynchronously downloads a file from the specified URL and saves it to the given file path.
    /// </summary>
    /// <param name="url">The URL of the file to download.</param>
    /// <param name="filePath">The local file path to save the downloaded file.</param>
    public static async Task DownloadFileAsync(string url, string filePath)
    {
        // Validate inputs
        if (string.IsNullOrWhiteSpace(url))
            throw new ArgumentException("URL cannot be null or empty.", nameof(url));

        if (string.IsNullOrWhiteSpace(filePath))
            throw new ArgumentException("File path cannot be null or empty.", nameof(filePath));

        // Ensure the directory exists
        var directory = Path.GetDirectoryName(filePath);
        if (!string.IsNullOrEmpty(directory) && !Directory.Exists(directory))
        {
            Directory.CreateDirectory(directory);
        }

        try
        {
            // Download file using HttpClient
            using var httpClient = new HttpClient();
            using var response = await httpClient.GetAsync(url, HttpCompletionOption.ResponseHeadersRead);
            response.EnsureSuccessStatusCode();

            // Save the file
            await using var fileStream = new FileStream(filePath, FileMode.Create, FileAccess.Write, FileShare.None);
            await response.Content.CopyToAsync(fileStream);
        }
        catch (Exception ex)
        {
            Console.WriteLine($"Error downloading file: {ex.Message}");
            throw;
        }
    }
}
# ---------- end c_script ----------

move = Move(Geometry=srf_2, Motion=Z)  # -> Geometry, Transform
brepgrid_2 = BrepGridPoints(Geometry=move.Geometry, Spacing=2)  # -> Points, Vectors, Mesh, Status
sky_exposure = SkyExposure(Positions=brepgrid.Points, Context=context, Offset=0.918)
surfacetemp_material = SurfaceTempMaterial(MaterialList="grass_ground")
hoy = HourOfYear(
    StartMonth=Slider(1, range=1..12),
    StartDay=Slider(1, range=1..30),
    StartHour=Slider(0, range=0..23),
    EndMonth=Slider(12, range=1..12),
    EndDay=Slider(31, range=1..31),
    EndHour=Slider(23, range=0..23))  # -> HoursOfYear, DateTimes
mlmodel = MLModel(Run=True, Model="Yel 2.0")  # -> Status, FilePath, Progress
surfacetemp = SurfaceTemp(
    Points=brepgrid.Points,
    Vectors=brepgrid.Vectors,
    EPW=c_script.epwPath,
    Material=surfacetemp_material,
    HOY=hoy.HoursOfYear,
    IndoorTemp=22,
    SkyView=sky_exposure,
    Run=True)
calendar = Calendar(Day=20, Hour=13, Month=11)
sensors = MRTSensors(Points=brepgrid.Points, Normal=Vector(0, 0, 1), Height=1.1)  # -> Sensors, Points
subtraction = Subtraction(A=calendar, B=1)
surface = MRTSurface(Geometry=srf, Type=1, Simulated=True, PatchSize=3, Temperature=surfacetemp, TemperaturePoints=brepgrid.Points)  # -> Surface, Mesh
branch = TreeBranch(Tree=surfacetemp, Path=subtraction, MaintainPaths=True)
deweather = DeconstructWeather(Weather=c_script.epwPath)  # -> DryBulbTemperature, RelativeHumidity, WindSpeed, WindDirection
mrt = MRT(Surfaces=surface.Surface, Sensors=sensors.Sensors, EPW=c_script.epwPath, Run=Button(), Engine="Native")  # -> Points, MRT, SkyDome, Probes
panel_2 = Panel(branch)
item = ListItem(List=deweather.WindSpeed, Index=subtraction, Wrap=True)
item_2 = ListItem(List=deweather.WindDirection, Index=subtraction, Wrap=True)
abl = AtmosphericBoundaryLayer(
    WindDirections=item_2,
    WindSpeed=item,
    ReferenceHeight=10,
    RoughnessLengthZ0=1,
    GroundHeight=0,
    TurbulentKEK=0.015,
    TurbulentEpsilonΕ=0.135,
    TurbulentOmegaΩ=100)  # -> BoundaryConditions, WindVectors
windpredict = WindPredictor(
    Points=brepgrid_2.Points,
    Buildings=context,
    Model=mlmodel.FilePath,
    BoundaryConditions=abl.BoundaryConditions,
    PedestrianLevel=1.8,
    FilterMargin=100,
    Palette="jet",
    Interpolate="Smooth",
    Field="Velocity",
    Level="Roof Level",
    SelectionPoints=brepgrid.Points)  # -> X, Y, Values, GridMesh, LegendMesh, LegendPoints, LegendValues, BoundaryConditions, ValuesRoof
mesh = Mesh(windpredict.GridMesh)
vec = Vector(abl.WindVectors)
amp = Amplitude(Vector=vec, Amplitude=windpredict.Values)
vaf = VelocityAmplificationFactorsVAF(BoundaryConditions=abl.BoundaryConditions, WindVelocity=amp, EPW=c_script.epwPath, ProbeHeight=1.8, Interpolate=True)  # -> WindSpeed, VelocityAmplificationFactors
utcisim = UTCISimulation(
    MRT=mrt.MRT,
    WindSpeed=vaf.WindSpeed,
    AirTemperature=deweather.DryBulbTemperature,
    RelativeHumidity=deweather.RelativeHumidity,
    Transpose=True,
    Run=True)  # -> UTCI, ComfortHours, Comfort
branch_2 = TreeBranch(Tree=utcisim.UTCI, Path=subtraction, MaintainPaths=True)
bnd = Bounds(Numbers=branch_2)
pt = Point(Point(46.919285, -64.14896314, 0))
panel_3 = Panel(branch_2)
dedomain = DeconstructDomain(Domain=bnd)  # -> Start, End
cir_3 = Circle(Plane=mrt.Points, Radius=1)
gradient = Gradient(
    LowerLimit=dedomain.Start,
    UpperLimit=dedomain.End,
    Parameter=branch_2,
    stops=[0: RGB(48, 18, 59), 0.0294: RGB(56, 40, 112), 0.0588: RGB(63, 62, 156), 0.0882: RGB(68, 82, 193), 0.118: RGB(70, 102, 221), 0.147: RGB(71, 122, 241)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])
utcilegend = UTCILegend(
    UTCI=branch_2,
    Plane=pt,
    Size=2,
    Mesh=brepgrid.Mesh,
    GroundSurface=srf,
    Offset=5,
    SmoothColors=False,
    CircleRadius=0.75,
    SensorPoints=mrt.Points,
    Scale=2.2)  # -> Colors, Categories, LegendMesh, LabelPoints, Labels, UTCIMesh, CenteredLabels
round = Round(Number=panel_3)  # -> Nearest, Floor, Ceiling
srf_3 = Surface(cir_3)
tag = TextTag(Location=brepgrid.Points, Text=round.Nearest, Colour=ColourSwatch(SwatchColor=RGB(0, 0, 0)))
mesh_2 = Mesh(utcilegend.UTCIMesh)
preview_2 = CustomPreview(Geometry=srf_3, Material=utcilegend.Colors)
mesh_3 = Mesh(utcilegend.LegendMesh)
tag_2 = TextTag3D(
    Location=utcilegend.LabelPoints,
    Text=utcilegend.Labels,
    Size=1,
    Colour=ColourSwatch(SwatchColor=RGB(0, 0, 0)),
    Justification=8)
