# Grasshopper definition 4_AnnualWindAnalysis.ghx (Grasshopper 1.0.8)
# plug-ins: Eddy3D

select = SelectTemplate()
select_2 = SelectTemplate()
# 1. Geometry &
# Boundary Conditions
panel = Panel("""0
45
90
135
180
225
270
315""")
panel_2 = Panel("""5
6
4
3
5
4
6
5""")
panel_3 = Panel("https://energyplus-weather.s3.amazonaws.com/asia_wmo_region_2/IND/IND_Ahmedabad.426470_IWEC/IND_Ahmedabad.426470_IWEC.epw")

abl = ABLFlow(WindDirections=panel, ReferenceVelocity=panel_2, ReferenceHeight="10", WeatherFile=panel_3)

buildings = Geometry([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])

# ----
# 2. Simulation Domain
domcyl = CylindricalDomain(
    Buildings=buildings,
    BoundaryCondition=abl,
    CellSize="20",
    RadialMultiplier=Slider(1, range=0..1),
    XDivisions=Slider(2, range=0..10))  # -> Domain, PreviewMesh

# ----
# 3. Mesh & Simulation
panel_4 = Panel("4_AnnualWindAnalysis")
rset = RunSettings(
    Iterations="400",
    WriteInterval=20,
    TimestepsToKeep=3,
    TurbulenceModel=2,
    RelaxationFactors=3,
    NumericalSchemes=1,
    PotentialFlowInit=False,
    AgeOfAir=False,
    CPUCores=-1,
    StabilityLimiter=False,
    DebugDiagnostics=False,
    SIMPLEC=False)
mset = MeshSettings(
    BuildingMinLevel=2,
    BuildingMaxLevel=3,
    FeatureLevel=2,
    BoundingBoxLevel=0,
    GroundLevel=2,
    BoundaryLayers=4,
    CellsBetweenLevels=5,
    MeshMode=1,
    Preset=0)
windsim = WindSimulation(
    SimulationDomain=domcyl.Domain,
    WorkingDirectory=panel_4,
    MeshSettings=mset,
    RunSettings=rset,
    RunMeshing=Button(),
    MakeTrees=False,
    RunSimulation=Button(),
    SelectedEngine=1)  # -> SimulationResult, MeshDone, SimDone, MeshRemainingTime, SimulationRemainingTime

reslive = LiveResiduals(Result=windsim.SimulationResult, Live=True, WindDirection=-1)
panel_5 = Panel(windsim.MeshDone)
panel_6 = Panel(windsim.MeshRemainingTime)
panel_7 = Panel(windsim.SimDone)
panel_8 = Panel(windsim.SimulationRemainingTime)
pt = Point([Point(-149.4596252, -8.845352173, 2), Point(-149.4596252, -5.845352173, 2), Point(-149.4596252, -2.845352173, 2), Point(-149.4596252, 0.1546478271, 2), Point(-149.4596252, 3.154647827, 2), Point(-149.4596252, 6.154647827, 2)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])

# ----
# 4. Probing points & probing
panel_9 = Panel("ttt")
probing = Probing(
    Result=windsim.SimulationResult,
    ProbingPoints=pt,
    NameOfInstance=panel_9,
    InterpolationScheme=3,
    NameOfField=0,
    Run=Button())  # -> ProbingPoints, ProbingResult

# ----
# 6. Clean
button = Button()
clean = CleanDirectories(ResultDirectory=windsim.SimulationResult, Mode=2, Run=button)

# ----
# 5. Post-processing
# 5.1. Paraview
# 5.2. Grasshopper
# Multi-directional / annual wind vectors
# Set to -1 for average of entire year (takes 30 s to compute)
dir = Slider(6, range=0..7)
vectors = Data(probing.ProbingResult)
points = Data(probing.ProbingPoints)
paraview = Paraview(Result=windsim.SimulationResult, Run=Button())
choose_dir = TreeBranch(Tree=vectors, Path=dir, MaintainPaths=True)
wind_factors = WindFactors(Result=windsim.SimulationResult, ProbingPoints=points, WindVelocity=vectors, Run=Button(), Interpolation=True)  # -> WindFactorsSpatial, WindFactorsAnnual
cluster = Cluster(data=choose_dir)  # -> S, E, data_3
gradient = Gradient(
    LowerLimit=cluster.S,
    UpperLimit=cluster.E,
    Parameter=cluster.data_3,
    stops=[0.103: RGB(0, 0, 255), 0.22: RGB(0, 170, 255), 0.305: RGB(0, 255, 255), 0.398: RGB(0, 255, 188), 0.504: RGB(0, 255, 106), 0.605: RGB(91, 255, 0), 0.699: RGB(184, 255, 0), 0.799: RGB(255, 255, 0), 0.898: RGB(255, 170, 0)])
dedata = DeconstructDataObjects(Data=wind_factors.WindFactorsAnnual, Select=Slider(1, range=0..10))
flip = FlipMatrix(Data=dedata)
vdisex = VectorDisplayEx(Point=points, Vector=choose_dir, Colour=gradient, Width=Slider(3, range=0..10))
avr = Average(Input=flip)  # -> flatten(ArithmeticMean)
cluster_2 = Cluster(data=avr)  # -> S, E, data_3
cluster_3 = Cluster_3(C=points, T=Vector(0, 0, 10))
gradient_2 = Gradient(
    LowerLimit=cluster_2.S,
    UpperLimit=cluster_2.E,
    Parameter=cluster_2.data_3,
    stops=[0.103: RGB(0, 0, 255), 0.22: RGB(0, 170, 255), 0.305: RGB(0, 255, 255), 0.398: RGB(0, 255, 188), 0.504: RGB(0, 255, 106), 0.605: RGB(91, 255, 0), 0.699: RGB(184, 255, 0), 0.799: RGB(255, 255, 0), 0.898: RGB(255, 170, 0)])
preview = CustomPreview(Geometry=cluster_3, Material=gradient_2)

pedestrian_wind_comfort = PedestrianWindComfort(
    WindFactorsSpatial=wind_factors.WindFactorsSpatial,
    WindFactorsAnnual=wind_factors.WindFactorsAnnual,
    WindComfortMetric=4,
    Weibull_Fit=True)  # -> WindComfortRank, WindComfortClassLetter, WindComfortClass
cir = Circle(Plane=probing.ProbingPoints, Radius=1)
srf = Surface(cir)

# ----
# Wind Comfort Metrics
cluster_4 = Cluster(data=pedestrian_wind_comfort.WindComfortRank)  # -> S, E, data_3
gradient_3 = Gradient(
    LowerLimit=cluster_4.S,
    UpperLimit=cluster_4.E,
    Parameter=cluster_4.data_3,
    stops=[0.103: RGB(0, 0, 255), 0.22: RGB(0, 170, 255), 0.305: RGB(0, 255, 255), 0.398: RGB(0, 255, 188), 0.504: RGB(0, 255, 106), 0.605: RGB(91, 255, 0), 0.699: RGB(184, 255, 0), 0.799: RGB(255, 255, 0), 0.898: RGB(255, 170, 0)])
tag = TextTag(Location=probing.ProbingPoints, Text=pedestrian_wind_comfort.WindComfortClassLetter)
preview_2 = CustomPreview(Geometry=srf, Material=gradient_3)

# ==== cluster Cluster
data = ClusterInput()
data_2 = Data(data)
data_3 = ClusterOutput(data_2)
bnd = Bounds(Numbers=data_2)
dedomain = DeconstructDomain(Domain=bnd)  # -> Start, End
S = ClusterOutput(dedomain.Start)
E = ClusterOutput(dedomain.End)

# ==== cluster Cluster_3
C = ClusterInput()
cluster = Cluster_2(C=C)
T = ClusterInput()
move = Move(Geometry=cluster, Motion=T)  # -> Geometry, Transform
srf = ClusterOutput(cluster)

# ==== cluster Cluster_2
C = ClusterInput()
circle = CircleCNR(Center=C, Normal=Vector(0, 0, 1), Radius=2)
srf = Surface(circle)
srf_2 = ClusterOutput(srf)
