# Grasshopper definition 99_SurfaceTempTest_GrassVsConcrete.ghx (Grasshopper 1.0.8)
# plug-ins: Eddy3D, LunchBox

install = InstallEngines(InstallEnergyPlus=False, InstallRadiance=Button(), InstallBlueCFD=False, InstallFluidX3D=False)
panel = Panel("https://energyplus-weather.s3.amazonaws.com/asia_wmo_region_2/IND/IND_Ahmedabad.426470_IWEC/IND_Ahmedabad.426470_IWEC.epw")
number_slider = Slider(0.3, range=0..1)
number_slider_2 = Slider(1, range=0..1)
material_name = Panel("ConcreteBld")
material_name_2 = Panel("ConcreteSrf")
surfset = SurfaceSettings(
    Name=material_name_2,
    Thickness=Slider(0.5, range=0..1),
    Conductivity=Slider(1.13, range=0..10),
    Density=Slider(2400, range=0..10000),
    SpecificHeat=Slider(1000, range=0..10000),
    ThermalAbsorptance=0.9,
    SolarAbsorptance=Slider(0.8, range=0..1),
    VisibleAbsorptance=0.7)
surfset_2 = SurfaceSettings(
    Name=material_name,
    Thickness=Slider(0.1, range=0..1),
    Conductivity=Slider(0.5, range=0..10),
    Density=Slider(689, range=0..10000),
    SpecificHeat=Slider(1000, range=0..10000),
    ThermalAbsorptance=0.9,
    SolarAbsorptance=Slider(0.78, range=0..1),
    VisibleAbsorptance=0.7)
working_directory_path = Panel("C:\Users\rmermelstein\Desktop\remyeddytest2")

# ---- group: Simulation Settings
toggle = BooleanToggle(True)
toggle_2 = BooleanToggle(True)
toggle_3 = BooleanToggle(True)

# ----
vegset = VegetationSettings(
    Name="grass",
    HeightPlants=0.5,
    LeafAreaIndex=5,
    LeafReflectivity=0.2,
    LeafEmissivity=0.95,
    MinimumStomatalResistance=180)
brep = Brep([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])
brep_2 = Brep(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)

# ---- group: Setup Probes
probing_point = Point([Point(30.08176527, 5, 1.7), Point(5, 5, 1.7), Point(5, 2.042361432, 1.7), Point(30.08176527, 2.042361432, 1.7), Point(30.08176527, 3.55540691, 1.7), Point(5, 3.55540691, 1.7)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])
sen = Sensor(Point=probing_point, Normal=Vector(0, 0, 1))

# ----
brep_3 = Brep([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])
brep_4 = Brep(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)
run_sim = Button()
weather_file_path = FilePath(panel)
set = Settings(
    ComputeReflectionsAndDiffuseRadiation=toggle,
    CummulativeViewFactorCutoffPercentile=Slider(0.1, range=0..0.1),
    ComputeSurfaceTemperatureEnergyPlus=toggle_2,
    ComputeLongWaveExchangeEnergyPlus=toggle_3,
    WindScaling=1)
tree = Tree(Geometry=brep_3, PatchSize=number_slider_2, TemperatureType=0)
ground = GroundSurface(Geometry=brep_4, PatchSize=number_slider_2, TempSource=0)
radsurf = RadiationSurface(Geometry=brep, PatchSize=number_slider_2, TempSource=0)
vegsurf = VegetationSurface(Geometry=brep_2, PatchSize=number_slider_2, TemperatureType=0)
mrt = MRTSystem(
    WorkingDirectory="/Users/patrickkastner/Desktop/Temp/MRTTest",
    WeatherFile=weather_file_path,
    Surfaces=[vegsurf, radsurf, ground, tree],
    Sensors=sen,
    Run=Toggle(True))  # -> System, Result, Settings
load = BooleanToggle(True)
loadmrt = LoadMRT(FilePath=mrt.Result, Load=load)  # -> Result, Probes, Polygons

# ---- group: Specific Day
hoy = HourOfYear(Month=Slider(8, range=0..12), Day=Slider(19, range=1..31), Hour=Slider(13, range=0..23))

# ----
inpoly = InspectPolygon(Polygon=loadmrt.Polygons, Metric=1, Index=hoy, type="Hour")  # -> Point, Mesh, Data
insen = InspectSensor(Sensor=loadmrt.Probes, Metric=2, Index=hoy, type="Hour")  # -> Point, Mesh, Data
visualize_data_tags = TextTag(Location=insen.Point, Text=insen.Data)
meshnurbs = MeshToNurbs(Mesh=inpoly.Mesh)  # -> flatten(QuadrangularSurfaces), TriangularSurfaces

# ----
# Inspect Surface Temperatures
bnd = Bounds(Numbers=inpoly.Data)
dedomain = DeconstructDomain(Domain=bnd)  # -> Start, End
low_bound_reference = Panel(dedomain.Start)
high_bound_reference = Panel(dedomain.End)
gradient = Gradient(
    LowerLimit=low_bound_reference,
    UpperLimit=high_bound_reference,
    Parameter=inpoly.Data,
    stops=[0: RGB(0, 0, 64), 0.25: RGB(173, 203, 249), 0.5: RGB(255, 255, 192), 0.75: RGB(234, 126, 0), 1: RGB(139, 0, 0)])
visualize_data_tags_2 = TextTag(Location=inpoly.Point, Text=inpoly.Data, Colour=gradient)
vizualize_data = CustomPreview(Geometry=meshnurbs.QuadrangularSurfaces, Material=gradient)
