# Grasshopper definition ABL_Verification.ghx (Grasshopper 1.0.8)
# plug-ins: Outdoor, Eddy3D

pt = ConstructPoint(XCoordinate=40, YCoordinate=30, ZCoordinate=0)
pt_2 = ConstructPoint(XCoordinate=80, YCoordinate=50, ZCoordinate=20)
pt_3 = ConstructPoint(XCoordinate=40, YCoordinate=70, ZCoordinate=0)
pt_4 = ConstructPoint(XCoordinate=80, YCoordinate=90, ZCoordinate=20)
box_domain = BoxDomain(
    CellSize="5",
    FrontExtension=-1,
    BackExtension=-1,
    SideExtension=-1,
    TopExtension=-1,
    RefinementBoxExtension=-1,
    WakeRefinement=3)
mesh_settings = MeshSettings(
    RefinementBoxLevel=2,
    BuildingSurfaceLevel=2,
    BuildingFeatureLevel=2,
    GroundSurfaceLevel=3,
    LayerCount=4,
    AddLayers=False,
    Snap=True,
    GradingStrengthHorizontal="25",
    GradingStrengthVertical="25",
    AdaptiveGrading=True)
atmospheric_boundary_layer = AtmosphericBoundaryLayer(
    ReferenceHeight=10,
    RoughnessLengthZ0=1,
    GroundHeight=0,
    TurbulentKEK=0.015,
    TurbulentEpsilonΕ=0.135,
    TurbulentOmegaΩ=100,
    TerrainType="Custom (z0 input)",
    AblOutputLayoutVersion=2)  # -> BoundaryConditions, WindVectors
run_settings = RunSettings(
    Iterations=400,
    WriteInterval=20,
    KeepTimeSteps=3,
    TurbulenceModel="realizableKE",
    CPUCount="12",
    SolverAlgorithm="SIMPLE",
    AgeOfAir=False,
    Robustness="4",
    PotentialFoamInit=True,
    WarmUpIterations=-1,
    FieldMonitors=False,
    PedestrianAverage=False,
    Convergence_2=0.0001,
    AutoStopOnPlateau=False,
    Duration=-1,
    TimeStep=-1,
    MaxCourant=-1,
    AveragingWindow=-1)  # -> RunSettings, DebugLogs
box = Box2Pt(PointA=pt, PointB=pt_2, Plane=PlaneXY(0, 0, 0))
box_2 = Box2Pt(PointA=pt_3, PointB=pt_4, Plane=PlaneXY(0, 0, 0))
merge = Merge(Data1=box, Data2=box_2)
outdoor_case = OutdoorCase(
    BoundaryConditions=atmospheric_boundary_layer.BoundaryConditions,
    DomainParameters=box_domain,
    Buildings=merge,
    MeshSettings=mesh_settings,
    RunSettings=run_settings.RunSettings,
    Write=False,
    ClearCase=False,
    AutoName="merry-lemur-dune-quill",
    OutdoorCaseInputLayoutVersion=3,
    PreviewBuildings=False,
    PreviewDimensions=True,
    PreviewGrid3D=False,
    PreviewGroundGrid=True,
    PreviewRefinementBox=True,
    PreviewWindArrows=True)  # -> Logs, WriteLogs, Case, Domain, RefinementBox, Buildings
plot_residuals = PlotResiduals(Case=outdoor_case.Case, Plot=False, ResidualViewerTarget=0)
live_residuals = LiveResiduals(Case=outdoor_case.Case, Live=True, DirectionDegrees=-1)
meshing_progress = MeshingProgress(Case=outdoor_case.Case, Live=True)  # -> Progress, Phase, Done, Status
panel = Panel([meshing_progress.Progress, meshing_progress.Phase, meshing_progress.Status, meshing_progress.Done])
open_in_paraview = OpenInParaView(Case=outdoor_case.Case, Open=False, ComfortMetric=1, DirectionIndex=-1)
run = Run(
    Case=outdoor_case.Case,
    Mesh=False,
    Simulate=False,
    RunAll=False,
    Parallel=True,
    Engine="Docker",
    DirectionIndex=-1,
    ShowZones=False)
parse_case_logs = ParseCaseLogs(Case=outdoor_case.Case, Run=False)  # -> LogSummary, Errors, Warnings
panel_2 = Panel([parse_case_logs.LogSummary, parse_case_logs.Errors, parse_case_logs.Warnings])
series = Series(Start=2.5, Step=5, Count=16)
# POLLUTANT CANYON
# Street-canyon dispersion. Units: METERS.
# Built on the shipped BoxDomain workflow.
# 
# GEOMETRY, from TestPollutantCanyonContainerE2E:
# two building blocks (40,30,0)-(80,50,20) and
# (40,70,0)-(80,90,20), leaving a canyon along X
# between y=50 and y=70. Base cell size 5 m, to
# match the fixture's 120 x 120 x 40 m blockMesh
# over 24 x 24 x 8 cells.
# 
# POLLUTANT SOURCE volume (40,52,0)-(55,68,10),
# species "exhaust", 0.01 kg/s. The volume is
# deliberately many cells across - a box near the
# cell size is exactly how a topoSet zone comes
# out empty.
# 
# PROBE RAKE on the canyon centreline at
# pedestrian height, wind along +X:
#   (25, 60, 2)   upwind   - must stay near 0
#   (47.5, 60, 2) in-source - carries the emission
#   (75, 60, 2)   downwind - diluted, above upwind
# Probe Field is set to "exhaust", so it reads the
# tracer concentration (kg/m3), not velocity.
# 
# Run Settings Iterations = 80, the fixture's
# short-run count.
# 
# PRUNED from BoxDomain: the sample Tree branch,
# the sample building geometry, the 6208-point
# sample probe cloud, and the Wind Field Viewer /
# Wind Legend / Streamlines branch that read it.
# That cloud is another site's, and it shipped
# with a stale cached result (341 velocities for
# 6208 points) that showed as an orange component.
# 
# Action toggles ship OFF. Order: Outdoor Case >
# Write, Run > Mesh, Run > Create Zones,
# Run > Simulate.
pt_5 = ConstructPoint(XCoordinate=0, YCoordinate=60, ZCoordinate=series)
pt_6 = ConstructPoint(XCoordinate=40, YCoordinate=60, ZCoordinate=series)
merge_2 = Merge(Data1=pt_5, Data2=pt_6)
# ABL APPROACH-FLOW VERIFICATION
# ASCE/SEI CWE Prestandard PO 4-1 / AC 4-1.
# Units: METERS.
# 
# WHAT THIS CHECKS: does the atmospheric boundary
# layer imposed at the inlet still exist by the
# time it reaches the buildings? Every wind study
# assumes it does; the Prestandard makes checking
# it a required step before the building run.
# 
# TWO VERTICAL RAKES on the canyon centreline
# (y = 60), 16 points each from Series:
# 2.5 m to 77.5 m in 5 m steps.
#   x = 0   the approach flow near the inlet
#   x = 40  the upwind face of the buildings
# Compare the two profiles. Probe Field is "U".
# That series contains all six heights the fixture
# rakes (2.5 / 7.5 / 17.5 / 32.5 / 52.5 / 77.5),
# which are cell centres of ITS 5 m z-mesh.
# 
# ABL: 5 m/s at 10 m reference height, z0 = 1 m -
# the three numbers TestAblSelfSustainmentContainer
# E2E writes its analytic log law against.
# Iterations 400, the fixture's count.
# 
# *** SCOPE LIMIT - READ THIS ***
# The Prestandard asks for an EMPTY domain. That
# cannot be built here: OutdoorCaseCMP returns
# early with "Connect at least one closed building
# mesh to the Buildings input", so no Case object
# is produced without geometry. This template
# therefore rakes the REAL domain, which answers
# "has the profile decayed by the building
# position" but not the standard's empty-domain
# form.
# 
# The fixture's own stations (y = 5 / 105 / 195 in
# a 100 x 200 x 100 m empty box) belong to that
# empty domain and do not transfer to this site.
# 
# A decay here is EXPECTED, not a bug: the log-law
# ABL solves OpenFOAM's epsilon equation only at
# sigmaEps = 1.1674, and stock kEpsilon runs 1.3.
# The point is to see how big it is.
# 
# Automating the AC 5-9 error integral
# (eps_ABL-U <= 0.1) is feature F2 in
# docs/ASCE-CWE-PRESTANDARD-COMPLIANCE.md and does
# not ship. Nothing here computes it.
# 
# Action toggles ship OFF.
probe = Probe(
    Case=outdoor_case.Case,
    Points=merge_2,
    Field="U",
    Run=False,
    AutoProbeName="polite-octopus-glade-needle",
    BakeTimeHistory=False,
    CullHugeVectors=True,
    CullInvalid=True,
    ShowRegion=False)  # -> Values, TimeSteps, SubResults
