# Grasshopper definition Cluster_SLURM.ghx (Grasshopper 1.0.8)
# plug-ins: Outdoor, Eddy3D

pt = ConstructPoint(XCoordinate=40, YCoordinate=30, ZCoordinate=0)
pt_2 = ConstructPoint(XCoordinate=80, YCoordinate=50, ZCoordinate=20)
pt_3 = ConstructPoint(XCoordinate=40, YCoordinate=70, ZCoordinate=0)
pt_4 = ConstructPoint(XCoordinate=80, YCoordinate=90, ZCoordinate=20)
box_domain = BoxDomain(
    CellSize="5",
    FrontExtension=-1,
    BackExtension=-1,
    SideExtension=-1,
    TopExtension=-1,
    RefinementBoxExtension=-1,
    WakeRefinement=3)
mesh_settings = MeshSettings(
    RefinementBoxLevel=2,
    BuildingSurfaceLevel=2,
    BuildingFeatureLevel=2,
    GroundSurfaceLevel=3,
    LayerCount=4,
    AddLayers=False,
    Snap=True,
    GradingStrengthHorizontal="25",
    GradingStrengthVertical="25",
    AdaptiveGrading=True)
atmospheric_boundary_layer = AtmosphericBoundaryLayer(
    ReferenceHeight=10,
    RoughnessLengthZ0=1,
    GroundHeight=0,
    TurbulentKEK=0.015,
    TurbulentEpsilonΕ=0.135,
    TurbulentOmegaΩ=100,
    TerrainType="Custom (z0 input)",
    AblOutputLayoutVersion=2)  # -> BoundaryConditions, WindVectors
run_settings = RunSettings(
    Iterations=400,
    WriteInterval=20,
    KeepTimeSteps=3,
    TurbulenceModel="realizableKE",
    CPUCount="12",
    SolverAlgorithm="SIMPLE",
    AgeOfAir=False,
    Robustness="4",
    PotentialFoamInit=True,
    WarmUpIterations=-1,
    FieldMonitors=False,
    PedestrianAverage=False,
    Convergence_2=0.0001,
    AutoStopOnPlateau=False,
    Duration=-1,
    TimeStep=-1,
    MaxCourant=-1,
    AveragingWindow=-1)  # -> RunSettings, DebugLogs
box = Box2Pt(PointA=pt, PointB=pt_2, Plane=PlaneXY(0, 0, 0))
box_2 = Box2Pt(PointA=pt_3, PointB=pt_4, Plane=PlaneXY(0, 0, 0))
merge = Merge(Data1=box, Data2=box_2)
outdoor_case = OutdoorCase(
    BoundaryConditions=atmospheric_boundary_layer.BoundaryConditions,
    DomainParameters=box_domain,
    Buildings=merge,
    MeshSettings=mesh_settings,
    RunSettings=run_settings.RunSettings,
    Write=False,
    ClearCase=False,
    AutoName="merry-lemur-dune-quill",
    OutdoorCaseInputLayoutVersion=3,
    PreviewBuildings=False,
    PreviewDimensions=True,
    PreviewGrid3D=False,
    PreviewGroundGrid=True,
    PreviewRefinementBox=True,
    PreviewWindArrows=True)  # -> Logs, WriteLogs, Case, Domain, RefinementBox, Buildings
plot_residuals = PlotResiduals(Case=outdoor_case.Case, Plot=False, ResidualViewerTarget=0)
live_residuals = LiveResiduals(Case=outdoor_case.Case, Live=True, DirectionDegrees=-1)
meshing_progress = MeshingProgress(Case=outdoor_case.Case, Live=True)  # -> Progress, Phase, Done, Status
panel = Panel([meshing_progress.Progress, meshing_progress.Phase, meshing_progress.Status, meshing_progress.Done])
open_in_paraview = OpenInParaView(Case=outdoor_case.Case, Open=False, ComfortMetric=1, DirectionIndex=-1)
run = Run(
    Case=outdoor_case.Case,
    Mesh=False,
    Simulate=False,
    RunAll=False,
    Parallel=True,
    Engine="Docker",
    DirectionIndex=-1,
    ShowZones=False)
parse_case_logs = ParseCaseLogs(Case=outdoor_case.Case, Run=False)  # -> LogSummary, Errors, Warnings
# CLUSTER / SLURM
# Build a wind study locally, run it on an HPC
# cluster. Units: METERS.
# 
# WORKFLOW
# 1. Outdoor Case > Write   (writes the case)
# 2. SLURM Runner           (writes sbatch files
#    into the case folder)
# 3. Copy the case folder to the cluster and
#    sbatch the generated job script.
# The local Run component is NOT used for the
# cluster path - it is left here for a local
# smoke test before you queue the real job.
# 
# PANELS YOU MUST EDIT before this is useful.
# They ship as CHANGE-ME placeholders on purpose,
# so an unedited template cannot submit a job to
# somebody else's account:
#   Charge Account
#   Notification Email
# Memory per CPU 10 GB and Job duration 10 h are
# the component defaults. The OpenFOAM load
# command stays at the component default
# "module load openfoam-org/12" - change it to
# whatever your cluster's module is named.
# 
# STL EXPORTER exports the Outdoor Case's own
# Buildings output - the meshed geometry the case
# was actually built from - as a standalone .stl,
# Binary mode. That is the headless hand-off: a
# form the CLI and the cluster consume without
# Rhino. TestEddy3DCliE2E covers the headless
# case-build half of this path.
# 
# *** THE FILE PATH PANEL IS DELIBERATELY EMPTY.
# STL Exporter has no run toggle: it writes the
# moment it has a valid path, so any path baked
# into a template would write a file just from
# opening the document. Type your own path in to
# arm it. ***
# 
# Geometry here is the canyon pair from the
# Pollutant Canyon template - replace it with your
# own site.
# 
# Action toggles ship OFF.
panel_2 = Panel("CHANGE-ME-charge-account")
panel_3 = Panel([parse_case_logs.LogSummary, parse_case_logs.Errors, parse_case_logs.Warnings])
# POLLUTANT CANYON
# Street-canyon dispersion. Units: METERS.
# Built on the shipped BoxDomain workflow.
# 
# GEOMETRY, from TestPollutantCanyonContainerE2E:
# two building blocks (40,30,0)-(80,50,20) and
# (40,70,0)-(80,90,20), leaving a canyon along X
# between y=50 and y=70. Base cell size 5 m, to
# match the fixture's 120 x 120 x 40 m blockMesh
# over 24 x 24 x 8 cells.
# 
# POLLUTANT SOURCE volume (40,52,0)-(55,68,10),
# species "exhaust", 0.01 kg/s. The volume is
# deliberately many cells across - a box near the
# cell size is exactly how a topoSet zone comes
# out empty.
# 
# PROBE RAKE on the canyon centreline at
# pedestrian height, wind along +X:
#   (25, 60, 2)   upwind   - must stay near 0
#   (47.5, 60, 2) in-source - carries the emission
#   (75, 60, 2)   downwind - diluted, above upwind
# Probe Field is set to "exhaust", so it reads the
# tracer concentration (kg/m3), not velocity.
# 
# Run Settings Iterations = 80, the fixture's
# short-run count.
# 
# PRUNED from BoxDomain: the sample Tree branch,
# the sample building geometry, the 6208-point
# sample probe cloud, and the Wind Field Viewer /
# Wind Legend / Streamlines branch that read it.
# That cloud is another site's, and it shipped
# with a stale cached result (341 velocities for
# 6208 points) that showed as an orange component.
# 
# Action toggles ship OFF. Order: Outdoor Case >
# Write, Run > Mesh, Run > Create Zones,
# Run > Simulate.
slurm = SLURMRunner(
    Case=outdoor_case.Case,
    ChargeAccount=panel_2,
    NotificationEmail="CHANGE-ME@your-institution.edu",
    MemoryPerCPU=10,
    JobDuration=10,
    OpenFOAMLoadCommand="module load openfoam-org/12")
stl = STLExporter(Geometry=outdoor_case.Buildings, Mode=0, EdgeLength=0)
