# Grasshopper definition Facade_Pressure.ghx (Grasshopper 1.0.8)
# plug-ins: Outdoor, Eddy3D, Eddy3D-Radiance, Eddy3D-Indoor

pt = ConstructPoint(XCoordinate=40, YCoordinate=30, ZCoordinate=0)
pt_2 = ConstructPoint(XCoordinate=80, YCoordinate=50, ZCoordinate=20)
pt_3 = ConstructPoint(XCoordinate=40, YCoordinate=70, ZCoordinate=0)
pt_4 = ConstructPoint(XCoordinate=80, YCoordinate=90, ZCoordinate=20)
box_domain = BoxDomain(
    CellSize="5",
    FrontExtension=-1,
    BackExtension=-1,
    SideExtension=-1,
    TopExtension=-1,
    RefinementBoxExtension=-1,
    WakeRefinement=3)
mesh_settings = MeshSettings(
    RefinementBoxLevel=2,
    BuildingSurfaceLevel=2,
    BuildingFeatureLevel=2,
    GroundSurfaceLevel=3,
    LayerCount=4,
    AddLayers=False,
    Snap=True,
    GradingStrengthHorizontal="25",
    GradingStrengthVertical="25",
    AdaptiveGrading=True)
atmospheric_boundary_layer = AtmosphericBoundaryLayer(
    ReferenceHeight=10,
    RoughnessLengthZ0=1,
    GroundHeight=0,
    TurbulentKEK=0.015,
    TurbulentEpsilonΕ=0.135,
    TurbulentOmegaΩ=100,
    TerrainType="Custom (z0 input)",
    AblOutputLayoutVersion=2)  # -> BoundaryConditions, WindVectors
run_settings = RunSettings(
    Iterations=400,
    WriteInterval=20,
    KeepTimeSteps=3,
    TurbulenceModel="realizableKE",
    CPUCount="12",
    SolverAlgorithm="SIMPLE",
    AgeOfAir=False,
    Robustness="4",
    PotentialFoamInit=True,
    WarmUpIterations=-1,
    FieldMonitors=False,
    PedestrianAverage=False,
    Convergence_2=0.0001,
    AutoStopOnPlateau=False,
    Duration=-1,
    TimeStep=-1,
    MaxCourant=-1,
    AveragingWindow=-1)  # -> RunSettings, DebugLogs
box = Box2Pt(PointA=pt, PointB=pt_2, Plane=PlaneXY(0, 0, 0))
box_2 = Box2Pt(PointA=pt_3, PointB=pt_4, Plane=PlaneXY(0, 0, 0))
merge = Merge(Data1=box, Data2=box_2)
outdoor_case = OutdoorCase(
    BoundaryConditions=atmospheric_boundary_layer.BoundaryConditions,
    DomainParameters=box_domain,
    Buildings=merge,
    MeshSettings=mesh_settings,
    RunSettings=run_settings.RunSettings,
    Write=False,
    ClearCase=False,
    AutoName="merry-lemur-dune-quill",
    OutdoorCaseInputLayoutVersion=3,
    PreviewBuildings=False,
    PreviewDimensions=True,
    PreviewGrid3D=False,
    PreviewGroundGrid=True,
    PreviewRefinementBox=True,
    PreviewWindArrows=True)  # -> Logs, WriteLogs, Case, Domain, RefinementBox, Buildings
plot_residuals = PlotResiduals(Case=outdoor_case.Case, Plot=False, ResidualViewerTarget=0)
live_residuals = LiveResiduals(Case=outdoor_case.Case, Live=True, DirectionDegrees=-1)
meshing_progress = MeshingProgress(Case=outdoor_case.Case, Live=True)  # -> Progress, Phase, Done, Status
panel = Panel([meshing_progress.Progress, meshing_progress.Phase, meshing_progress.Status, meshing_progress.Done])
open_in_paraview = OpenInParaView(Case=outdoor_case.Case, Open=False, ComfortMetric=1, DirectionIndex=-1)
run = Run(
    Case=outdoor_case.Case,
    Mesh=False,
    Simulate=False,
    RunAll=False,
    Parallel=True,
    Engine="Docker",
    DirectionIndex=-1,
    ShowZones=False)
parse_case_logs = ParseCaseLogs(Case=outdoor_case.Case, Run=False)  # -> LogSummary, Errors, Warnings
panel_2 = Panel([parse_case_logs.LogSummary, parse_case_logs.Errors, parse_case_logs.Warnings])
fwp = FacadeWindPressure(
    BasicWindSpeed=25,
    Height=10,
    BuildingHeight=20,
    BuildingDepth=40,
    OpeningArea=1.5,
    Zone=3,
    Terrain=3,
    FacadeZone="Custom (Zone input)",
    TerrainCategory="Custom (Terrain input)")  # -> Pressure, Cpe, PeakPressure, MeanWind, Turbulence
facgrid = FacadeGrid(Geometry=outdoor_case.Buildings, Spacing=1, Offset=0.05, MaxTilt=45, Flip=False)  # -> Points, Normals, Areas, Grid, Report
# POLLUTANT CANYON
# Street-canyon dispersion. Units: METERS.
# Built on the shipped BoxDomain workflow.
# 
# GEOMETRY, from TestPollutantCanyonContainerE2E:
# two building blocks (40,30,0)-(80,50,20) and
# (40,70,0)-(80,90,20), leaving a canyon along X
# between y=50 and y=70. Base cell size 5 m, to
# match the fixture's 120 x 120 x 40 m blockMesh
# over 24 x 24 x 8 cells.
# 
# POLLUTANT SOURCE volume (40,52,0)-(55,68,10),
# species "exhaust", 0.01 kg/s. The volume is
# deliberately many cells across - a box near the
# cell size is exactly how a topoSet zone comes
# out empty.
# 
# PROBE RAKE on the canyon centreline at
# pedestrian height, wind along +X:
#   (25, 60, 2)   upwind   - must stay near 0
#   (47.5, 60, 2) in-source - carries the emission
#   (75, 60, 2)   downwind - diluted, above upwind
# Probe Field is set to "exhaust", so it reads the
# tracer concentration (kg/m3), not velocity.
# 
# Run Settings Iterations = 80, the fixture's
# short-run count.
# 
# PRUNED from BoxDomain: the sample Tree branch,
# the sample building geometry, the 6208-point
# sample probe cloud, and the Wind Field Viewer /
# Wind Legend / Streamlines branch that read it.
# That cloud is another site's, and it shipped
# with a stale cached result (341 velocities for
# 6208 points) that showed as an orange component.
# 
# Action toggles ship OFF. Order: Outdoor Case >
# Write, Run > Mesh, Run > Create Zones,
# Run > Simulate.
probe = Probe(
    Case=outdoor_case.Case,
    Points=facgrid.Points,
    Field="Cp",
    Run=False,
    AutoProbeName="keen-lynx-reef-prism",
    BakeTimeHistory=False,
    CullHugeVectors=True,
    CullInvalid=True,
    ShowRegion=False)  # -> Values, TimeSteps, SubResults
# FACADE PRESSURE
# Wind-driven facade Cp, and the EnergyPlus
# AirflowNetwork hand-off. Units: METERS.
# 
# CHAIN
# Outdoor Case > Buildings (the meshed geometry)
#   -> Facade Grid    1 m spacing, 0.05 m offset,
#      Max Tilt 45 so only near-vertical faces
#      count as facade (90 would include roofs and
#      ground). Flip off.
#   -> Probe          Field "Cp", at those points,
#      on the solved case
#   -> Airflow Network Cp
#      writes a WindPressureCoefficientArray, per
#      node WindPressureCoefficientValues and
#      ExternalNode objects as an .idf snippet to
#      merge into a Ladybug Tools AirflowNetwork
#      model. Ground Z 0. Write ships OFF and the
#      File Path is empty, so opening this document
#      cannot write a file.
# The ABL component's Boundary Conditions feed
# Airflow Network Cp so the exported array carries
# the simulated wind directions.
# 
# FACADE WIND PRESSURE sits alongside as the
# analytic EN 1991-1-4 cross-check: basic wind
# 25 m/s, opening at 10 m on a 20 x 40 m building,
# zone D (windward), terrain 3 (suburban). It is
# NOT wired into the CFD chain - it is the
# code-based number you compare the simulated Cp
# against.
# 
# *** TWO THINGS TO KNOW ***
# 1. Probe and Airflow Network Cp show warnings
#    until the case is solved. That is the
#    unsolved state, not a wiring fault: this
#    template deliberately ships no cached results.
# 2. Airflow Network Cp's own help says "Enable
#    Pressure Coefficient in Run Settings". On the
#    installed 1.9.0.827 Run Settings has no such
#    input - it is not in the component's parameter
#    list. Until it appears, the Cp field has to
#    come from whatever your build writes; check
#    the case's function objects before probing.
# 
# Nothing in the shipped catalog used Facade Grid,
# Facade Wind Pressure or Airflow Network Cp before
# this template.
# 
# Action toggles ship OFF.
afncp = AirflowNetworkCp(
    CpValues=probe.Values,
    BoundaryConditions=atmospheric_boundary_layer.BoundaryConditions,
    Points=facgrid.Points,
    GroundZ=0,
    Write=False)  # -> IDF, Path
