# Grasshopper definition Pollutant_Canyon.ghx (Grasshopper 1.0.8)
# plug-ins: Outdoor, Eddy3D

# Description: Purpose: Where a street-level emission goes, and how much reaches pedestrians.
# Fidelity: Engineering - steady RANS with a passive tracer, not validated for this canyon.
# Method: Two 40 x 20 x 20 m blocks form a canyon; Pollutant Source releases 0.01 kg/s of exhaust from a volume inside it.
# Result: Tracer concentration in kg/m3 at three points 2 m above ground along the canyon centreline.
# Needs: Eddy3D Setup > (U)RANS CFD (OpenFOAM). Runtime: minutes.
# Edit: Blocks, source volume and rate, probe points; turn the toggles on.
pt = ConstructPoint(XCoordinate=40, YCoordinate=30, ZCoordinate=0)
pt_2 = ConstructPoint(XCoordinate=80, YCoordinate=50, ZCoordinate=20)
pt_3 = ConstructPoint(XCoordinate=40, YCoordinate=70, ZCoordinate=0)
pt_4 = ConstructPoint(XCoordinate=80, YCoordinate=90, ZCoordinate=20)
pt_5 = ConstructPoint(XCoordinate=40, YCoordinate=52, ZCoordinate=0)
pt_6 = ConstructPoint(XCoordinate=55, YCoordinate=68, ZCoordinate=10)
box_domain = BoxDomain(
    CellSize="25",
    FrontExtension=-1,
    BackExtension=-1,
    SideExtension=-1,
    TopExtension=-1,
    RefinementBoxExtension=-1,
    WakeRefinement=3)
mesh_settings = MeshSettings(
    RefinementBoxLevel=2,
    BuildingSurfaceLevel=2,
    BuildingFeatureLevel=2,
    GroundSurfaceLevel=3,
    LayerCount=4,
    AddLayers=False,
    Snap=True,
    GradingStrengthHorizontal="25",
    GradingStrengthVertical="25",
    AdaptiveGrading=True,
    CellsBetweenLevels=-1)
atmospheric_boundary_layer = AtmosphericBoundaryLayer(
    ReferenceHeight=10,
    RoughnessLengthZ0=1,
    GroundHeight=0,
    TurbulentKEK=0.015,
    TurbulentEpsilonΕ=0.135,
    TurbulentOmegaΩ=100,
    TerrainType="Custom (z0 input)",
    InletProfile="Log law (Richards & Hoxey)",
    DisplacementHeight=0,
    AblOutputLayoutVersion=2)  # -> BoundaryConditions, WindVectors
box = Box2Pt(PointA=pt, PointB=pt_2, Plane=PlaneXY(0, 0, 0))
box_2 = Box2Pt(PointA=pt_3, PointB=pt_4, Plane=PlaneXY(0, 0, 0))
box_3 = Box2Pt(PointA=pt_5, PointB=pt_6, Plane=PlaneXY(0, 0, 0))
run_settings = RunSettings(
    Iterations="1000",
    WriteInterval=20,
    KeepTimeSteps=3,
    TurbulenceModel="realizableKE",
    CPUCount="10",
    SolverAlgorithm="SIMPLE",
    AgeOfAir=False,
    Numerics="0,0.5,0.5",
    PotentialFoamInit=True,
    WarmUpIterations=-1,
    FieldMonitors=False,
    PedestrianAverage=False,
    PressureCoefficient=False,
    Convergence=0.0001,
    AutoStopOnPlateau=False,
    Duration=-1,
    TimeStep=-1,
    MaxCourant=-1,
    AveragingWindow=-1,
    PressureSolver="GAMG",
    LaplacianScheme="auto",
    MeshQualityPreset="auto",
    PedestrianHeight=1.75,
    Guideline="None")  # -> RunSettings, DebugLogs
merge = Merge(Data1=box, Data2=box_2)
pollutant = PollutantSource(Geometry=box_3, Species="exhaust", Rate=0.01, Schmidt=0.7)
outdoor_case = OutdoorCase(
    CaseName="PollutantCanyon",
    BoundaryConditions=atmospheric_boundary_layer.BoundaryConditions,
    DomainParameters=box_domain,
    Buildings=merge,
    MeshSettings=mesh_settings,
    RunSettings=run_settings.RunSettings,
    Sources=pollutant,
    Write=False,
    ClearCase=False,
    AutoName="merry-lemur-dune-quill",
    AutoWrapGeometry=False,
    OutdoorCaseInputLayoutVersion=5,
    PreviewBuildings=False,
    PreviewDimensions=True,
    PreviewGrid3D=False,
    PreviewGroundGrid=True,
    PreviewRefinementBox=True,
    PreviewWindArrows=True,
    RepairGeometry=True)  # -> Logs, WriteLogs, Case, Domain, RefinementBox, Buildings
plot_residuals = PlotResiduals(Case=outdoor_case.Case, Plot=False, ResidualViewerTarget=0)
live_residuals = LiveResiduals(Case=outdoor_case.Case, Live=True, DirectionDegrees=-1)
meshing_progress = MeshingProgress(Case=outdoor_case.Case, Live=True)  # -> Progress, Phase, Done, Status
panel = Panel([meshing_progress.Progress, meshing_progress.Phase, meshing_progress.Status, meshing_progress.Done])
open_in_paraview = OpenInParaView(Case=outdoor_case.Case, Open=False, ComfortMetric=1, DirectionIndex=-1, ParaviewInputLayoutVersion=2, Streamlines=True)
run = Run(
    Case=outdoor_case.Case,
    Mesh=False,
    CreateZones=False,
    Simulate=False,
    RunAll=False,
    Parallel=True,
    DirectionIndex=-1,
    ShowZones=True)
parse_case_logs = ParseCaseLogs(Case=outdoor_case.Case, Run=False)  # -> LogSummary, Errors, Warnings
panel_2 = Panel([parse_case_logs.LogSummary, parse_case_logs.Errors, parse_case_logs.Warnings])
pt_7 = ConstructPoint(XCoordinate=25, YCoordinate=60, ZCoordinate=2)
pt_8 = ConstructPoint(XCoordinate=47.5, YCoordinate=60, ZCoordinate=2)
pt_9 = ConstructPoint(XCoordinate=75, YCoordinate=60, ZCoordinate=2)
merge_2 = Merge(Data1=pt_7, Data2=pt_8)
merge_3 = Merge(Data1=merge_2, Data2=pt_9)
# POLLUTANT CANYON
# Street-canyon dispersion. Units: METERS.
# Built on the shipped BoxDomain workflow.
# 
# GEOMETRY, from TestPollutantCanyonContainerE2E:
# two building blocks (40,30,0)-(80,50,20) and
# (40,70,0)-(80,90,20), leaving a canyon along X
# between y=50 and y=70. Base cell size 5 m, to
# match the fixture's 120 x 120 x 40 m blockMesh
# over 24 x 24 x 8 cells.
# 
# POLLUTANT SOURCE volume (40,52,0)-(55,68,10),
# species "exhaust", 0.01 kg/s. The volume is
# deliberately many cells across - a box near the
# cell size is exactly how a topoSet zone comes
# out empty.
# 
# PROBE RAKE on the canyon centreline at
# pedestrian height, wind along +X:
#   (25, 60, 2)   upwind   - must stay near 0
#   (47.5, 60, 2) in-source - carries the emission
#   (75, 60, 2)   downwind - diluted, above upwind
# Probe Field is set to "exhaust", so it reads the
# tracer concentration (kg/m3), not velocity.
# 
# Run Settings Iterations = 80, the fixture's
# short-run count.
# 
# PRUNED from BoxDomain: the sample Tree branch,
# the sample building geometry, the 6208-point
# sample probe cloud, and the Wind Field Viewer /
# Wind Legend / Streamlines branch that read it.
# That cloud is another site's, and it shipped
# with a stale cached result (341 velocities for
# 6208 points) that showed as an orange component.
# 
# Action toggles ship OFF. Order: Outdoor Case >
# Write, Run > Mesh, Run > Create Zones,
# Run > Simulate.
probe = Probe(
    Case=outdoor_case.Case,
    Points=merge_3,
    Field="exhaust",
    Run=False,
    AutoProbeName="polite-octopus-glade-needle",
    BakeTimeHistory=False,
    CullHugeVectors=True,
    CullInvalid=True,
    ShowRegion=False)  # -> Values, TimeSteps, SubResults
