# Grasshopper definition GAN_Prediction.ghx (Grasshopper 1.0.8)
# plug-ins: Eddy3D

select = SelectTemplate()
geo = Geometry(<extrusion referenced from the Rhino model>)
ganpredict = GANWindPrediction(
    BuildingGeometry=geo,
    WindDirection=0,
    Run=Button(),
    APIURL="https://sustainableurbansystemslab-eddy3d-gan.hf.space",
    HeightScale=3,
    DistanceScale=100,
    ColorMap="Viridis")  # -> WindSpeed, Mesh
c_script = CSharpScript(
    M=ganpredict.Mesh,
    FaceWidth="512",
    FaceHeight="512",
    ContourCount="10",
    SmoothIters="4",
    SmoothStrength=Slider(4, range=0..4))  # -> out, Contours, Levels, Status; inputs M: Mesh, FaceWidth: Int32, FaceHeight: Int32, ContourCount: Int32, MinLevel: Double, MaxLevel: Double, SmoothIters: Int32, SmoothStrength: Double, UseRed: Boolean, UseGreen: Boolean, UseBlue: Boolean
# ---------- c_script: C# ----------
#region Usings
using System;
using System.Collections.Generic;
using System.Drawing;

using Rhino;
using Rhino.Geometry;

using Grasshopper;
using Grasshopper.Kernel;
#endregion

public class Script_Instance : GH_ScriptInstance
{
    private void RunScript(
		Mesh M,
		int FaceWidth,
		int FaceHeight,
		int ContourCount,
		double MinLevel,
		double MaxLevel,
		int SmoothIters,
		double SmoothStrength,
		bool UseRed,
		bool UseGreen,
		bool UseBlue,
		ref object Contours,
		ref object Levels,
		ref object Status)
    {
        var polylines = new List<Polyline>();
        var levelsOut = new List<double>();

        try
        {
            if (M == null)  { Contours = polylines; Levels = levelsOut; Status = "Mesh is null"; return; }
            if (!M.IsValid) { Contours = polylines; Levels = levelsOut; Status = "Mesh is invalid"; return; }

            Mesh mesh = M.DuplicateMesh();
            int vCount = mesh.Vertices.Count;
            int fCount = mesh.Faces.Count;

            if (mesh.VertexColors.Count != vCount)
            { Contours = polylines; Levels = levelsOut; Status = "Vertex color count != vertex count"; return; }

            if (FaceWidth < 2 || FaceHeight < 2 || FaceWidth * FaceHeight != fCount)
            { Contours = polylines; Levels = levelsOut; Status = "FaceWidth*FaceHeight must equal face count"; return; }

            // 1) Scalar per face from vertex A color
            double[] faceS = new double[fCount];
            for (int f = 0; f < fCount; f++)
                faceS[f] = ColorToScalar(mesh.VertexColors[mesh.Faces[f].A], UseRed, UseGreen, UseBlue);

            // 2) Optional smoothing
            SmoothStrength = Clamp(SmoothStrength, 0.0, 1.0);
            SmoothIters = Math.Max(0, SmoothIters);

            for (int it = 0; it < SmoothIters; it++)
            {
                double[] next = new double[fCount];
                for (int y = 0; y < FaceHeight; y++)
                    for (int x = 0; x < FaceWidth; x++)
                    {
                        int i = FaceIdx(x, y, FaceWidth);
                        double sum = 0.0; int count = 0;
                        if (x > 0)              { sum += faceS[FaceIdx(x - 1, y, FaceWidth)]; count++; }
                        if (x < FaceWidth - 1)  { sum += faceS[FaceIdx(x + 1, y, FaceWidth)]; count++; }
                        if (y > 0)              { sum += faceS[FaceIdx(x, y - 1, FaceWidth)]; count++; }
                        if (y < FaceHeight - 1) { sum += faceS[FaceIdx(x, y + 1, FaceWidth)]; count++; }
                        next[i] = count == 0 ? faceS[i]
                                             : (1.0 - SmoothStrength) * faceS[i] + SmoothStrength * (sum / count);
                    }
                faceS = next;
            }

            // 3) Build a scalar-on-grid representation at GRID NODES (FaceWidth+1 x FaceHeight+1)
            //    Node value = average of up to 4 surrounding face values.
            int nx = FaceWidth + 1;
            int ny = FaceHeight + 1;
            double[] node = new double[nx * ny];
            Point3d[] nodePt = new Point3d[nx * ny];

            for (int ny_i = 0; ny_i < ny; ny_i++)
            {
                for (int nx_i = 0; nx_i < nx; nx_i++)
                {
                    double sum = 0.0; int count = 0;
                    // four surrounding faces, clamped to grid
                    for (int dy = -1; dy <= 0; dy++)
                        for (int dx = -1; dx <= 0; dx++)
                        {
                            int fx = nx_i + dx;
                            int fy = ny_i + dy;
                            if (fx >= 0 && fx < FaceWidth && fy >= 0 && fy < FaceHeight)
                            { sum += faceS[FaceIdx(fx, fy, FaceWidth)]; count++; }
                        }
                    node[ny_i * nx + nx_i] = count == 0 ? 0.0 : sum / count;
                    nodePt[ny_i * nx + nx_i] = NodePoint(mesh, FaceWidth, FaceHeight, nx_i, ny_i);
                }
            }

            // 4) Determine contour levels
            double sMin = double.MaxValue, sMax = double.MinValue;
            for (int i = 0; i < node.Length; i++)
            { if (node[i] < sMin) sMin = node[i]; if (node[i] > sMax) sMax = node[i]; }

            double lo = (MinLevel >= MaxLevel) ? sMin : MinLevel;
            double hi = (MinLevel >= MaxLevel) ? sMax : MaxLevel;
            int nLevels = Math.Max(1, ContourCount);

            var levelValues = new List<double>();
            for (int k = 0; k < nLevels; k++)
            {
                double t = (nLevels == 1) ? 0.5 : (k + 1.0) / (nLevels + 1.0);
                levelValues.Add(lo + t * (hi - lo));
            }

            // 5) Marching squares per cell, per level
            foreach (double L in levelValues)
            {
                var segs = new List<Line>();
                for (int y = 0; y < ny - 1; y++)
                {
                    for (int x = 0; x < nx - 1; x++)
                    {
                        int i00 = y * nx + x;
                        int i10 = y * nx + (x + 1);
                        int i11 = (y + 1) * nx + (x + 1);
                        int i01 = (y + 1) * nx + x;

                        double v00 = node[i00], v10 = node[i10], v11 = node[i11], v01 = node[i01];
                        Point3d p00 = nodePt[i00], p10 = nodePt[i10], p11 = nodePt[i11], p01 = nodePt[i01];

                        MarchingSquaresCell(L, p00, p10, p11, p01, v00, v10, v11, v01, segs);
                    }
                }

                // Stitch segments into polylines by endpoint matching
                var stitched = StitchSegments(segs, 1e-6);
                foreach (var pl in stitched)
                {
                    polylines.Add(pl);
                    levelsOut.Add(L);
                }
            }

            Contours = polylines;
            Levels = levelsOut;
            Status = "OK | levels: " + nLevels
                   + " | range used: " + lo.ToString("G4") + " to " + hi.ToString("G4")
                   + " | data range: " + sMin.ToString("G4") + " to " + sMax.ToString("G4")
                   + " | polylines: " + polylines.Count;
        }
        catch (Exception ex)
        {
            Contours = polylines;
            Levels = levelsOut;
            Status = "Exception: " + ex.Message;
        }
    }

    // ---------------- helpers ----------------

    int FaceIdx(int x, int y, int w) { return y * w + x; }

    Point3d NodePoint(Mesh mesh, int faceW, int faceH, int nx_i, int ny_i)
    {
        // Grid node (nx_i, ny_i) sits at the corner of faces.
        // We take the average of the corners of the up-to-four adjacent faces that touch this node.
        var samples = new List<Point3d>();
        for (int dy = -1; dy <= 0; dy++)
            for (int dx = -1; dx <= 0; dx++)
            {
                int fx = nx_i + dx;
                int fy = ny_i + dy;
                if (fx < 0 || fx >= faceW || fy < 0 || fy >= faceH) continue;
                MeshFace mf = mesh.Faces[FaceIdx(fx, fy, faceW)];

                // Pick the corner of this face that is geometrically closest to the node location.
                // For a regular grid, mf.A/B/C/D are ordered; here we just average all face corners as a robust fallback.
                // But for contour accuracy, it's better to pick the specific corner. We instead use face center
                // offset — simplest: average of 4 face vertices.
                samples.Add(AvgFaceCorner(mesh, mf, dx, dy));
            }
        if (samples.Count == 0) return Point3d.Origin;
        double sx = 0, sy = 0, sz = 0;
        foreach (var p in samples) { sx += p.X; sy += p.Y; sz += p.Z; }
        return new Point3d(sx / samples.Count, sy / samples.Count, sz / samples.Count);
    }

    // Return the corner of face mf that corresponds to offset (dx,dy) relative to the node.
    // dx,dy in {-1,0}: (-1,-1)=upper-right of face, (0,-1)=upper-left, (-1,0)=lower-right, (0,0)=lower-left.
    // For simplicity and robustness across different face winding orders, just return the face centroid;
    // the loss of accuracy is ~half a cell which is fine for dense 512x512 grids.
    Point3d AvgFaceCorner(Mesh mesh, MeshFace mf, int dx, int dy)
    {
        if (mf.IsQuad)
        {
            Point3d a = mesh.Vertices.Point3dAt(mf.A);
            Point3d b = mesh.Vertices.Point3dAt(mf.B);
            Point3d c = mesh.Vertices.Point3dAt(mf.C);
            Point3d d = mesh.Vertices.Point3dAt(mf.D);
            return new Point3d(
                0.25 * (a.X + b.X + c.X + d.X),
                0.25 * (a.Y + b.Y + c.Y + d.Y),
                0.25 * (a.Z + b.Z + c.Z + d.Z));
        }
        Point3d a2 = mesh.Vertices.Point3dAt(mf.A);
        Point3d b2 = mesh.Vertices.Point3dAt(mf.B);
        Point3d c2 = mesh.Vertices.Point3dAt(mf.C);
        return new Point3d((a2.X + b2.X + c2.X) / 3.0, (a2.Y + b2.Y + c2.Y) / 3.0, (a2.Z + b2.Z + c2.Z) / 3.0);
    }

    void MarchingSquaresCell(double L,
                             Point3d p00, Point3d p10, Point3d p11, Point3d p01,
                             double v00, double v10, double v11, double v01,
                             List<Line> segs)
    {
        int code = 0;
        if (v00 > L) code |= 1;
        if (v10 > L) code |= 2;
        if (v11 > L) code |= 4;
        if (v01 > L) code |= 8;

        if (code == 0 || code == 15) return;

        Point3d e0 = Interp(p00, p10, v00, v10, L); // bottom
        Point3d e1 = Interp(p10, p11, v10, v11, L); // right
        Point3d e2 = Interp(p11, p01, v11, v01, L); // top
        Point3d e3 = Interp(p01, p00, v01, v00, L); // left

        switch (code)
        {
            case 1:  segs.Add(new Line(e3, e0)); break;
            case 2:  segs.Add(new Line(e0, e1)); break;
            case 3:  segs.Add(new Line(e3, e1)); break;
            case 4:  segs.Add(new Line(e1, e2)); break;
            case 5:  segs.Add(new Line(e3, e2)); segs.Add(new Line(e1, e0)); break; // ambiguous
            case 6:  segs.Add(new Line(e0, e2)); break;
            case 7:  segs.Add(new Line(e3, e2)); break;
            case 8:  segs.Add(new Line(e2, e3)); break;
            case 9:  segs.Add(new Line(e2, e0)); break;
            case 10: segs.Add(new Line(e0, e3)); segs.Add(new Line(e2, e1)); break; // ambiguous
            case 11: segs.Add(new Line(e2, e1)); break;
            case 12: segs.Add(new Line(e1, e3)); break;
            case 13: segs.Add(new Line(e1, e0)); break;
            case 14: segs.Add(new Line(e0, e3)); break;
        }
    }

    Point3d Interp(Point3d a, Point3d b, double va, double vb, double L)
    {
        double denom = vb - va;
        double t = Math.Abs(denom) < 1e-16 ? 0.5 : (L - va) / denom;
        if (t < 0) t = 0; if (t > 1) t = 1;
        return new Point3d(a.X + t * (b.X - a.X), a.Y + t * (b.Y - a.Y), a.Z + t * (b.Z - a.Z));
    }

    List<Polyline> StitchSegments(List<Line> segs, double tol)
    {
        var result = new List<Polyline>();
        if (segs.Count == 0) return result;

        var used = new bool[segs.Count];
        double tol2 = tol * tol;

        for (int i = 0; i < segs.Count; i++)
        {
            if (used[i]) continue;
            used[i] = true;

            var pl = new Polyline();
            pl.Add(segs[i].From);
            pl.Add(segs[i].To);

            bool extended = true;
            while (extended)
            {
                extended = false;
                Point3d tail = pl[pl.Count - 1];
                for (int j = 0; j < segs.Count; j++)
                {
                    if (used[j]) continue;
                    if (tail.DistanceToSquared(segs[j].From) < tol2)
                    { pl.Add(segs[j].To); used[j] = true; extended = true; break; }
                    if (tail.DistanceToSquared(segs[j].To) < tol2)
                    { pl.Add(segs[j].From); used[j] = true; extended = true; break; }
                }
            }

            extended = true;
            while (extended)
            {
                extended = false;
                Point3d head = pl[0];
                for (int j = 0; j < segs.Count; j++)
                {
                    if (used[j]) continue;
                    if (head.DistanceToSquared(segs[j].To) < tol2)
                    { pl.Insert(0, segs[j].From); used[j] = true; extended = true; break; }
                    if (head.DistanceToSquared(segs[j].From) < tol2)
                    { pl.Insert(0, segs[j].To); used[j] = true; extended = true; break; }
                }
            }

            result.Add(pl);
        }

        return result;
    }

    double ColorToScalar(Color c, bool useRed, bool useGreen, bool useBlue)
    {
        int flags = (useRed ? 1 : 0) + (useGreen ? 1 : 0) + (useBlue ? 1 : 0);
        if (flags == 1)
        {
            if (useRed) return c.R / 255.0;
            if (useGreen) return c.G / 255.0;
            return c.B / 255.0;
        }
        return (0.2126 * c.R + 0.7152 * c.G + 0.0722 * c.B) / 255.0;
    }

    double Clamp(double x, double a, double b) { return x < a ? a : (x > b ? b : x); }
}
# ---------- end c_script ----------
panel = Panel(c_script.Status)
