# Grasshopper definition PALM-4U.ghx (Grasshopper 1.0.8)
# plug-ins: Eddy3D-PALM, Outdoor

division = Division(A="5", B="2")
multiplication = Multiplication(A=division, B="-1")
boolean_toggle = BooleanToggle(True)
multiplication_2 = Multiplication(A="50", B=multiplication)
vector_xyz = VectorXYZ(XComponent=multiplication_2, YComponent=multiplication_2, ZComponent=0)  # -> Vector, Length
# Description: Purpose: Pedestrian-level PET maps from a PALM-4U large-eddy simulation of a small site.
# Fidelity: Experimental - skeleton workflow for the PALM-4U plugin.
# Method: PALM Domain (64 x 64 x 48 cells, 2 m), buildings, trees, terrain and OSM land cover feed PALM Case; 2 h, 3 m/s westerly.
# Result: Time-averaged bio_pet field from PALM Results; PALM Progress follows the container run.
# Needs: Eddy3D Setup > Urban microclimate / LES / RANS (PALM-4U). Runtime: hours.
# Edit: Domain size and resolution, STL buildings and trees, terrain, wind, simulated time; toggle Fetch for land cover.
site_picker = SitePicker(SitePickerAddress="Zurich, District Zurich, Zurich, Switzerland", SitePickerLat=47.374449, SitePickerLon=8.541042)  # -> Latitude, Longitude, Address
palm_domain = PALMDomain(
    Latitude=site_picker.Latitude,
    Longitude=site_picker.Longitude,
    CellSize="5",
    CellsX="50",
    CellsY="50",
    CellsZ=48,
    Origin=vector_xyz.Vector)  # -> Domain, Boundary, Summary
palm_land_cover = PALMLandCover(Domain=palm_domain.Domain, Fetch=Toggle(True))  # -> LandCover, Outlines, Report
palm_settings = PALMSettings(
    Duration=2,
    Spinup=0.5,
    OutputInterval=10,
    WindSpeed=3,
    WindDirection=270,
    AirTemperature=20,
    Humidity=0.008,
    DateTime="2023-06-21 12:00:00 +00",
    SliceHeight=2,
    Comfort=True)  # -> Settings, Summary
download_weather = DownloadWeather(
    Station="USA_NY_New.York-Downtown.Manhattan.Heli.720553_TMYx.2004-2018",
    Latitude=site_picker.Latitude,
    Longitude=site_picker.Longitude,
    ChartMonthFrom=1,
    ChartMonthTo=12)  # -> EPWFile, Logs, Stations, Station, ExtraFiles, SiteLatitude, SiteLongitude
lidar_site = LiDARSite(
    Latitude=download_weather.SiteLatitude,
    Longitude=download_weather.SiteLongitude,
    Size="150",
    TerrainSize="250",
    Source="Auto",
    Roads=True,
    RingSize="350",
    Run=boolean_toggle,
    LidarSiteInputLayoutVersion=4,
    LidarSiteOutputLayoutVersion=2)  # -> PointCloud, Footprints, RoofHints, Domain, Trees, TreeCrowns, LayerOutlines, LayerNames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
city_surface = CitySurface(
    PointCloud=lidar_site.PointCloud,
    Footprints=lidar_site.Footprints,
    Domain=lidar_site.Domain,
    LayerOutlines=lidar_site.LayerOutlines,
    LayerNames=lidar_site.LayerNames,
    LayerRoughness=lidar_site.LayerRoughness,
    Flatten=lidar_site.Flatten,
    RoofHints=lidar_site.RoofHints,
    LoD="LoD 1.3",
    Engine="GPU",
    CloudOffset=Vector(0, 0, 0),
    LayerPercentile=0.5,
    RoofPercentile=0.9,
    GroundSpacing="5",
    Smoothing=2,
    Buffer=0,
    RoofFit="Auto",
    FlatTerrain=True,
    Run=boolean_toggle,
    CitySurfaceInputLayoutVersion=10,
    ClayLook=True)  # -> Terrain, Buildings, Layers, LayerNames, Surface, RoofHeights, Report, LayerRoughness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
palm_case = PALMCase(
    Domain=palm_domain.Domain,
    Buildings=city_surface.Buildings,
    Trees=city_surface.Trees,
    Terrain=city_surface.Terrain,
    LandCover=palm_land_cover.LandCover,
    BuildingType="3 — Residential — after 2000",
    VegetationType="3 — Short grass",
    PavementType="1 — Asphalt / concrete mix",
    WaterType="1 — Lake",
    GroundCover="3 — Short grass",
    SoilType="3 — Medium-fine",
    LeafAreaDensity=2,
    Settings=palm_settings.Settings,
    Write=Button(),
    Clear=False,
    AutoCaseName="polite-narwhal-plateau-feather",
    PalmCaseInputLayoutVersion=2,
    PreviewBoundaries=True,
    PreviewDimensions=True,
    PreviewGrid=False,
    PreviewGrid3D=False,
    PreviewSurface=True,
    PreviewWind=True)  # -> Driver, Path, Report, Namelist, DomainBox
geometry = Geometry(city_surface.Buildings)
geometry_2 = Geometry(palm_case.DomainBox)
palm_run = PALMRun(
    Driver=palm_case.Driver,
    Engine="Container (Docker/Podman)",
    Image="Auto (published image for this machine)",
    Run=Button(),
    PalmRunInputLayoutVersion=6)  # -> Namelist, Script, Command, Status, CaseFolder
palm_progress = PALMProgress(CaseFolder=palm_run.CaseFolder, Live=True)  # -> Progress, SimulatedTime, Done, Status
panel = Panel([palm_run.Command, palm_run.Status])
palm_results = PALMResults(
    CaseFolder=palm_run.CaseFolder,
    File="Averaged XY (…_av_xy)",
    Variable="bio_pet*_xy",
    Frame=Slider(0, range=0..23),
    Domain=palm_domain.Domain)  # -> Mesh, Values, Variables, Times, Info
