# Grasshopper definition Share.ghx (Grasshopper 1.0.8)
# plug-ins: Outdoor, Eddy3D, Eddy3D-Radiance

boolean_toggle = BooleanToggle(True)
panel = Panel("New York")
download_weather = DownloadWeather(Station="USA_NY_New.York-Central.Park.Obs-Belvedere.Castle.725053_TMYx.2004-2018", ChartMonthFrom=1, ChartMonthTo=12)  # -> EPWFile, Logs, Stations, Station, ExtraFiles, SiteLatitude, SiteLongitude
lidar_site = LiDARSite(
    Latitude=download_weather.SiteLatitude,
    Longitude=download_weather.SiteLongitude,
    Size="200",
    Source="Auto",
    Roads=True,
    Run=boolean_toggle,
    LidarSiteInputLayoutVersion=4,
    LidarSiteOutputLayoutVersion=2,
    LidarSiteRoundCrowns=False)  # -> PointCloud, Footprints, RoofHints, Domain, Trees, TreeCrowns, LayerOutlines, LayerNames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
city_surface = CitySurface(
    PointCloud=lidar_site.PointCloud,
    Footprints=lidar_site.Footprints,
    Domain=lidar_site.Domain,
    LayerOutlines=lidar_site.LayerOutlines,
    LayerNames=lidar_site.LayerNames,
    LayerRoughness=lidar_site.LayerRoughness,
    Flatten=lidar_site.Flatten,
    RoofHints=lidar_site.RoofHints,
    Engine="GPU",
    CloudOffset=Vector(0, 0, 0),
    LayerPercentile=0.5,
    RoofPercentile=0.9,
    GroundSpacing="2",
    Smoothing=2,
    Buffer=0,
    Run=boolean_toggle,
    CitySurfaceInputLayoutVersion=10,
    CitySurfaceRoundCrowns=False,
    ClayLook=True)  # -> Terrain, Buildings, Layers, LayerNames, Surface, RoofHeights, Report, LayerRoughness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
weather = Weather(EPWFilePath=download_weather.EPWFile)
mesh_join = MeshJoin(Meshes=flatten([city_surface.Surface, lidar_site.Furniture, lidar_site.Barriers]))
mesh_join_2 = MeshJoin(Meshes=flatten(lidar_site.Trees))
deconstruct_mesh = DeconstructMesh(Mesh=mesh_join)  # -> Vertices, Faces, Colours, Normals
canopy = Canopy(Geometry=mesh_join_2, CrownTransmittance=0.2, PerCrossing=False, LeafOn=0, LeafOff=0)  # -> Canopy, Report
sun_hours = SunHours(
    Context=mesh_join,
    Points=deconstruct_mesh.Vertices,
    Weather=weather,
    StartHour=0,
    EndHour=8760,
    Timestep=1,
    North=0,
    Offset=0.01,
    Canopy=canopy.Canopy,
    Engine="Auto",
    Date="Custom",
    SunHoursInputLayoutVersion=2)  # -> SunHours, Fraction, Colors, Report, MorningHours, AfternoonHours
python_3_script = Python3Script()  # -> out, a
# ---------- python_3_script: Python ----------
import os
from pathlib import Path
a = Path( os.path.expanduser("~") / Path( "Eddy3D/Cases/Share"))
# ---------- end python_3_script ----------
share_pack = ShareBundle(
    Folder=python_3_script.a,
    Title="Sun Hours",
    Mesh=mesh_join,
    Values=sun_hours.SunHours,
    Units="Sun Hours",
    Context=flatten([city_surface.Surface, lidar_site.Furniture, lidar_site.Barriers, lidar_site.Trees]),
    Latitude=download_weather.SiteLatitude,
    Longitude=download_weather.SiteLongitude,
    Formats="All",
    ColorMap="blue → yellow",
    Steps=Slider(10, range=0..30),
    Write=boolean_toggle,
    SharePackInputLayoutVersion=2)  # -> Files, Summary, Bundle
