# Grasshopper definition SiteAnalysis.ghx (Grasshopper 1.0.8)
# plug-ins: Outdoor, Eddy3D

site_picker = SitePicker(
    SitePickerAddress="Sihlbrücke, Langstrasse, Kreis 4, Zurich, District Zurich, Zurich, 8004, Switzerland",
    SitePickerLat=47.373525,
    SitePickerLon=8.532252)  # -> Latitude, Longitude, Address
boolean_toggle = BooleanToggle(True)
size = ValueList({"Small": 200, "Medium": 400, "Large": 800, "Huge": 1600}, selected="Medium")
size_2 = ValueList({"Small": 200, "Medium": 400, "Large": 800, "Huge": 1600}, selected="Small")
size_3 = ValueList({"Small": 200, "Medium": 400, "Large": 800, "Huge": 1600}, selected="Large")
panel = Panel(site_picker.Address)
lidar_site = LiDARSite(
    Latitude=site_picker.Latitude,
    Longitude=site_picker.Longitude,
    Size=size_2,
    TerrainSize=size,
    Source="Auto",
    Roads=True,
    RingSize=size_3,
    Run=boolean_toggle,
    LidarSiteInputLayoutVersion=4,
    LidarSiteOutputLayoutVersion=2)  # -> PointCloud, Footprints, RoofHints, Domain, Trees, TreeCrowns, LayerOutlines, LayerNames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
wind_climate = WindClimate(
    Source="ERA5 (Open-Meteo)",
    Latitude=site_picker.Latitude,
    Longitude=site_picker.Longitude,
    Years="1995-2024",
    Sectors=36,
    CalmThreshold=0.5,
    SourceTerrain="II - Low vegetation, isolated obstacles (z0 0.05 m)",
    SiteTerrain="None (source speeds as recorded)",
    ReferenceHeight=10,
    Fetch=boolean_toggle)  # -> WindClimate, Directions, Probabilities, WeibullC, WeibullK, Calm, SectorTable, Report, RoseFrequencies, RoseBands
download_weather = DownloadWeather(
    Station="OneBuilding (nearest TMYx)",
    Latitude=site_picker.Latitude,
    Longitude=site_picker.Longitude,
    ChartMonthFrom=1,
    ChartMonthTo=12)  # -> EPWFile, Logs, Stations, Station, ExtraFiles, SiteLatitude, SiteLongitude
city_surface = CitySurface(
    PointCloud=lidar_site.PointCloud,
    Footprints=lidar_site.Footprints,
    Domain=lidar_site.Domain,
    LayerOutlines=lidar_site.LayerOutlines,
    LayerNames=lidar_site.LayerNames,
    LayerRoughness=lidar_site.LayerRoughness,
    Flatten=lidar_site.Flatten,
    RoofHints=lidar_site.RoofHints,
    LoD="LoD 2.2",
    Engine="GPU",
    CloudOffset=Vector(0, 0, 0),
    LayerPercentile=0.5,
    RoofPercentile=0.9,
    GroundSpacing=1,
    Smoothing=2,
    Buffer=0,
    RoofFit="Auto",
    Run=boolean_toggle,
    CitySurfaceInputLayoutVersion=10,
    ClayLook=True)  # -> Terrain, Buildings, Layers, LayerNames, Surface, RoofHeights, Report, LayerRoughness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
site_context = SiteContext(
    Latitude=site_picker.Latitude,
    Longitude=site_picker.Longitude,
    Radius=size_2,
    TerrainRadius=0,
    FallbackHeight=9,
    BuildingSource="Global Building Atlas",
    TerrainSource="GEDTM30",
    Fetch=boolean_toggle,
    FetchLayerBuildings=True,
    FetchLayerLandCover=True,
    FetchLayerTerrain=True,
    FetchLayerTrees=True,
    SiteContextInputLayoutVersion=4)  # -> Buildings, BuildingHeights, HeightSources, Terrain, SiteElevation, TreeCrowns, TreePoints, TreeHeights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
panel_2 = Panel(wind_climate.WindClimate)
panel_3 = Panel(wind_climate.Directions)
deconstruct_weather = DeconstructWeather(
    Weather=download_weather.EPWFile,
    Period="Year",
    Series="""Dry Bulb Temperature
Relative Humidity
Wind Speed
Wind Direction
Solar Elevation
Solar Azimuth
Hour of Year""")  # -> DryBulbTemperature, RelativeHumidity, WindSpeed, WindDirection, SolarElevation, SolarAzimuth, HourOfYear
panel_4 = Panel(wind_climate.Probabilities)
panel_5 = Panel(deconstruct_weather.DryBulbTemperature)
