# Grasshopper definition ViewShed.ghx (Grasshopper 1.0.8)
# plug-ins: Eddy3D-Radiance

geometry = Geometry(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)
geometry_2 = Geometry(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)
# Description: Purpose: How open the view is from points on a surface, and how much of a target each point can see.
# Fidelity: Screening - geometric ray casting; a plan-view measure, not a daylight metric.
# Method: Viewshed casts a 26 degree half-angle cone out to 48 m from each mesh vertex; View Target casts rays to the target past shared context.
# Result: Values from 0 to 1, with colours, per observer point.
# Needs: Nothing to install; runs inside Rhino. Runtime: seconds to minutes.
# Edit: Context, observer surfaces and target; wire normals to aim the cones.
geometry_3 = Geometry([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])
mesh_brep = MeshBrep(
    Brep=geometry,
    Settings={GridMaxCount=0, GridMinCount=16, JaggedSeams=False, MaxEdgeLength=0, MinEdgeLength=0.0001, MinTolerance=0, Refine=True, RefineAngle=0, RelativeTolerance=0.65, SimplePlanes=True, Tolerance=0})
geometry_4 = Geometry(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)
mesh_brep_2 = MeshBrep(
    Brep=geometry_2,
    Settings={GridMaxCount=0, GridMinCount=16, JaggedSeams=False, MaxEdgeLength=0, MinEdgeLength=0.0001, MinTolerance=0, Refine=True, RefineAngle=0, RelativeTolerance=0.65, SimplePlanes=True, Tolerance=0})
quad_remesh = QuadRemesh(Geometry=mesh_brep, Settings={aqc=True, as=50, dhe=True, gci=0, null=False, pme=2, sa=0, tqc=2000})
quad_remesh_2 = QuadRemesh(Geometry=mesh_brep_2, Settings={aqc=True, as=50, dhe=True, gci=0, null=False, pme=2, sa=0, tqc=2000})
deconstruct_mesh = DeconstructMesh(Mesh=quad_remesh)  # -> Vertices, Faces, Colours, Normals
view_target = ViewTarget(
    Context=geometry_3,
    Points=deconstruct_mesh.Vertices,
    Target=geometry_4,
    TargetSamples=64,
    Offset=0.01,
    ColorScheme="Blue → Yellow",
    Engine="Auto")  # -> Visibility, Colors, TargetPoints, Report
deconstruct_mesh_2 = DeconstructMesh(Mesh=quad_remesh_2)  # -> Vertices, Faces, Colours, Normals
viewshed = Viewshed(
    Context=geometry_3,
    Points=deconstruct_mesh_2.Vertices,
    ConeHalfAngle=Slider(26, range=0..100),
    Rays=500,
    Offset=0.01,
    MaxDistance=Slider(48, range=0..100),
    ColorScheme="Viridis",
    Engine="Auto")  # -> Openness, Colors, Report, Cones
mesh = Mesh(viewshed.Cones)
