# Grasshopper definition WRF.ghx (Grasshopper 1.0.8)
# plug-ins: Eddy3D-WRF, Outdoor

site_picker = SitePicker(SitePickerAddress="Atlanta, Fulton County, Georgia, United States", SitePickerLat=33.754466, SitePickerLon=-84.389815)  # -> Latitude, Longitude, Address
wrf_domain = WRFDomain(
    Latitude=site_picker.Latitude,
    Longitude=site_picker.Longitude,
    Projection="Lambert",
    CellSize=3000,
    GridX=40,
    GridY=40,
    NestRatios=3,
    TrueLat1=30,
    TrueLat2=36,
    StandLon=-84.39,
    GeogDataRes="lowres")  # -> Project, Domains, Summary
wrf_geo_data = WRFGeoData(Resolution="lowres", Download="geog_low_res_mandatory (149.9 MB)", Fetch=False)  # -> GeogPath, Ready, Status
# Description: Purpose: Site weather for Atlanta from a regional WRF run driven by GFS forecasts.
# Fidelity: Experimental - mesoscale workflow; 3 km nest on low-resolution geography.
# Method: WRF Met Data fetches 0.25 degree GFS from NOMADS; 3 km Lambert nest inside a 9 km parent; WPS and WRF run in a container.
# Result: 2 m temperature and 10 m wind viewers; WRF Weather and WRF ABL derive CFD weather and inflow.
# Needs: Eddy3D Setup > Mesoscale weather / Weather Research and Forecasting (WRF). Runtime: hours.
# Edit: Dates (NOMADS keeps about ten days), domain centre and size.
panel = Panel("Atlanta")
wrf_met_data = WRFMetData(
    Source="NOAA NOMADS GFS (no account, last ~10 days)",
    Start="2026-10-25 12:00:00",
    End="2026-10-25 21:00:00",
    Interval=3,
    Resolution="0p25",
    CaseName=panel,
    Fetch=False,
    WrfMetDataInputLayoutVersion=2)  # -> GRIBFolder, Vtable, Files, Status
wrf_namelist = WRFNamelist(
    Project=wrf_domain.Project,
    GeogDataPath=wrf_geo_data.GeogPath,
    Start="2026-10-25 12:00:00",
    End="2026-10-25 21:00:00",
    Interval=10800,
    CaseName=panel,
    Write=False,
    WrfNamelistInputLayoutVersion=2)  # -> Namelist, Path
wrf_run = WRFRun(
    GRIBFolder=wrf_met_data.GRIBFolder,
    Vtable=wrf_met_data.Vtable,
    Engine="Container (Docker/Podman)",
    Image="Auto (published image for this machine)",
    Ranks=1,
    Steps="Everything (WPS then WRF)",
    CaseName=panel,
    TimeStep=0,
    HistoryInterval=0,
    Run=False,
    AutoCaseName="fresh-heron-reef-kite",
    WrfRunInputLayoutVersion=3)  # -> Script, Command, Status, CaseFolder
wrf_weather = WRFWeather(
    CaseFolder=wrf_run.CaseFolder,
    Domain=2,
    Latitude=33.76,
    Longitude=-84.39,
    TimeZone=-4,
    SolarSplit="Erbs (model the split)",
    CloudCover="Clearness index (Kasten-Czeplak)")  # -> Weather, StartHOY, Duration, Series, Report
wrf_progress = WRFProgress(WorkingDirectory=wrf_run.CaseFolder, Live=False)  # -> Progress, Phase, Done, Status
wrf_animate = WRFAnimate(CaseFolder=wrf_run.CaseFolder, Domain=2, Play=False, SecondsPerFrame=1)  # -> Frame, Instant
wrf_map = WRFMap(CaseFolder=wrf_run.CaseFolder, Domain=2, Graticule=1, ZHeight=0, LineWeight=Slider(10, range=0..10), LabelStyle="Text")  # -> Graticule, Labels, LabelPoints, Coastline, SitePoint, SiteLabel, Borders, UrbanAreas, Water
wrf_probe = WRFProbe(CaseFolder=wrf_run.CaseFolder, Domain=2, Field="Air temperature 2 m (degC)", Variable="T2", Frame=wrf_animate.Frame)  # -> Points, Values, Vectors, Report, Mesh
wrf_probe_2 = WRFProbe(CaseFolder=wrf_run.CaseFolder, Domain=2, Field="Wind 10 m (U10/V10, m/s)", Variable="T2", Frame=wrf_animate.Frame)  # -> Points, Values, Vectors, Report, Mesh
wrf_abl = WRFABL(Series=wrf_weather.Series, Terrain="Urban (1.0 m)", Roughness=1, GroundHeight=0, Mode="Average over the run", Sectors=16)  # -> BoundaryConditions, WindVectors, Speed, Report
flex_legend = FlexLegend(
    Values=wrf_probe_2.Values,
    Points=wrf_probe_2.Points,
    MetricType="temperature",
    ColorMap="Inferno",
    Contours="Bands + Lines",
    Plane=PlaneXY(0, 0, 0),
    LabelStyle="Text",
    Offset=0.5,
    Smoothing=0,
    Aggregate="Mean",
    HighlightTop=0,
    FlexLegendInputLayoutVersion=5)  # -> LegendMesh, LegendPoints, LegendValues, FieldMesh, Colors, ResolvedRange, Contours, ContourValues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
scalar_field_viewer = ScalarFieldViewer(
    Values=wrf_probe.Values,
    Points=wrf_probe.Points,
    DisplayMode="Heatmap Mesh",
    ColorMap="Viridis",
    Mesh=wrf_probe.Mesh,
    Size=4,
    Fit="Gapless",
    ScalarFieldViewerInputLayoutVersion=2)  # -> Geometry, Colors, Range
