# Grasshopper definition Stormwater.ghx (Grasshopper 1.0.9)
# plug-ins: Eddy3D-Stormwater, Outdoor

site_picker = SitePicker(
    SitePickerAddress="11th Street Northeast, Midtown, Atlanta, Fulton County, Georgia, 30309, United States",
    SitePickerLat=33.782162,
    SitePickerLon=-84.377875)  # -> Latitude, Longitude, Address
site_context = SiteContext(
    Latitude=site_picker.Latitude,
    Longitude=site_picker.Longitude,
    Radius=Slider(290, range=0..1000),
    TerrainRadius=0,
    FallbackHeight=9,
    BuildingSource="Global Building Atlas",
    TerrainSource="GEDTM30",
    Fetch=Toggle(True),
    ClayLook=True,
    FetchLayerBuildings=True,
    FetchLayerLandCover=True,
    FetchLayerTerrain=True,
    FetchLayerTrees=True,
    SiteContextInputLayoutVersion=4)  # -> Buildings, BuildingHeights, HeightSources, Terrain, SiteElevation, TreeCrowns, TreePoints, TreeHeights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
panel = Panel("""1
2
3""")
land_cover_runoff = LandCoverRunoff(
    Latitude=site_picker.Latitude,
    Longitude=site_picker.Longitude,
    Radius=500,
    SoilGroup="B — sandy loam (moderate)",
    Anchor=Point(0, 0, 0))  # -> Zones, Outlines, Classes, CurveNumbers
# Description: Purpose: Where water can pond on a graded site, and which way it runs.
# Fidelity: Experimental - surface routing only, no pipes; the IDF coefficients are placeholders.
# Method: Stormwater Grid rasterises the terrain at 1 m; Fast mode computes terrain analytics, Full mode solves shallow-water depths.
# Result: A depression-capacity mesh and runoff flowlines up to 240 m, coloured by contributing area.
# Needs: Nothing to install; runs inside Rhino. Runtime: seconds to minutes, Full mode the slower.
# Edit: Terrain surface; real IDF coefficients a, b, c in Design Storm; connect Land Cover Runoff.
stormwater_grid = StormwaterGrid(
    Terrain=site_context.Terrain,
    CellSize=Slider(5, range=0..10),
    Buildings=site_context.Buildings,
    Zones=land_cover_runoff.Zones,
    BuildingsAre="Walls",
    Supersample=1,
    DefaultManningsN=0.015,
    DefaultRunoffCoefficient=1)  # -> Grid, Preview, Summary
design_storm = DesignStorm(
    ReturnPeriod=100,
    Duration=60,
    IDFCoefficients=panel,
    Pattern="Alternating Block",
    BlockLength=5,
    ClimateAllowance="None (present day)",
    DrainageDepth=0)  # -> Storm, Intensities, TotalDepth, Summary
stormwater_run = StormwaterRun(
    Grid=stormwater_grid.Grid,
    Storm=design_storm.Storm,
    Mode="Fast (terrain only)",
    Engine="Auto",
    Run=True,
    StormwaterRunInputLayoutVersion=2)  # -> Result, Summary, PeakDepth
deconstruct_stormwater = DeconstructStormwater(Result=stormwater_run.Result, Field="Depression capacity", Time=0, Cutoff=10)  # -> Mesh, Points, Values, Colors, Range
stormwater_flowlines = StormwaterFlowlines(Result=stormwater_run.Result, SeedSpacing=10, MinimumCatchment=0, MaximumLength=Slider(200, range=0..1000), Time=0)  # -> Flowlines, Values, Colors, Range, flatten(Segments), flatten(SegmentColors)
stormwater_legend = StormwaterLegend(Style="Ponding depth", Range=stormwater_flowlines.Range, Plane=PlaneXY(0, 0, 0), Size=Slider(48, range=0..100), Steps=8)  # -> Swatches, Labels, LabelPlanes, Title
custom_preview = CustomPreview(Geometry=deconstruct_stormwater.Mesh, Material=ColourSwatch(SwatchColor=RGB(0, 64, 255)))
custom_preview_2 = CustomPreview(Geometry=stormwater_flowlines.Segments, Material=stormwater_flowlines.SegmentColors)
