# Grasshopper definition ML_CreateDataset.ghx (Grasshopper 1.0.8)
# plug-ins: Outdoor

# Description: Purpose: Turn CFD wind solutions into labelled CSV rows for training wind surrogates.
# Fidelity: Engineering - steady RANS (realizable k-epsilon, SIMPLE) labels; a dataset is only as good as its CFD.
# Method: Outdoor Case solves 8 directions on a Cylinder Domain; Probe samples U on a 2 m grid at 1.8 m; Dataset Curator writes features.
# Result: One CSV per direction (SDF, building height, direction) plus a merge script; Dataset Reader previews mag_U.
# Needs: Eddy3D Setup > (U)RANS CFD (OpenFOAM). Runtime: hours.
# Edit: Buildings and terrain (radius above 500 m); probe k as well, which the merge needs.
panel = Panel("""0
45
90
135
180
225
270
315""")

# ----
# Building Geometry &
# Boundary Conditions
panel_2 = Panel("10")
atmospheric_boundary_layer = AtmosphericBoundaryLayer(
    WindDirections=panel,
    WindSpeed="5",
    ReferenceHeight=panel_2,
    RoughnessLengthZ0=1,
    GroundHeight=0,
    TurbulentKEK=0.015,
    TurbulentEpsilonΕ=0.135,
    TurbulentOmegaΩ=100,
    TerrainType="Custom (z0 input)",
    InletProfile="Log law (Richards & Hoxey)",
    DisplacementHeight=0,
    AblOutputLayoutVersion=2)  # -> BoundaryConditions, WindVectors

# ---- group: BUILDINGS
# Prepare Geometry
# the buildings should
#    consist of Breps!
# Step 1
buildings = Geometry([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])

# ---- group: TERRAIN
srf = Surface(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)

# ----
# Computational Domain
# Step 2
# Prepare Terrain
# the radius should be
# more than 500 meters!
pedestrian_level = Panel("1.8")
Z = UnitZ(Factor=pedestrian_level)
move = Move(Geometry=srf, Motion=Z)  # -> Geometry, Transform

cyldomain = CylinderDomain(
    CoreCellSize="10",
    InnerCoreSize=-1,
    OuterRadius=-1,
    Height=-1,
    RadialMultiplier=2,
    CoreDivisions=1,
    RefinementBoxExtension=-1,
    RadialGrading=7,
    CoreRoundness=0.65,
    VerticalGrading=35)

# ----
# Create Case Folder
panel_3 = Panel("4")
run_settings = RunSettings(
    Iterations="600",
    WriteInterval="600",
    KeepTimeSteps=3,
    TurbulenceModel="realizableKE",
    CPUCount=-1,
    SolverAlgorithm="SIMPLE",
    AgeOfAir=False,
    Numerics="0,0.5,0.5",
    PotentialFoamInit=True,
    WarmUpIterations=-1,
    FieldMonitors=False,
    PedestrianAverage=False,
    PressureCoefficient=False,
    Convergence=0.0001,
    AutoStopOnPlateau=False,
    Duration=-1,
    TimeStep=-1,
    MaxCourant=-1,
    AveragingWindow=-1,
    PressureSolver="GAMG",
    LaplacianScheme="auto",
    MeshQualityPreset="auto",
    PedestrianHeight=1.75,
    Guideline="None",
    ConcurrentDirections=1,
    EmptyDomainCheck=False)  # -> RunSettings, DebugLogs

mesh_settings = MeshSettings(
    RefinementBoxLevel="2",
    BuildingSurfaceLevel=panel_3,
    BuildingFeatureLevel=2,
    GroundSurfaceLevel=0,
    LayerCount="2",
    GradingStrengthHorizontal="5",
    AdaptiveGrading=True,
    CellsBetweenLevels=-1)
groundz0 = GroundRoughness(Faces=srf, RoughnessLengths=1, RefinementLevel=2)
path = FilePath("C:\Users\ilker\Desktop\Deneme\")
# Step 3
button = Button()
outcase = OutdoorCase(
    CaseName="ML_Basic_Test_0",
    WorkingDirectory=path,
    BoundaryConditions=atmospheric_boundary_layer.BoundaryConditions,
    DomainParameters=cyldomain,
    Buildings=buildings,
    Terrain=srf,
    MeshSettings=mesh_settings,
    RunSettings=run_settings.RunSettings,
    GroundRoughness=groundz0,
    Engine="BlueCFD",
    Write=False,
    ClearCase=False,
    AutoName="gentle-marmot-wharf-satchel",
    AutoWrapGeometry=False,
    ClayLook=True,
    OutdoorCaseInputLayoutVersion=7,
    PreviewBuildings=False,
    PreviewDimensions=True,
    PreviewGrid3D=False,
    PreviewGroundGrid=True,
    PreviewRefinementBox=True,
    PreviewWindArrows=True,
    RepairGeometry=True)  # -> Logs, WriteLogs, Case, Domain, RefinementBox, Buildings, PedestrianPoints, Terrain
# Step 4
concat = Concatenate(FragmentA=path, FragmentB="\", FragmentC="ML_Basic_Test_0")
# write dataset to file!
safety = SafetyToggle()

# ----
# Probing
brep_grid_points = BrepGridPoints(Geometry=move.Geometry, Spacing="2")  # -> Points, Vectors, Mesh, Status

# ----
# Dataset Preparation
datacurator = DatasetCurator(
    Points=brep_grid_points.Points,
    Buildings=buildings,
    Case_dir=concat,
    U_ref="5",
    Z_ref=panel_2,
    Pedestrian_level=pedestrian_level,
    Wind_dir=panel,
    Engine="CPU",
    Run=safety,
    DatasetCuratorInputLayoutVersion=2)  # -> SDF, Bldg_height, Z_relative, U_over_Uref, X_coords, Y_coords, Dir_sin, Dir_cos, CSV_Path
panel_4 = Panel(datacurator.CSV_Path)

probe = Probe(
    Case=outcase.Case,
    Points=brep_grid_points.Points,
    Field="U",
    ProbeName="ttt",
    Run=False,
    BakeTimeHistory=False,
    CullHugeVectors=True,
    CullInvalid=True,
    OpenTerminal=True,
    ShowCulled=False)  # -> Values, TimeSteps, SubResults, Points

# ----
# Read Dataset with Results
wind_direction_angle = ValueList({"0", "45", "90", "135", "180", "225", "270", "315"}, selected="0")

concatenate = Concatenate(Fragment_B="\Dataset\", A="ML_Basic_Test_0", B="_", C=wind_direction_angle, D=".csv")

dataset_reader = DatasetReader(CSVPath=concatenate, Run=Toggle(False))  # -> SDF, Bldg_height, Z_relative, U_over_Uref, Mag_U, X, Y, Dir_sin, Dir_cos, Brep
gradient = Gradient(
    LowerLimit=0,
    UpperLimit=1,
    Parameter=dataset_reader.Mag_U,
    stops=[0: RGB(48, 18, 59), 0.0294: RGB(56, 40, 112), 0.0588: RGB(63, 62, 156), 0.0882: RGB(68, 82, 193), 0.118: RGB(70, 102, 221), 0.147: RGB(71, 122, 241)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])
construct_point = ConstructPoint(XCoordinate=dataset_reader.X, YCoordinate=dataset_reader.Y, ZCoordinate=dataset_reader.Z_relative)
custom_preview = CustomPreview(Geometry=construct_point, Material=gradient)
