# Grasshopper definition ML_Inference_moving_circle.ghx (Grasshopper 1.0.8)
# plug-ins: Outdoor, Eddy3D

# Description: Purpose: Explore wind across a large context by dragging a 450 m analysis circle over it.
# Fidelity: Screening, not CFD - Yel 2.0 model.
# Method: Settle Data waits for the slider to be released, then Wind Predictor reruns on a 2 m grid 1.8 m above the circle.
# Result: A jet velocity mesh with a 0 to 5 m/s legend and a Wind Compass sized to the circle.
# Needs: Nothing to install; ML Model downloads Yel 2.0 on first use. Runtime: seconds to minutes.
# Edit: Context, circle radius, wind direction (Value List, southeast by default).
# Related work to cite:
# Karadag, I., & Kastner, P. (in press).
#  Advancements in wind analysis:
# Surrogate models and GPU-accelerated solvers.
# In U. Passe & F. Battaglia (Eds.),
# Designing natural ventilation strategies
# using computational fluid dynamics:
# A guide for architects. Routledge.
select_template = SelectTemplate()

# ---- group: wind direction
list = ValueList({"North": 0, "Northeast": 45, "East": 90, "Southeast": 135, "South": 180, "Southwest": 225, "West": 270, "Northwest": 315}, selected="Southeast")

# ----
winddir = ControlKnob(Decimals=0, Limit=True, Maximum=359, Minimum=0, Range=360, Value=144)

# ---- group: Wind Speed
panel = Panel("5")

# ---- group: Legend Settings
dom = ConstructDomain(DomainStart=0, DomainEnd=panel)

# ----
list_2 = ValueList({"Velocity": 0, "Turbulent Kinetic Energy": 1}, selected="Velocity")
entwine = Entwine(Branch00=dom, FlattenInputs=True)  # -> simplify(Result)
branch = TreeBranch(Tree=entwine, Path=list_2, MaintainPaths=True)

# ---- group: Geometry Input / Buildings
brep = Brep([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])

# ---- group: Geometry Input
preview = CustomPreview(Geometry=brep, Material=ColourSwatch(SwatchColor=RGB(204, 204, 204)))

# ----
token = FilePath("D:\GithubProjects\Conditional_Transformer\TokenHF\HF_Token.txt")
mlmodel = MLModel(Model="Yel 2.0", HFToken=token, Run=Toggle(True), MLModelInputLayoutVersion=2)  # -> Status, FilePath, Progress

panel_2 = Panel(mlmodel.Status)

# ---- group: Terrain- Do not change, try to center your geometry accordingly.
md_slider = MDSlider(
    SliderMode=0,
    slider_value=Point(0.6884471136, 0.3271980732, 0.5),
    x_domain=Domain(-1000, 1000),
    y_domain=Domain(-1000, 1000),
    z_domain=Domain(0, 1))
settle = SettleData(Data=md_slider)
cir = Circle(Plane=md_slider, Radius=450)

# ----
cir_2 = Circle(Plane=settle, Radius=450)

# ---- group: Terrain- Do not change, try to center your geometry accordingly. / TERRAIN
srf = Surface(cir_2)

# ---- group: Terrain- Do not change, try to center your geometry accordingly. (continued)
move = Move(Geometry=srf, Motion=Vector(0, 0, 1.8))  # -> Geometry, Transform
area = Area(Geometry=move.Geometry)  # -> Area, Centroid
dim = Dimensions(Surface=move.Geometry)  # -> UDimension, VDimension
brepgrid = BrepGridPoints(Geometry=move.Geometry, Spacing="2")  # -> Points, Vectors, Mesh, Status

# ----
swatch = ColourSwatch(SwatchColor=RGB(0, 0, 0))
abl = AtmosphericBoundaryLayer(
    WindDirections=list,
    WindSpeed=panel,
    TurbulentEpsilonΕ=0.135,
    TurbulentOmegaΩ=100,
    TerrainType="Custom (z0 input)",
    InletProfile="Log law (Richards & Hoxey)",
    DisplacementHeight=0,
    AblOutputLayoutVersion=2)  # -> BoundaryConditions, WindVectors
compass = WindCompass(
    WindDirection=list,
    Radius=expr("x/2", dim.UDimension),
    BasePoint=area.Centroid,
    Color=swatch,
    ArrowScale=0.5,
    StartMonth=1,
    EndMonth=12)  # -> Vector, DirectionName

windpredict = WindPredictor(
    Points=brepgrid.Points,
    Buildings=brep,
    Model=mlmodel.FilePath,
    BoundaryConditions=abl.BoundaryConditions,
    PedestrianLevel=1.8,
    FilterMargin=0,
    Palette="jet",
    LegendDomain=branch,
    Interpolate="Smooth",
    Field="Velocity",
    Level="Pedestrian Level",
    Radius=0.75,
    LegendScale=1,
    MeshType="Square",
    Engine="Auto",
    Run=True,
    WindPredictorInputLayoutVersion=2,
    WindPredictorOutputLayoutVersion=2)  # -> Points, Values, GridMesh, LegendMesh, LegendPoints, LegendValues, BoundaryConditions, ValuesRoof

bnd = Bounds(Numbers=windpredict.Values)
mesh = Mesh(windpredict.GridMesh)
mesh_2 = Mesh(windpredict.LegendMesh)
tag = TextTag3D(Location=windpredict.LegendPoints, Text=windpredict.LegendValues, Size=14, Colour=swatch, Justification=5)
area_2 = Area(Geometry=mesh_2)  # -> Area, Centroid
Y = UnitY(Factor=-100)
Y_2 = UnitY(Factor=-50)
move_2 = Move(Geometry=area_2.Centroid, Motion=Y)  # -> Geometry, Transform
move_3 = Move(Geometry=move_2.Geometry, Motion=Y_2)  # -> Geometry, Transform
concat = Concatenate(
    FragmentA="Incoming wind direction & speed: ",
    FragmentB=compass.DirectionName,
    FragmentC=", ",
    FragmentD=panel,
    FragmentE=" m/s")
tag_2 = TextTag3D(Location=move_3.Geometry, Text=concat, Size=16, Colour=swatch, Justification=5)

# ---- group: Wind speed range
panel_3 = Panel(bnd)

# ----
concat_2 = Concatenate(FragmentA="Min - Max: ", FragmentB=panel_3)
tag_3 = TextTag3D(Location=move_2.Geometry, Text=concat_2, Size=16, Colour=swatch, Justification=5)
