# Grasshopper definition ABL_Verification.ghx (Grasshopper 1.0.8)
# plug-ins: Outdoor, Eddy3D

pt = ConstructPoint(XCoordinate=40, YCoordinate=30, ZCoordinate=0)
# Description: Purpose: Does the boundary layer imposed at the inlet survive to the buildings?
# Fidelity: Engineering - a partial ASCE/SEI CWE Prestandard approach-flow check, run in the real domain rather than an empty one.
# Method: Steady RANS (realizable k-epsilon, 400 iterations) in a Box Domain; ABL of 5 m/s at 10 m, z0 1 m.
# Result: U on two vertical rakes at x = 0 and x = 40 m, from 2.5 to 77.5 m, plotted together; some decay is expected.
# Needs: Eddy3D Setup > (U)RANS CFD (OpenFOAM). Runtime: minutes.
# Edit: ABL speed and z0, domain, mesh settings, rake positions.
pt_2 = ConstructPoint(XCoordinate=80, YCoordinate=50, ZCoordinate=20)
pt_3 = ConstructPoint(XCoordinate=40, YCoordinate=70, ZCoordinate=0)
pt_4 = ConstructPoint(XCoordinate=80, YCoordinate=90, ZCoordinate=20)
box_domain = BoxDomain(
    CellSize="25",
    FrontExtension=-1,
    BackExtension=-1,
    SideExtension=-1,
    TopExtension=-1,
    RefinementBoxExtension=-1,
    WakeRefinement=3)
mesh_settings = MeshSettings(
    RefinementBoxLevel=2,
    BuildingSurfaceLevel=2,
    BuildingFeatureLevel=2,
    GroundSurfaceLevel=3,
    LayerCount=4,
    AddLayers=False,
    Snap=True,
    GradingStrengthHorizontal="25",
    GradingStrengthVertical="25",
    AdaptiveGrading=True,
    CellsBetweenLevels=-1)
atmospheric_boundary_layer = AtmosphericBoundaryLayer(
    ReferenceHeight=10,
    RoughnessLengthZ0=1,
    GroundHeight=0,
    TurbulentKEK=0.015,
    TurbulentEpsilonΕ=0.135,
    TurbulentOmegaΩ=100,
    TerrainType="Custom (z0 input)",
    InletProfile="Log law (Richards & Hoxey)",
    DisplacementHeight=0,
    AblOutputLayoutVersion=2)  # -> BoundaryConditions, WindVectors
run_settings = RunSettings(
    Iterations=400,
    WriteInterval=20,
    KeepTimeSteps=3,
    TurbulenceModel="realizableKE",
    CPUCount="12",
    SolverAlgorithm="SIMPLE",
    AgeOfAir=False,
    Numerics="0,0.5,0.5",
    PotentialFoamInit=True,
    WarmUpIterations=-1,
    FieldMonitors=False,
    PedestrianAverage=False,
    PressureCoefficient=False,
    Convergence=0.0001,
    AutoStopOnPlateau=False,
    Duration=-1,
    TimeStep=-1,
    MaxCourant=-1,
    AveragingWindow=-1,
    PressureSolver="GAMG",
    LaplacianScheme="auto",
    MeshQualityPreset="auto",
    PedestrianHeight=1.75,
    Guideline="None",
    ConcurrentDirections=1,
    EmptyDomainCheck=False)  # -> RunSettings, DebugLogs
box = Box2Pt(PointA=pt, PointB=pt_2, Plane=PlaneXY(0, 0, 0))
box_2 = Box2Pt(PointA=pt_3, PointB=pt_4, Plane=PlaneXY(0, 0, 0))
merge = Merge(Data1=box, Data2=box_2)
outdoor_case = OutdoorCase(
    CaseName="ABLVerification",
    BoundaryConditions=atmospheric_boundary_layer.BoundaryConditions,
    DomainParameters=box_domain,
    Buildings=merge,
    MeshSettings=mesh_settings,
    RunSettings=run_settings.RunSettings,
    Engine="BlueCFD",
    Write=False,
    ClearCase=False,
    AutoName="merry-lemur-dune-quill",
    AutoWrapGeometry=False,
    ClayLook=True,
    OutdoorCaseInputLayoutVersion=7,
    PreviewBuildings=False,
    PreviewDimensions=True,
    PreviewGrid3D=False,
    PreviewGroundGrid=True,
    PreviewRefinementBox=True,
    PreviewWindArrows=True,
    RepairGeometry=True)  # -> Logs, WriteLogs, Case, Domain, RefinementBox, Buildings, PedestrianPoints, Terrain
plot_residuals = PlotResiduals(Case=outdoor_case.Case, Plot=False, ResidualViewerTarget=0)
live_residuals = LiveResiduals(Case=outdoor_case.Case, Live=True, DirectionDegrees=-1, ShowResidualGoals=False)
meshing_progress = MeshingProgress(Case=outdoor_case.Case, Live=True)  # -> Progress, Phase, Done, Status
panel = Panel([meshing_progress.Progress, meshing_progress.Phase, meshing_progress.Status, meshing_progress.Done])
open_in_paraview = OpenInParaView(Case=outdoor_case.Case, Open=False, ComfortMetric=1, DirectionIndex=-1, ParaviewInputLayoutVersion=2, Streamlines=True)
run = Run(Case=outdoor_case.Case, Mesh=False, Simulate=False, RunAll=False, Parallel=True, DirectionIndex=-1, ShowZones=False)
parse_case_logs = ParseCaseLogs(Case=outdoor_case.Case, Run=False)  # -> LogSummary, Errors, Warnings
panel_2 = Panel([parse_case_logs.LogSummary, parse_case_logs.Errors, parse_case_logs.Warnings])
series = Series(Start=2.5, Step=5, Count=16)
pt_5 = ConstructPoint(XCoordinate=40, YCoordinate=60, ZCoordinate=series)
pt_6 = ConstructPoint(XCoordinate=0, YCoordinate=60, ZCoordinate=series)
merge_2 = Merge(Data1=pt_6, Data2=pt_5)
# ABL APPROACH-FLOW VERIFICATION
# ASCE/SEI CWE Prestandard PO 4-1 / AC 4-1.
# Units: METERS.
# 
# WHAT THIS CHECKS: does the atmospheric boundary
# layer imposed at the inlet still exist by the
# time it reaches the buildings? Every wind study
# assumes it does; the Prestandard makes checking
# it a required step before the building run.
# 
# TWO VERTICAL RAKES on the canyon centreline
# (y = 60), 16 points each from Series:
# 2.5 m to 77.5 m in 5 m steps.
#   x = 0   the approach flow near the inlet
#   x = 40  the upwind face of the buildings
# Compare the two profiles. Probe Field is "U".
# That series contains all six heights the fixture
# rakes (2.5 / 7.5 / 17.5 / 32.5 / 52.5 / 77.5),
# which are cell centres of ITS 5 m z-mesh.
# 
# ABL: 5 m/s at 10 m reference height, z0 = 1 m -
# the three numbers TestAblSelfSustainmentContainer
# E2E writes its analytic log law against.
# Iterations 400, the fixture's count.
# 
# *** SCOPE LIMIT - READ THIS ***
# The Prestandard asks for an EMPTY domain. That
# cannot be built here: OutdoorCaseCMP returns
# early with "Connect at least one closed building
# mesh to the Buildings input", so no Case object
# is produced without geometry. This template
# therefore rakes the REAL domain, which answers
# "has the profile decayed by the building
# position" but not the standard's empty-domain
# form.
# 
# The fixture's own stations (y = 5 / 105 / 195 in
# a 100 x 200 x 100 m empty box) belong to that
# empty domain and do not transfer to this site.
# 
# A decay here is EXPECTED, not a bug: the log-law
# ABL solves OpenFOAM's epsilon equation only at
# sigmaEps = 1.1674, and stock kEpsilon runs 1.3.
# The point is to see how big it is.
# 
# Automating the AC 5-9 error integral
# (eps_ABL-U <= 0.1) is feature F2 in
# docs/ASCE-CWE-PRESTANDARD-COMPLIANCE.md and does
# not ship. Nothing here computes it.
# 
# Action toggles ship OFF.
probe = Probe(
    Case=outdoor_case.Case,
    Points=merge_2,
    Field="U",
    Run=False,
    AutoProbeName="polite-octopus-glade-needle",
    BakeTimeHistory=False,
    CullHugeVectors=True,
    CullInvalid=True,
    OpenTerminal=True,
    ShowCulled=False)  # -> Values, TimeSteps, SubResults, Points
wind_field_viewer = WindFieldViewer(
    Velocity=probe.Values,
    Points=merge_2,
    DisplayMode="Vector Field",
    ColorMap="Viridis",
    Scale=1,
    VectorPlane="3D",
    ArrowheadScaling="Linear",
    SeedCount=120,
    VectorFieldViewerInputLayoutVersion=2)  # -> Geometry, Colors, Range
