# Grasshopper definition Facade_Pressure.ghx (Grasshopper 1.0.8)
# plug-ins: Outdoor, Eddy3D, Eddy3D-Radiance

series = Series(Start=0, Step="45", Count="8")
pt = ConstructPoint(XCoordinate=40, YCoordinate=70, ZCoordinate=0)
pt_2 = ConstructPoint(XCoordinate=80, YCoordinate=90, ZCoordinate=20)
# Description: Purpose: Wind pressure coefficients on facades for building energy models, over eight wind directions.
# Fidelity: Engineering - steady RANS mean Cp, not validated for this building.
# Method: Outdoor Case with a Cylinder Domain, directions 0 to 315 degrees in 45 degree steps, Cp output on in Run Settings.
# Result: Cp at 1 m facade points (set Probe Field to Cp); Airflow Network Cp writes an EnergyPlus .idf snippet.
# Needs: Eddy3D Setup > (U)RANS CFD (OpenFOAM). Runtime: hours.
# Edit: The two 40 x 20 x 20 m blocks: replace them with your building.
pt_3 = ConstructPoint(XCoordinate=80, YCoordinate=50, ZCoordinate=20)
pt_4 = ConstructPoint(XCoordinate=40, YCoordinate=30, ZCoordinate=0)
cylinder_domain = CylinderDomain(
    CoreCellSize=25,
    InnerCoreSize=-1,
    OuterRadius=-1,
    Height=-1,
    RadialMultiplier=2,
    CoreDivisions=1,
    RefinementBoxExtension=-1,
    RadialGrading=7,
    CoreRoundness=0.65,
    VerticalGrading=35)
mesh_settings = MeshSettings(
    RefinementBoxLevel=2,
    BuildingSurfaceLevel=2,
    BuildingFeatureLevel=2,
    GroundSurfaceLevel=3,
    LayerCount=4,
    AddLayers=False,
    Snap=True,
    GradingStrengthHorizontal="25",
    GradingStrengthVertical="25",
    AdaptiveGrading=True,
    CellsBetweenLevels=-1)
atmospheric_boundary_layer = AtmosphericBoundaryLayer(
    WindDirections=series,
    ReferenceHeight=10,
    RoughnessLengthZ0=1,
    GroundHeight=0,
    TurbulentKEK=0.015,
    TurbulentEpsilonΕ=0.135,
    TurbulentOmegaΩ=100,
    TerrainType="Custom (z0 input)",
    InletProfile="Log law (Richards & Hoxey)",
    DisplacementHeight=0,
    AblOutputLayoutVersion=2)  # -> BoundaryConditions, WindVectors
run_settings = RunSettings(
    Iterations="100",
    WriteInterval=20,
    KeepTimeSteps=3,
    TurbulenceModel="realizableKE",
    CPUCount=-1,
    SolverAlgorithm="SIMPLEC",
    AgeOfAir=False,
    Numerics="0.5,0.5,0",
    PotentialFoamInit=True,
    WarmUpIterations=-1,
    FieldMonitors=True,
    PedestrianAverage=False,
    PressureCoefficient=True,
    Convergence=0.0001,
    AutoStopOnPlateau=True,
    Duration=-1,
    TimeStep=-1,
    MaxCourant=-1,
    AveragingWindow=-1,
    PressureSolver="GAMG",
    LaplacianScheme="auto",
    MeshQualityPreset="auto",
    PedestrianHeight=1.75,
    Guideline="None",
    ConcurrentDirections=1,
    EmptyDomainCheck=False)  # -> RunSettings, DebugLogs
box = Box2Pt(PointA=pt, PointB=pt_2, Plane=PlaneXY(0, 0, 0))
box_2 = Box2Pt(PointA=pt_4, PointB=pt_3, Plane=PlaneXY(0, 0, 0))
merge = Merge(Data1=box_2, Data2=box)
outdoor_case = OutdoorCase(
    CaseName="FacadePressure",
    BoundaryConditions=atmospheric_boundary_layer.BoundaryConditions,
    DomainParameters=cylinder_domain,
    Buildings=merge,
    MeshSettings=mesh_settings,
    RunSettings=run_settings.RunSettings,
    Engine="BlueCFD",
    Write=False,
    ClearCase=False,
    AutoName="merry-lemur-dune-quill",
    AutoWrapGeometry=False,
    ClayLook=True,
    OutdoorCaseInputLayoutVersion=7,
    PreviewBuildings=False,
    PreviewDimensions=True,
    PreviewGrid3D=False,
    PreviewGroundGrid=True,
    PreviewRefinementBox=True,
    PreviewWindArrows=True,
    RepairGeometry=True)  # -> Logs, WriteLogs, Case, Domain, RefinementBox, Buildings, PedestrianPoints, Terrain
plot_residuals = PlotResiduals(Case=outdoor_case.Case, Plot=False, ResidualViewerTarget=0)
live_residuals = LiveResiduals(Case=outdoor_case.Case, Live=True, DirectionDegrees=-1, ShowResidualGoals=False)
meshing_progress = MeshingProgress(Case=outdoor_case.Case, Live=True)  # -> Progress, Phase, Done, Status
panel = Panel([meshing_progress.Progress, meshing_progress.Phase, meshing_progress.Status, meshing_progress.Done])
open_in_paraview = OpenInParaView(Case=outdoor_case.Case, Open=False, ComfortMetric=1, DirectionIndex=-1, ParaviewInputLayoutVersion=2, Streamlines=True)
run = Run(Case=outdoor_case.Case, Mesh=False, Simulate=False, RunAll=False, Parallel=True, DirectionIndex=-1, ShowZones=False)
parse_case_logs = ParseCaseLogs(Case=outdoor_case.Case, Run=False)  # -> LogSummary, Errors, Warnings
panel_2 = Panel([parse_case_logs.LogSummary, parse_case_logs.Errors, parse_case_logs.Warnings])
facgrid = FacadeGrid(Geometry=outdoor_case.Buildings, Spacing=1, Offset=0.05, MaxTilt=45, Flip=False)  # -> Points, Normals, Areas, Grid, Report
probe = Probe(
    Case=outdoor_case.Case,
    Points=facgrid.Points,
    ProbeName="Facade_Probes",
    Run=False,
    AutoProbeName="keen-lynx-reef-prism",
    BakeTimeHistory=False,
    CullHugeVectors=True,
    CullInvalid=True,
    OpenTerminal=True,
    ShowCulled=False)  # -> Values, TimeSteps, SubResults, Points
afncp = AirflowNetworkCp(
    CpValues=probe.Values,
    BoundaryConditions=atmospheric_boundary_layer.BoundaryConditions,
    Points=facgrid.Points,
    GroundZ=0,
    Write=False)  # -> IDF, Path
# FACADE PRESSURE
# Wind-driven facade Cp, and the EnergyPlus
# AirflowNetwork hand-off. Units: METERS.
# 
# CHAIN
# Outdoor Case > Buildings (the meshed geometry)
#   -> Facade Grid    1 m spacing, 0.05 m offset,
#      Max Tilt 45 so only near-vertical faces
#      count as facade (90 would include roofs and
#      ground). Flip off.
#   -> Probe          Field "Cp", at those points,
#      on the solved case
#   -> Airflow Network Cp
#      writes a WindPressureCoefficientArray, per
#      node WindPressureCoefficientValues and
#      ExternalNode objects as an .idf snippet to
#      merge into a Ladybug Tools AirflowNetwork
#      model. Ground Z 0. Write ships OFF and the
#      File Path is empty, so opening this document
#      cannot write a file.
# The ABL component's Boundary Conditions feed
# Airflow Network Cp so the exported array carries
# the simulated wind directions.
# 
# FACADE WIND PRESSURE sits alongside as the
# analytic EN 1991-1-4 cross-check: basic wind
# 25 m/s, opening at 10 m on a 20 x 40 m building,
# zone D (windward), terrain 3 (suburban). It is
# NOT wired into the CFD chain - it is the
# code-based number you compare the simulated Cp
# against.
# 
# *** TWO THINGS TO KNOW ***
# 1. Probe and Airflow Network Cp show warnings
#    until the case is solved. That is the
#    unsolved state, not a wiring fault: this
#    template deliberately ships no cached results.
# 2. Airflow Network Cp's own help says "Enable
#    Pressure Coefficient in Run Settings". On the
#    installed 1.9.0.827 Run Settings has no such
#    input - it is not in the component's parameter
#    list. Until it appears, the Cp field has to
#    come from whatever your build writes; check
#    the case's function objects before probing.
# 
# Nothing in the shipped catalog used Facade Grid,
# Facade Wind Pressure or Airflow Network Cp before
# this template.
# 
# Action toggles ship OFF.
panel_3 = Panel(afncp.IDF)
